# Grasshopper definition Kangaroo01.gh (Grasshopper 0.9.76)
# plug-ins: Biomorpher, Python Interpreter, MeshMachine, Kangaroo Components, PlanktonGh, Weaverbird

crv = Curve(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)
srf = Surface(crv)
timer = Timer(TimerInterval=20, Target=meshmachine)  # disabled
meshmachine = MeshMachine(
    Geometry=srf,
    Length=Slider(2, range=0..10),
    FixCurves=crv,
    Flip=1,
    PullStrength=0.8,
    CurvatureAdaptivity=0,
    BoundaryScale=1,
    BoundaryDistance=5,
    Reset=Toggle(False))
pmesh = PlanktonMesh(meshmachine)
dam = DataDam(DataA=pmesh, BufferDelay=10000000, BufferMode=0)
mesh = Mesh(dam)
number_slider = Slider(10, range=0..10)
nv = NakedVertices(Mesh=mesh)  # -> ClothedIndex, NakedIndex, ClothedPts, NakedPts
springsfrommesh = SpringsFromMesh(M=mesh, stiffness=Slider(1, range=0..100), B=Slider(0, range=0..100))
number_slider_2 = Slider(14, range=0..100)
culln = CullNth(List=nv.NakedPts, CullFrequency=Slider(5, range=0..10))
number_slider_3 = Slider(82, range=0..100)
dispatch = Dispatch(List=nv.NakedPts, DispatchPattern=[True, True, True, False])  # -> ListA, ListB
Z = UnitZ(Factor=Slider(100, range=0..10000))
neg = Negative(Value=Z)
item = ListItem(List=nv.ClothedPts, Index=[number_slider_2, number_slider_3], Wrap=True)
uforce = UnaryForce(Point=item, Force=neg)
kangaroo_settings = KangarooSettings(
    Tolerance=0.001,
    TimeStep=0.01,
    SubIterations=10,
    Floor=False,
    Drag=1,
    Restitution=0.7,
    StaticFriction=10,
    KineticFriction=10,
    Settle=2,
    Tumble=1,
    Sound=False,
    Solver=0)
zombie = ZombieKangaroo(
    ForceObjects=flatten([springsfrommesh, uforce]),
    AnchorPoints=dispatch.ListA,
    Settings=null,
    Geometry=mesh,
    Threshold=0.1,
    MaxIters=2000)  # -> Out, Iterations, ParticlesOut, GeometryOut, KE
wbloop = WeaverbirdsLoopSubdivision(MeshCurves=zombie.GeometryOut, Level=Slider(2, range=0..10), SmoothNakedEdges=1)
python = PythonScript(mesh=wbloop)  # -> out, a, b, c, d, e; inputs mesh: Mesh
# ---------- python: Python ----------
import System
plankton_dir = System.Environment.GetEnvironmentVariable("appdata")
plankton_dir += "\\Grasshopper\\Libraries\\"
import clr
clr.AddReferenceToFileAndPath(plankton_dir + "Plankton.dll")
import Plankton
clr.AddReferenceToFileAndPath(plankton_dir + "Plankton.gha")
import PlanktonGh.RhinoSupport as planktongh
from Rhino.Geometry import Line

def main():
    _mesh = planktongh.ToPlanktonMesh(mesh)
    
    _dual = dual(_mesh)
    
    a = planktongh.ToPolylines(_dual)
    b = clothededges(_dual)
    c = [planktongh.ToPoint3d(v) for v in _dual.Vertices]
    d = [c[i] for i in range(len(c)) if _dual.Vertices.IsBoundary(i)]
    
    # get vertex edge windings (wip)
    #vedges = []
    #for i in range(_dual.Vertices.Count):
    #    if (not _dual.Vertices.IsBoundary(i)):
    #        [h for h in _dual.Vertices.GetHalfedges(i)]
    #    else:
    #        vedges.append([])
    
    return a, b, c, d

def dual(mesh):
    # initialise the dual mesh
    dmesh = Plankton.PlanktonMesh()
    # add a dual vertex at the center of every primal face
    for i in range(mesh.Faces.Count):
        c = mesh.Faces.GetFaceCenter(i)
        dmesh.Vertices.Add(c.X, c.Y, c.Z)
    mplookup = []
    for i in range(0, mesh.Halfedges.Count, 2):
        if (mesh.Halfedges.IsBoundary(i)):
            mp = midpoint(mesh, i)
            n = dmesh.Vertices.Add(mp[0], mp[1], mp[2])
            mplookup += [n, n]
        else:
            mplookup += [-1, -1]
    # 
    
    for i in range(mesh.Vertices.Count):
        # create face for all "clothed" vertices
        if (not mesh.Vertices.IsBoundary(i)):
            vf = mesh.Vertices.GetVertexFaces(i)
            dmesh.Faces.AddFace(vf)
        # handle boundary vertices (special case)
        else:
            vf = [x for x in mesh.Vertices.GetVertexFaces(i) if x != -1]
            h = mesh.Vertices[i].OutgoingHalfedge
            vf += [mplookup[mesh.Halfedges[h].PrevHalfedge], mplookup[h]]
            #print vf, dmesh.Vertices.Count
            dmesh.Faces.AddFace(vf)
    return dmesh

def midpoint(mesh, i):
    hs = mesh.Halfedges
    x = 0.5 * (mesh.Vertices[hs[i].StartVertex].X + mesh.Vertices[hs.EndVertex(i)].X)
    y = 0.5 * (mesh.Vertices[hs[i].StartVertex].Y + mesh.Vertices[hs.EndVertex(i)].Y)
    z = 0.5 * (mesh.Vertices[hs[i].StartVertex].Z + mesh.Vertices[hs.EndVertex(i)].Z)
    return [x, y, z]

def clothededges(mesh):
    lines = []
    for i in range(0, mesh.Halfedges.Count, 2):
        if (not mesh.Halfedges.IsBoundary(i)):
            pt0 = mesh.Vertices[mesh.Halfedges[i].StartVertex]
            pt1 = mesh.Vertices[mesh.Halfedges.EndVertex(i)]
            lines.append(Line(pt0.X, pt0.Y, pt0.Z, pt1.X, pt1.Y, pt1.Z))
    return lines

import Rhino.Geometry as rg
from clr import AddReference as addr
addr("Grasshopper")

from clr import AddReference as addr
addr("Grasshopper")
from Grasshopper import DataTree
from Grasshopper.Kernel.Data import GH_Path

def raggedListToDataTree(raggedList):
    rl = raggedList
    result = DataTree[object]()
    for i in range(len(rl)):
        path = GH_Path(i)
        result.AddRange(rl[i], path)
    return result

if __name__ == "__main__":
    a, b, c, d = main()
# ---------- end python ----------
crv_2 = Curve(python.a)
wbframe = WeaverbirdsPictureFrame(MeshPolylines=crv_2, Distance=5, InsetType=0)
wbthicken = WeaverbirdsMeshThicken(MeshCurves=wbframe, Distance=Slider(0.45, range=0..1), OffsetType=0)
biomorpher = Biomorpher(Genome=[number_slider_2, Slider(104, range=0..1000), number_slider_3], Geometry=wbthicken)
preview = CustomPreview(Geometry=wbthicken, Shader=ColourSwatch(SwatchColor=RGB(158, 158, 158)))

# ==== cluster SpringsFromMesh: Turns all edges of a mesh into springs
M = ClusterInput()
medges = MeshEdges(Mesh=M)  # -> NakedEdges, InteriorEdges, NonManifoldEdges
crv = Curve([medges.NakedEdges, medges.InteriorEdges])
B = ClusterInput()
len = Length(Curve=crv)
multiplication = Multiplication(A=len, B=B)
stiffness = ClusterInput()
springs = SpringsFromLine(Connection=crv, Stiffness=stiffness, Damping=10, RestLength=multiplication, UpperCutoff=0, LowerCutoff=0, Plasticity=0)
S = ClusterOutput(springs)
