# Grasshopper definition Kangaroo1.gh (Grasshopper 0.9.76)
# plug-ins: Biomorpher, Kangaroo Components

genes = GenePool(Decimals=2, Maximum=10, Minimum=0, Value=[2.279644954, 5.686693432, 6.545814958, 8.761600389, 2.714091367])
genes_2 = GenePool(Decimals=2, Maximum=10, Minimum=0, Value=[1.836453023, 7.951319205, 5.051922945, 3.977137799, 2.058431278])
pt = ConstructPoint(XCoordinate=genes, YCoordinate=genes_2, ZCoordinate=0)
nurbs = NurbsCurve(Vertices=pt, Degree=3, Periodic=True)  # -> Curve, Length, Domain
number_slider = Slider(52, range=0..100)
srf = Surface(nurbs.Curve)
mesh_uv = MeshSurface(Surface=srf, UCount=number_slider, VCount=number_slider, Overhang=False, Equalize=False)
number_slider_2 = Slider(0, range=0..100)
nv = NakedVertices(Mesh=mesh_uv)  # -> ClothedIndex, NakedIndex, ClothedPts, NakedPts
dispatch = Dispatch(List=nv.NakedPts, DispatchPattern=[True, False, False, False, False, False, False, False, False, False, False, False])  # -> ListA, ListB
gravity = Gravity(M=mesh_uv, F=Slider(0.15, range=0..1))
springsfrommesh = SpringsFromMesh(M=mesh_uv, stiffness=1000, B=1)
zombie = ZombieKangaroo(
    ForceObjects=flatten([gravity, springsfrommesh]),
    AnchorPoints=dispatch.ListA,
    Settings=null,
    Geometry=mesh_uv,
    Threshold=0.1,
    MaxIters=2000)  # -> Out, Iterations, ParticlesOut, GeometryOut, KE
biomorpher = Biomorpher(Genome=[genes, genes_2], Geometry=zombie.GeometryOut)

# ==== cluster Gravity: Apply gravity to vertices of a mesh
M = ClusterInput()
F = ClusterInput()
mcomp = Decompose(Mesh=M)  # -> Vertices, Faces, Colours, Normals
Z = UnitZ(Factor=F)
duppt = RemoveDuplicatePts(Points=mcomp.Vertices, Tolerance=0.01)
uforce = UnaryForce(Point=duppt, Force=Z)
U = ClusterOutput(uforce)

# ==== cluster SpringsFromMesh: Turns all edges of a mesh into springs
M = ClusterInput()
medges = MeshEdges(Mesh=M)  # -> NakedEdges, InteriorEdges, NonManifoldEdges
crv = Curve([medges.NakedEdges, medges.InteriorEdges])
B = ClusterInput()
len = Length(Curve=crv)
multiplication = Multiplication(A=len, B=B)
stiffness = ClusterInput()
springs = SpringsFromLine(Connection=crv, Stiffness=stiffness, Damping=10, RestLength=multiplication, UpperCutoff=0, LowerCutoff=0, Plasticity=0)
S = ClusterOutput(springs)
