# Grasshopper definition Karamba01.gh (Grasshopper 0.9.76)
# plug-ins: Biomorpher, Karamba, LunchBox, Mesh Pipe

number_slider = Slider(7, range=3..10)
srf = Surface(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)
number_slider_2 = Slider(7, range=3..10)
number_slider_3 = Slider(1, range=0..1)
diagrid = DiagridStructure(Surface=srf, UDivisions=number_slider, VDivisions=number_slider_2, Type=True)  # -> StructureLines, StructureNodes
hex = HexagonalStructure(Surface=srf, UDivisions=number_slider, VDivisions=number_slider_2, AdjustShape=0.3, Type=False)  # -> StructureLines, StructureNodes
filter = StreamFilter(Gate=number_slider_3, Stream0=diagrid.StructureLines, Stream1=hex.StructureLines)
linetobeam = LineToBeamKaramba(Line=flatten(filter), New=True, Remove=True, LimitDistance_m=0.005)  # -> Points, Element, Info
Z = UnitZ(Factor=Slider(-1000, range=-1000..0))
basesupports = BaseSupports(pt=linetobeam.Points)  # -> supports, not
crosecrselect = CrossSectionRangeSelectorKaramba(MaximumHeight_cm=-1, MaximumWidth_cm=-1, menu=[dropdown(2), dropdown(2), dropdown(2)])
loads = LoadsKaramba(ForceVector=Z, Local=True, PosInd=basesupports.not, LCase=0, mode="Point")
supp = SupportKaramba(PosInd=basesupports.supports, menu=[buttons(on, on, on, off, off, off)])
item = ListItem(List=crosecrselect, Index=Slider(305, range=0..1000), Wrap=True)
assemble = AssembleModelKaramba(Elem=linetobeam.Element, Support=supp, Load=loads, CrossSection=item, LimitDistance_m=0.005)  # -> Model, Info, Mass_kg, CenterOfGravity
analyzethi = AnalyzeThIKaramba(Model=assemble.Model)  # -> CalculatedModel, MaximumDisplacement_m, ResultingForceOfGravity_kN, ElasticEnergy_kNm
modelview = ModelViewKaramba(Model=analyzethi.CalculatedModel, LoadCaseFactorsForLinearSuperposition=1, IndexIncrementOfVisibleLoadcase=0)  # -> Model, DeformedMesh, DeformedAxes, DeformedModel
crv = Curve(srf)
beamview = BeamViewKaramba(Model=modelview.Model)  # -> Model, MeshesOfRenderedBeams, DeformedBeamAxes, LegendColors, LegendTags
mpipe = MeshPipe(Curve=crv, Radius=Slider(0.34, range=0..1), Accuracy=0.2, Rotation=0, Segments=10, Caps=2)
biomorpher = Biomorpher(
    Sliders=[number_slider_2, number_slider, number_slider_3],
    Geometry=flatten([beamview.MeshesOfRenderedBeams, mpipe]),
    Performas=analyzethi.MaximumDisplacement_m)

# ==== cluster BaseSupports: Gets bottom 1% of points (in z direction)
pt = ClusterInput()
pt_2 = Point(pt)
pdecon = Deconstruct(Point=pt_2)  # -> XComponent, YComponent, ZComponent
bnd = Bounds(Numbers=pdecon.ZComponent)
dedomain = DeconstructDomain(Domain=bnd)  # -> Start, End
subtraction = Subtraction(A=dedomain.End, B=dedomain.Start)
multiplication = Multiplication(A=subtraction, B=Slider(0.01, range=0..0.01))
addition = Addition(A=dedomain.Start, B=multiplication)
smaller = SmallerThan(FirstNumber=pdecon.ZComponent, SecondNumber=addition)  # -> SmallerThan, OrEqualTo
dispatch = Dispatch(List=pt_2, DispatchPattern=smaller.SmallerThan)  # -> Supports, ListB
supports = ClusterOutput(dispatch.Supports)
not = ClusterOutput(dispatch.ListB)
