# Grasshopper definition QuadTreeMassing.gh (Grasshopper 0.9.76)
# plug-ins: Biomorpher, MeshEdit Components

genes = GenePool(
    Decimals=2,
    Maximum=10,
    Minimum=0,
    Value=[6.971748679, 9.79116329, 4.467704894, 0.4046273373, 6.872336891, 9.10738735, 3.152177154, 9.775503324, 5.756004618, 0.1747750818])
genes_2 = GenePool(
    Decimals=2,
    Maximum=10,
    Minimum=0,
    Value=[7.632473715, 8.623180491, 0.6913130873, 3.948725329, 6.815604333, 1.453058129, 6.899106268, 0.1533294935, 2.456592625, 4.458943235])
genes_3 = GenePool(
    Decimals=2,
    Maximum=5,
    Minimum=1,
    Value=[3.428756845, 1.000489727, 3.164029571, 2.475554657, 4.032247867, 1.13250945, 4.956331594, 3.797549745, 2.389153401, 4.974645419])
pt = ConstructPoint(XCoordinate=genes, YCoordinate=genes_2, ZCoordinate=0)
xy = XYPlane(Origin=Point(0, 0, 0))
qt = QuadTree(Points=pt, Plane=xy, Square=False, Group=Slider(1, range=0..10))  # -> Quads, Points
brep = Brep(qt.Quads)
join = BrepJoin(Breps=brep)  # -> Breps, Closed
fmerge = MergeFaces(Brep=join.Breps)  # -> Breps, Before, After
lng = ListLength(List=fmerge.Breps)
split = SplitList(List=genes_3, Index=lng)  # -> ListA, ListB
Z = UnitZ(Factor=split.ListA)
extr = Extrude(Base=fmerge.Breps, Direction=Z)
jagged = SettingsSpeed()
edges = BrepEdges(Brep=extr)  # -> Naked, Interior, NonManifold
mesh = MeshBrep(Brep=extr, Settings=jagged)
lng_2 = ListLength(List=mesh)
preview = CustomPreview(Geometry=[edges.Naked, edges.Interior, edges.NonManifold], Shader=ColourSwatch(SwatchColor=RGB(255, 255, 255)))
series = Series(Start=0, Step=1, Count=lng_2)
gradient = Gradient(
    LowerLimit=0,
    UpperLimit=lng_2,
    Parameter=series,
    stops=[0: RGB(33, 29, 28), 0: RGB(234, 126, 0), 0: RGB(245, 156, 194), 0: RGB(254, 244, 84), 1: RGB(75, 107, 169)])
mcol = MeshColours(Mesh=graft(mesh), Colours=graft(gradient))
volume = MeshVolume(Mesh=mcol)  # -> Volume, Centroid
ma = MassAddition(Input=flatten(volume.Volume))  # -> Result, PartialResults
biomorpher = Biomorpher(Genome=[genes, genes_2, genes_3], Geometry=mcol, Performance=ma.Result)  # -> GenoGuids, Population, Historic, Clusters
