# Grasshopper definition SimpleQuadTree.gh (Grasshopper 0.9.76)
# plug-ins: Biomorpher

genes = GenePool(
    Decimals=2,
    Maximum=10,
    Minimum=0,
    Value=[1.56772079, 9.664830514, 3.254978002, 5.103932971, 7.864238633, 8.862027288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])
genes_2 = GenePool(
    Decimals=2,
    Maximum=10,
    Minimum=0,
    Value=[6.419132006, 9.262221479, 7.046364307, 1.84267839, 6.72402494, 8.387233111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])
pt = ConstructPoint(XCoordinate=genes, YCoordinate=genes_2, ZCoordinate=0)
qt = QuadTree(Points=pt, Plane=PlaneXY(0, 0, 0), Square=False, Group=Slider(1, range=0..10))  # -> Quads, Points
mesh = Mesh(qt.Quads)
biomorpher = Biomorpher(Genome=[genes, genes_2], Geometry=mesh)
