# Grasshopper definition K1Example_HenryMoore.gh (Grasshopper 0.9.76)
# plug-ins: Biomorpher, Karamba, MarchingCubes, MeshEdit Components, Kangaroo Components, Weaverbird

genes = GenePool(Decimals=4, Maximum=1, Minimum=0, Value=[0.7779748093, 0.1204145065, 0.5540946102, 0.4193489915, 0.008609703534])
# Sculptures are generated resembling the work of the artist Henry Moore.
# You will need Karamba3d, Kangaroo 1, Weaverbird and Cocoon plug-ins.
# Double click on the biomorpher component to begin.
crv = Curve(reparameterize(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))
seam = Seam(Curve=crv, Seam=Slider(0.34, range=0..1))
eval = EvaluateCurve(Curve=reparameterize(seam), Parameter=genes)  # -> Point, Tangent, Angle
nearn = NearestNeighborsKaramba(FromPoints=eval.Point, ToPoints=eval.Point, NumberOfNeighbors=Slider(2, range=0..10), LimitDistance=-1)  # -> flatten(Line), Connectivity, Points
len = Length(Curve=nearn.Line)
division = Division(A=len, B=Slider(8, range=0..100))
divide = DivideCurve(Curve=nearn.Line, Count=division, Kinks=False)  # -> Points, Tangents, Parameters
pline = PolyLine(Vertices=divide.Points, Closed=False)
explode = Explode(Curve=pline, Recursive=True)  # -> Segments, Vertices
Z = UnitZ(Factor=Slider(20, range=0..100))
springs = SpringsFromLine(
    Connection=explode.Segments,
    Stiffness=Slider(9, range=0..1000),
    Damping=10,
    RestLength=0,
    UpperCutoff=0,
    LowerCutoff=0,
    Plasticity=0)
uforce = UnaryForce(Point=explode.Vertices, Force=Z)
end = EndPoints(Curve=nearn.Line)  # -> Start, End
zombie = ZombieKangaroo(
    ForceObjects=flatten([springs, uforce]),
    AnchorPoints=[end.Start, end.End],
    Settings=null,
    Geometry=pline,
    Threshold=0.1,
    MaxIters=2000)  # -> Out, Iterations, ParticlesOut, GeometryOut, KE
curve_charge = CurveCharge(Curve=flatten(zombie.GeometryOut), Radius=Slider(12, range=0..100), ChargeStrengths=Slider(7.76, range=0..10))
cocoon = Cocoon(
    Charges=flatten(curve_charge),
    Iso=Slider(4.01, range=0..10),
    CellSize=Slider(4, range=0..10),
    Execute=Toggle(True),
    Simple=False)  # -> Mesh, RefinementData
wblaplace = WeaverbirdsLaplacianSmoothing(MeshCurves=cocoon.Mesh, Level=Slider(10, range=0..10), SmoothNakedEdges=2, Thin=1)
mcol = MeshColours(Mesh=wblaplace, Colours=ColourSwatch(SwatchColor=RGB(129, 67, 141)))
volume = MeshVolume(Mesh=wblaplace)  # -> Volume, Centroid
addition = Addition(A=volume.Volume, B=Slider(0, range=0..100))
biomorpher = Biomorpher(Genome=genes, Geometry=mcol, Performance=addition)  # -> GenoGuids, Population, Historic, Clusters
