# Grasshopper definition QuadTreeMassing.gh (Grasshopper 0.9.76)
# plug-ins: Biomorpher, MeshEdit Components

genes = GenePool(
    Decimals=2,
    Maximum=10,
    Minimum=0,
    Value=[8.825921877, 1.48, 9.063528661, 5.314335216, 3.808547974, 0.9837192308, 1.223621904, 3.385109089, 7.726852939, 2.87149421])
genes_2 = GenePool(
    Decimals=2,
    Maximum=10,
    Minimum=0,
    Value=[3.380479731, 3.900179429, 1.449093913, 3.462743141, 9.651963287, 4.780964265, 0.9775616365, 9.34, 6.224481446, 5.859961527])
genes_3 = GenePool(
    Decimals=2,
    Maximum=5,
    Minimum=1,
    Value=[4.61, 2.7, 2.048452809, 2.224476613, 1.46954347, 2.811814051, 3.023414679, 2.737269494, 1.771011935, 4.225100876])
pt = ConstructPoint(XCoordinate=genes, YCoordinate=genes_2, ZCoordinate=0)
xy = XYPlane(Origin=Point(0, 0, 0))
qt = QuadTree(Points=pt, Plane=xy, Square=False, Group=Slider(1, range=0..10))  # -> Quads, Points
brep = Brep(qt.Quads)
join = BrepJoin(Breps=brep)  # -> Breps, Closed
fmerge = MergeFaces(Brep=join.Breps)  # -> Breps, Before, After
lng = ListLength(List=fmerge.Breps)
split = SplitList(List=genes_3, Index=lng)  # -> ListA, ListB
Z = UnitZ(Factor=split.ListA)
extr = Extrude(Base=fmerge.Breps, Direction=Z)
jagged = SettingsSpeed()
edges = BrepEdges(Brep=extr)  # -> Naked, Interior, NonManifold
mesh = MeshBrep(Brep=extr, Settings=jagged)
lng_2 = ListLength(List=mesh)
preview = CustomPreview(Geometry=[edges.Naked, edges.Interior, edges.NonManifold], Shader=ColourSwatch(SwatchColor=RGB(255, 255, 255)))
series = Series(Start=0, Step=1, Count=lng_2)
gradient = Gradient(
    LowerLimit=0,
    UpperLimit=lng_2,
    Parameter=series,
    stops=[0: RGB(33, 29, 28), 0: RGB(234, 126, 0), 0: RGB(245, 156, 194), 0: RGB(254, 244, 84), 1: RGB(75, 107, 169)])
mcol = MeshColours(Mesh=graft(mesh), Colours=graft(gradient))
preview_2 = CustomPreview(Geometry=extr, Shader=gradient)
volume = MeshVolume(Mesh=mcol)  # -> Volume, Centroid
ma = MassAddition(Input=flatten(volume.Volume))  # -> Result, PartialResults
biomorpher = Biomorpher(Genome=[genes_2, genes_3], Geometry=flatten(mcol), Performance=ma.Result)  # -> GenoGuids, Population, Historic, Clusters

number_slider = Slider(4, range=0..10)  # disabled
id = Guid()  # disabled
num = Number()  # disabled
biomorpherreader = BiomorpherReader(GenoGuids=id, Population=num, DesignID=number_slider)  # disabled
