# Grasshopper definition Superformula.gh (Grasshopper 1.0.7)
# plug-ins: Mesh Pipe, Biomorpher

b = Slider(0.35, range=0..1)

# ---- group: c
number_slider = Slider(0.24, range=0..1)

# ---- group: d
b_2 = Slider(0.2, range=0..1)

# ---- group: a
# https://en.wikipedia.org/wiki/Superformula
# Double click on the biomorpher component to begin.
# Needs meshpipe component.
number_slider_2 = Slider(0.41, range=0..1)

# ----
b_3 = Slider(0.35, range=0..1)

# ---- group: c
number_slider_3 = Slider(0.24, range=0..1)

# ---- group: a
number_slider_4 = Slider(0.41, range=0..1)

# ---- group: d
b_4 = Slider(0.2, range=0..1)

# ----
cluster = Cluster(A=number_slider_2, A_3=b, A_4=number_slider, A_2=b_2)
intcrv = Interpolate(Vertices=cluster, Degree=3, Periodic=True, KnotStyle=1)  # -> Curve, Length, Domain
mpipe = MeshPipe(Curve=intcrv.Curve, Radius=Slider(0.03, range=0..0.1), Accuracy=0.2, Rotation=0, Segments=10, Caps=2)
divide = DivideCurve(Curve=intcrv.Curve, Count=Slider(100, range=0..100), Kinks=False)  # -> Points, Tangents, Parameters
mcol = MeshColours(Mesh=mpipe, Colours=ColourSwatch(SwatchColor=RGB(0, 0, 0)))
curvature = Curvature(Curve=intcrv.Curve, Parameter=divide.Parameters)  # -> P, K, C

# ---- group: Variance of curvature
vlen = VectorLength(Vector=curvature.K)
cluster_2 = Cluster_2(num=vlen)

# ----
biomorpher = Biomorpher(Genome=[number_slider, b, number_slider_2], Meshes=mcol, Perform=[cluster_2, intcrv.Length])

# ==== cluster Cluster
number_slider = Slider(300, range=0..1000)
pi = Pi(Factor=Slider(2, range=0..10))
division = Division(A=pi, B=number_slider)
A = ClusterInput()
series = Series(Start=0, Step=division, Count=number_slider)
A_2 = ClusterInput()
A_3 = ClusterInput()
A_4 = ClusterInput()
multiplication = Multiplication(A=A, B="6")
multiplication_2 = Multiplication(A=A_2, B="6")
multiplication_3 = Multiplication(A=A_3, B="6")
multiplication_4 = Multiplication(A=A_4, B="6")
multiplication_5 = Multiplication(A=series, B=multiplication)
j = Slider(3, range=0..10)
multiplication_6 = Multiplication(A=series, B=multiplication_4)

# ---- group: k
j_2 = Slider(3, range=0..10)

# ----
multiplication_7 = Multiplication(A=series, B=multiplication_3)
multiplication_8 = Multiplication(A=series, B=multiplication_2)
sin = Sine(Value=multiplication_6)
cos = Cosine(Value=multiplication_7)
sin_2 = Sine(Value=multiplication_8)
cos_2 = Cosine(Value=multiplication_5)
cos_3 = Cosine(Value=multiplication_6)
pow = Power(A=cos, B=j)
pow_2 = Power(A=sin_2, B=j_2)
subtraction = Subtraction(A=sin, B=pow_2)
subtraction_2 = Subtraction(A=cos_2, B=pow)
pt = ConstructPoint(XCoordinate=subtraction_2, YCoordinate=subtraction, ZCoordinate=0)
pt_2 = ClusterOutput(pt)

# ==== cluster Cluster_2
num = ClusterInput()
num_2 = Number(num)
avr = Average(Input=num_2)
subtraction = Subtraction(A=avr, B=num_2)
lng = ListLength(List=num_2)
sqr = Square(Value=subtraction)
ma = MassAddition(Input=sqr)  # -> Result, PartialResults
division = Division(A=ma.Result, B=lng)
R = ClusterOutput(division)
