# Grasshopper definition boxes.gh (Grasshopper 0.9.76)
# plug-ins: Biomorpher

# In this example, genepools are used to
# create boxes which are then subtracted
# from the overall bounding box.
# 
# Double click on the Biomorpher component.
genes = GenePool(
    Decimals=2,
    Maximum=10,
    Minimum=0,
    Value=[4.959088581, 9.990276139, 5.012814546, 6.304255928, 0.5247623274, 6.61906679, 2.841034861, 0.4670463594, 8.947114044, 5.544233967])
genes_2 = GenePool(
    Decimals=2,
    Maximum=10,
    Minimum=0,
    Value=[6.123133035, 7.226054468, 5.427158662, 8.777649967, 3.922365746, 4.620724529, 3.076948152, 6.891269634, 0.9555963269, 4.996630821])
genes_3 = GenePool(
    Decimals=2,
    Maximum=10,
    Minimum=0,
    Value=[4.368248888, 0.6740545039, 5.378946381, 0.3553205901, 2.70803313, 6.537658856, 9.554798818, 2.725169968, 0.7372852001, 2.562081705])
genes_4 = GenePool(
    Decimals=2,
    Maximum=10,
    Minimum=0,
    Value=[3.515330989, 5.773093097, 9.186906626, 8.991433112, 2.498626439, 2.197765257, 1.845519202, 6.823700917, 9.09023953, 7.304822798])
genes_5 = GenePool(
    Decimals=2,
    Maximum=10,
    Minimum=0,
    Value=[8.341597167, 6.885146018, 0.8410115967, 0.6926086378, 0.4600623624, 2.960764403, 6.864378402, 9.29909401, 1.436527957, 8.30913768])
genes_6 = GenePool(
    Decimals=2,
    Maximum=10,
    Minimum=0,
    Value=[1.120224068, 6.803368058, 0.2670353067, 7.953495008, 2.830096208, 4.295034077, 4.621329758, 4.647493956, 3.596222798, 3.987103471])
dom = ConstructDomain(DomainStart=genes_5, DomainEnd=genes_6)
dom_2 = ConstructDomain(DomainStart=genes_3, DomainEnd=genes_4)
dom_3 = ConstructDomain(DomainStart=genes, DomainEnd=genes_2)
box = DomainBox(Base=PlaneXY(0, 0, 0), X=dom_3, Y=dom_2, Z=dom)
bbox = BoundingBox(Content=box, Plane=PlaneXY(0, 0, 0), UnionBox=True)  # -> Box, Box_2
volume = Volume(Geometry=bbox.Box)  # -> Volume, Centroid
scale = Scale(Geometry=bbox.Box, Center=volume.Centroid, Factor="0.9")  # -> Geometry, Transform
number_slider = Slider(238, range=0..254)
number_slider_2 = Slider(75, range=0..254)
number_slider_3 = Slider(183, range=0..254)
rgb = ColourRGB(Alpha=255, Red=number_slider, Green=number_slider_2, Blue=number_slider_3)
sdiff = SolidDifference(BrepsA=scale.Geometry, BrepsB=box)
mcol = MeshColours(Mesh=sdiff, Colours=rgb)
preview = CustomPreview(Geometry=sdiff, Shader=rgb)
biomorpher = Biomorpher(
    Genome=[number_slider, number_slider_2, number_slider_3, genes, genes_2, genes_3, genes_4, genes_5, genes_6],
    Geometry=mcol)  # -> GenoGuids, Population, Historic, Clusters
id = Guid([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])
split = SplitList(List=id, Index=Slider(7, range=0..10))  # -> ListA, ListB
num = Number(Tree({0}: [0.2517068626, 0.1297726377, 0.7591281316, 0.6360039936, 0.03156502685, 0.5914129866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], {1}: [0.2517854561, 0.130054319, 0.758669757, 0.6357934662, 0.03164425566, 0.5919310549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], {2}: [0.2511523649, 0.1300658053, 0.7589658184, 0.6363554547, 0.03129835371, 0.5918636011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], {3}: [0.2513210355, 0.1299863771, 0.7587020231, 0.6359893533, 0.03197740267, 0.5914096684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], {4}: [0.2511391822, 0.1304712619, 0.7591663435, 0.6357092263, 0.03140509786, 0.5918581896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], {5}: [0.2518112042, 0.1301244024, 0.7584790487, 0.6356437467, 0.03207603857, 0.5917234238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]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))
id_2 = Guid([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])
biomorpherreader = BiomorpherReader(GenoGuids=id_2, Population=num, DesignID=Slider(8, range=0..10))  # disabled
