# Grasshopper definition cocoon.gh (Grasshopper 0.9.76)
# plug-ins: Biomorpher, MarchingCubes

number_slider = Slider(0.78, range=-2..2)
number_slider_2 = Slider(0.31, range=-2..2)
number_slider_3 = Slider(0.02, range=-2..2)
number_slider_4 = Slider(1.6, range=0..20)
number_slider_5 = Slider(58.5, range=0..100)
number_slider_6 = Slider(8.7, range=0..40)
crv = Curve([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])
pt = Point(Point(-40.83270625, 30.4528106, 21.19580445))
pt_2 = Point([Point(-40.83270625, 41.14856894, 21.19580445), Point(-40.83270625, 19.75705226, 21.19580445)])
point_charge = PointCharge(Point=pt, Radius=number_slider_5, ChargeStrength=number_slider_2)
point_charge_2 = PointCharge(Point=pt_2, Radius=number_slider_6, ChargeStrength=number_slider_3)
brep_charge = BrepCharge(Brep=crv, Radius=number_slider_4, ChargeStrengths=number_slider)
merge = Merge(Data1=point_charge, Data2=point_charge_2, Data3=brep_charge)
cocoon = Cocoon(Charges=merge, Iso=Slider(0.25, range=0..1), CellSize=Slider(10, range=0.5..10), Execute=Toggle(True), Simple=False)  # -> Mesh, RefinementData
refine = Refine(
    RefinementData=cocoon.RefinementData,
    Samples=Slider(30, range=0..30),
    SampleSize=Slider(2, range=0..10),
    SampleTolerance="0.01",
    LaplacianSmoothing=Slider(1, range=0..10),
    ValencePasses=Slider(3, range=0..10),
    SubD=Slider(2, range=0..3),
    Execute=Toggle(True))
preview = CustomPreview(
    Geometry=refine,
    Shader={ambient=RGB(128, 128, 128), diffuse=RGB(0, 0, 0), emission=RGB(51, 111, 111), shine=0.25, specular=RGB(255, 255, 255), transparency=0})
biomorpher = Biomorpher(
    Genome=[number_slider, number_slider_4, number_slider_3, number_slider_6, number_slider_2, number_slider_5],
    Geometry=refine)  # -> GenoGuids, Population, Historic, Clusters
