# Grasshopper definition embryo.gh (Grasshopper 0.9.76)
# plug-ins: Biomorpher, Fröbel, embryoA

block1 = Block1(InTrans=0)  # -> OutBox, OutPlane1, OutPlane2
block2 = Block2(InTrans=1, InHeight=1)  # -> OutBox, OutPlane1, OutPlane2, OutPlane3, OutPoint1
block2_2 = Block2(InTrans=1, InHeight=1)  # -> OutBox, OutPlane1, OutPlane2, OutPlane3, OutPoint1
block2_3 = Block2(InTrans=1, InHeight=1)  # -> OutBox, OutPlane1, OutPlane2, OutPlane3, OutPoint1
link2 = Link2()
# In this example, we combine Biomorpher
# with the plug-in Embryo, to evolve
# parametric models themselves.
number_slider = Slider(37.5, range=0..1000)
g_slider9 = Slider(3.19, range=3..4.5)
g_slider8 = Slider(4.5, range=3..4.5)
g_slider7 = Slider(4.5, range=3..4.5)
g_slider6 = Slider(4.14, range=3..4.5)
g_slider5 = Slider(3.49, range=3..4.5)
g_slider4 = Slider(4.5, range=3..4.5)
g_slider3 = Slider(4.5, range=3..4.5)
g_slider2 = Slider(4.39, range=3..4.5)
g_slider1 = Slider(4.44, range=3..4.5)
g_slider0 = Slider(4.42, range=3..4.5)
number_slider_2 = Slider(4.1, range=0..100)
number_slider_3 = Slider(20, range=0..100)
genes = GenePool(
    Decimals=2,
    Maximum=5,
    Minimum=3,
    Value=[4.416587286, 4.440753315, 4.388625233, 4.705285992, 4.925015335, 3.490529349, 4.138027949, 4.803088911, 4.924837212, 3.194619581])
genes_2 = GenePool(
    Decimals=0,
    Maximum=20,
    Minimum=0,
    Value=[11.77068397, 12.05194021, 14.62216897, 6.339644439, 1.602184103, 6.528827244, 3.019009131, 7.684882417, 7.468495251, 2.899631347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])
genes_3 = GenePool(
    Decimals=0,
    Maximum=4,
    Minimum=0,
    Value=[2.55533434, 1.593634468, 2.586515256, 3.038836142, 0.2661757564, 0.6872621182, 1.005732162, 3.30587499, 0.8986851037, 0.8931140587, 1.814442937, 1.720477466, 0.6493569224, 3.533560471, 0.3721515575, 3.582470974])
pt = ConstructPoint(XCoordinate=number_slider, YCoordinate=50, ZCoordinate=0)
embryo = EmbryoSettings(
    Preview=Toggle(False),
    SliderDomain=Domain(3, 4.5),
    OneToOne=Toggle(True),
    GridX=120,
    GridY=150,
    RemoveDead=Toggle(True),
    OnlyTerminals=False)
xz = XZPlane(Origin=Point(0, 0, 0))
xz_2 = XZPlane(Origin=pt)
parent_output = ParentOutput(O=[xz, xz_2])
parent_output_2 = ParentOutput(O=number_slider_2)
embryo_2 = Embryo(
    Reset=Toggle(True),
    Sliders=Slider(10, range=0..10),
    Components=Slider(16, range=0..100),
    MetricGenes=genes,
    TopologyGenes=genes_2,
    FunctionGenes=genes_3,
    Settings=embryo,
    RandomOveride=0)  # -> Iterations, Components
g_block1 = Block1(InPlane=xz, InLength=g_slider2)  # -> OutBox, OutPlane1, OutPlane2
g_block2 = Block2(InPlane=xz, InLength=g_slider0, AddStoreys=g_slider5)  # -> OutBox, OutPlane1, OutPlane2, OutPlane3, OutPoint1
g_link2 = Link2(InPoint1=xz_2, InPoint2=g_block2.OutPlane2)
g_block2_2 = Block2(InPlane=g_block2.OutPoint1, InLength=1, AddStoreys=1)  # -> OutBox, OutPlane1, OutPlane2, OutPlane3, OutPoint1
g_block2_3 = Block2(InPlane=g_block2.OutPlane1, InLength=g_slider3, AddStoreys=g_slider9)  # -> OutBox, OutPlane1, OutPlane2, OutPlane3, OutPoint1
g_link2_2 = Link2(InPoint1=g_block1.OutPlane1, InPoint2=g_block2_2.OutPlane3)
g_block2_4 = Block2(InPlane=g_block2_3.OutPoint1, InLength=1, AddStoreys=1)  # -> OutBox, OutPlane1, OutPlane2, OutPlane3, OutPoint1
g_block2_5 = Block2(InPlane=g_block2_2.OutPlane1, InLength=1, AddStoreys=1)  # -> OutBox, OutPlane1, OutPlane2, OutPlane3, OutPoint1
g_block2_6 = Block2(InPlane=g_block2_3.OutPlane3, InLength=1, AddStoreys=1)  # -> OutBox, OutPlane1, OutPlane2, OutPlane3, OutPoint1
g_block2_7 = Block2(InPlane=g_block2_3.OutPlane2, InLength=g_slider6, AddStoreys=g_slider4)  # -> OutBox, OutPlane1, OutPlane2, OutPlane3, OutPoint1
g_block2_8 = Block2(InPlane=g_block2_3.OutPlane1, InLength=g_slider8, AddStoreys=g_slider1)  # -> OutBox, OutPlane1, OutPlane2, OutPlane3, OutPoint1
g_block2_9 = Block2(InPlane=g_block2_5.OutPlane1, InLength=1, AddStoreys=1)  # -> OutBox, OutPlane1, OutPlane2, OutPlane3, OutPoint1
g_block1_2 = Block1(InPlane=g_block2_7.OutPlane3, InLength=1)  # -> OutBox, OutPlane1, OutPlane2
g_block2_10 = Block2(InPlane=g_block2_8.OutPlane3, InLength=number_slider_2, AddStoreys=g_slider7)  # -> OutBox, OutPlane1, OutPlane2, OutPlane3, OutPoint1
g_link2_3 = Link2(InPoint1=g_block2_10.OutPlane1, InPoint2=g_block2_8.OutPlane2)
g_block2_11 = Block2(InPlane=g_block2_10.OutPoint1, InLength=1, AddStoreys=1)  # -> OutBox, OutPlane1, OutPlane2, OutPlane3, OutPoint1
get_geometry = GetGeometry(G=[g_block2.OutBox, g_link2, g_block2_3.OutBox, g_block2_8.OutBox, g_block1.OutBox, g_block2_7.OutBox, g_block2_10.OutBox, g_block2_2.OutBox, g_block2_11.OutBox, g_block2_6.OutBox, g_link2_2, g_link2_3, g_block2_5.OutBox, g_block2_4.OutBox, g_block1_2.OutBox, g_block2_9.OutBox])
pi = Pi(Factor=Slider(0, range=0..1))
rotate = Rotate(Geometry=get_geometry, Angle=pi, Plane=PlaneXY(0, 0, 0))  # -> Geometry, Transform
geo = Geometry(rotate.Geometry)
number_slider_4 = Slider(213, range=0..254)
number_slider_5 = Slider(20, range=0..254)
smesh = SimpleMesh(Brep=geo)
rgb = ColourRGB(Alpha=255, Red=number_slider_4, Green=0, Blue=number_slider_5)
mcol = MeshColours(Mesh=smesh, Colours=rgb)
num = Number(Tree({0}: [0.6971748679, 0.979116329, 0.4467704894, 0.04046273373, 0.6872336891, 0.910738735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], {1}: [0.8660840312, 0.891111894, 0.3898351846, 0.4698577116, 0.5513190006, 0.2028903189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], {2}: [0.1139815618, 0.251075558, 0.5254317012, 0.02266043519, 0.4888900022, 0.2257407812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], {3}: [0.1203500634, 0.340388674, 0.6165020725, 0.22692941, 0.09978866256, 0.7631560474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], {4}: [0.3785006517, 0.8187509602, 0.3806390787, 0.2560525896, 0.2114994075, 0.5292100839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], {5}: [0.2791014497, 0.03939760758, 0.5963320353, 0.9723198223, 0.6368473254, 0.7903422093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]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))
num_2 = Number(Tree({0}: [0.08694963906, 0.2915720582, 0.9321724772, 0.7896349415, 0.02190216678, 0.7881899838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], {1}: [0.06566499316, 0.03736237392, 0.03353249144, 0.9257668745, 0.5274363735, 0.650446798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], {2}: [0.3262264674, 0.9140376052, 0.6598325081, 0.2016317673, 0.7516992999, 0.0189338266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], {3}: [0.6001552658, 0.6458249179, 0.2007622706, 0.7957069924, 0.1673611152, 0.2869665731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], {4}: [0.8175321221, 0.4188992388, 0.04766172406, 0.7221879245, 0.2008255325, 0.1569569987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], {5}: [0.0536001297, 0.369945672, 0.7037764619, 0.9125202046, 0.4854861873, 0.0518057016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], {6}: [0.7372050601, 0.9744024118, 0.133575311, 0.2091987665, 0.3155177386, 0.400668435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], {7}: [0.9840167705, 0.6516756176, 0.1448861147, 0.09820992411, 0.5467824985, 0.412733061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], {8}: [0.6416600447, 0.08091126293, 0.8309926297, 0.3772908786, 0.8861833289, 0.0938257026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], {9}: [0.5331826646, 0.8370627155, 0.3565502411, 0.197136005, 0.6197143344, 0.8512522177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], {10}: [0.5700555162, 0.8394454484, 0.6849148086, 0.2660294968, 0.4773108505, 0.7384866833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], {11}: [0.8398068942, 0.07946733715, 0.638833585, 0.3984086171, 0.6466288141, 0.7597090354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]))
biomorpher = Biomorpher(Genome=[genes_3, genes, genes_2, number_slider_4, number_slider_5], Geometry=mcol, InitialPop=num_2)  # -> Population, Clusters, History
panel = Panel(num_2)
panel_2 = Panel(biomorpher.Population)
