# Grasshopper definition embryo01.gh (Grasshopper 0.9.76)
# plug-ins: Biomorpher, Fröbel, embryoA

block1 = Block1(InLength=1)  # -> OutBox, OutPlane1, OutPlane2
block2 = Block2(InLength=1, AddStoreys=1)  # -> OutBox, OutPlane1, OutPlane2, OutPlane3, OutPoint1
link2 = Link2()
g_slider7 = Slider(-6.956, range=-10..10)
g_slider6 = Slider(-5.687, range=-10..10)
g_slider5 = Slider(4.909, range=-10..10)
g_slider4 = Slider(-5.033, range=-10..10)
g_slider3 = Slider(-4.891, range=-10..10)
g_slider2 = Slider(-7.2, range=-10..10)
g_slider1 = Slider(1.719, range=-10..10)
g_slider0 = Slider(-2.055, range=-10..10)
xy = XYPlane(Origin=Point(0, 0, 0))
embryo = EmbryoSettings(
    Preview=True,
    SliderDomain=Domain(-10, 10),
    OneToOne=Toggle(True),
    GridX=120,
    GridY=120,
    RemoveDead=True,
    OnlyTerminals=False)
number_slider = Slider(854533, range=0..1000000)
parent_output = ParentOutput(O=xy)
embryo_2 = Embryo(
    Reset=Toggle(True),
    Sliders=8,
    Components=16,
    MetricGenes=2,
    TopologyGenes=2,
    FunctionGenes=2,
    Settings=embryo,
    RandomOveride=number_slider)  # -> Iterations, Components
g_block2 = Block2(InPlane=xy, InLength=g_slider1, AddStoreys=g_slider7)  # -> OutBox, OutPlane1, OutPlane2, OutPlane3, OutPoint1
g_block1 = Block1(InPlane=g_block2.OutPlane1, InLength=g_slider6)  # -> OutBox, OutPlane1, OutPlane2
g_block2_2 = Block2(InPlane=g_block2.OutPoint1, InLength=g_slider4, AddStoreys=g_slider2)  # -> OutBox, OutPlane1, OutPlane2, OutPlane3, OutPoint1
g_link2 = Link2(InPoint1=g_block2_2.OutPlane3, InPoint2=g_block2.OutPlane3)
g_block2_3 = Block2(InPlane=g_block1.OutPlane2, InLength=1, AddStoreys=1)  # -> OutBox, OutPlane1, OutPlane2, OutPlane3, OutPoint1
g_block2_4 = Block2(InPlane=g_block1.OutPlane1, InLength=g_slider0, AddStoreys=g_slider5)  # -> OutBox, OutPlane1, OutPlane2, OutPlane3, OutPoint1
g_block1_2 = Block1(InPlane=g_block2_4.OutPoint1, InLength=1)  # -> OutBox, OutPlane1, OutPlane2
g_block2_5 = Block2(InPlane=g_block2_4.OutPlane3, InLength=1, AddStoreys=1)  # -> OutBox, OutPlane1, OutPlane2, OutPlane3, OutPoint1
g_block2_6 = Block2(InPlane=g_block2_4.OutPlane1, InLength=g_slider3, AddStoreys=1)  # -> OutBox, OutPlane1, OutPlane2, OutPlane3, OutPoint1
g_link2_2 = Link2(InPoint1=g_block2_2.OutPoint1, InPoint2=g_block1_2.OutPlane2)
g_link2_3 = Link2(InPoint1=g_block2_6.OutPoint1, InPoint2=g_block2_2.OutPlane2)
g_block1_3 = Block1(InPlane=g_block2_5.OutPlane2, InLength=1)  # -> OutBox, OutPlane1, OutPlane2
g_block2_7 = Block2(InPlane=g_block2_6.OutPlane3, InLength=1, AddStoreys=1)  # -> OutBox, OutPlane1, OutPlane2, OutPlane3, OutPoint1
g_block2_8 = Block2(InPlane=g_block2_5.OutPlane3, InLength=1, AddStoreys=1)  # -> OutBox, OutPlane1, OutPlane2, OutPlane3, OutPoint1
g_block2_9 = Block2(InPlane=g_block2_5.OutPoint1, InLength=1, AddStoreys=1)  # -> OutBox, OutPlane1, OutPlane2, OutPlane3, OutPoint1
g_block1_4 = Block1(InPlane=g_block2_9.OutPlane1, InLength=1)  # -> OutBox, OutPlane1, OutPlane2
get_geometry = GetGeometry(G=[g_block2.OutBox, g_block2_2.OutBox, g_link2, g_block1.OutBox, g_block2_4.OutBox, g_block2_6.OutBox, g_block2_5.OutBox, g_block2_3.OutBox, g_block2_9.OutBox, g_block1_2.OutBox, g_block2_8.OutBox, g_block2_7.OutBox, g_block1_4.OutBox, g_link2_3, g_link2_2, g_block1_3.OutBox])
mesh = MeshBrep(
    Brep=get_geometry,
    Settings={GridMaxCount=0, GridMinCount=16, JaggedSeams=False, MaxEdgeLength=0, MinEdgeLength=0.0001, MinTolerance=0, Refine=True, RefineAngle=0, RelativeTolerance=0.65, SimplePlanes=True, Tolerance=0})
biomorpher = Biomorpher(Sliders=number_slider, Geometry=mesh)
