# Grasshopper definition embryo03.gh (Grasshopper 0.9.76)
# plug-ins: embryoA

box = Box2Pt(Plane=PlaneXY(0, 0, 0))
number_slider = Slider(8, range=0..10)
pop3d = Populate3D(Region={Plane=PlaneXY(0, 0, 0), X=Domain(0, 10), Y=Domain(0, 10), Z=Domain(0, 2)}, Count=Slider(10, range=0..10), Seed=1)
embryo = Embryo(
    Reset=Toggle(True),
    Sliders=0,
    Components=16,
    MetricGenes=2,
    TopologyGenes=2,
    FunctionGenes=2,
    Settings=null,
    RandomOveride=Slider(486, range=0..1000))  # -> Iterations, Components
item = ListItem(List=pop3d, Index=0, Wrap=True)  # -> Item, Item1, Item2, Item3, Item4, Item5, Item6, Item7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
pt = Point(item.Item)
pt_2 = Point(item.Item1)
pt_3 = Point(item.Item2)
pt_4 = Point(item.Item3)
pt_5 = Point(item.Item5)
pt_6 = Point(item.Item6)
pt_7 = Point(item.Item4)
pt_8 = Point(item.Item7)
pt_9 = Point(item.Item8)
pt_10 = Point(item.Item10)
pt_11 = Point(item.Item9)
xy = XYPlane(Origin=Point(0, 0, 0))
parent_output = ParentOutput(O=[pt_11, pt_9, pt_8, pt_6, pt_5, pt_7, pt_4, pt_3, pt_2, pt])
parent_output_2 = ParentOutput(O=xy)
g_box = Box2Pt(PointA=pt_11, PointB=pt, Plane=pt_5)
g_box_2 = Box2Pt(PointA=pt_7, PointB=pt_9, Plane=pt)
g_box_3 = Box2Pt(PointA=pt_9, PointB=pt_4, Plane=pt)
g_box_4 = Box2Pt(PointA=pt_5, PointB=pt_6, Plane=pt_11)
g_box_5 = Box2Pt(PointA=pt_7, PointB=pt_4, Plane=pt_3)
g_box_6 = Box2Pt(PointA=pt_2, PointB=pt_6, Plane=xy)
g_box_7 = Box2Pt(PointA=pt_2, PointB=pt_5, Plane=pt_8)
g_box_8 = Box2Pt(PointA=pt_7, PointB=pt_6, Plane=pt_9)
g_box_9 = Box2Pt(PointA=pt_4, PointB=pt_7, Plane=pt_11)
g_box_10 = Box2Pt(PointA=pt_7, PointB=pt_4, Plane=pt_3)
g_box_11 = Box2Pt(PointA=pt_2, PointB=pt_4, Plane=pt_5)
g_box_12 = Box2Pt(PointA=pt_7, PointB=pt, Plane=pt_8)
g_box_13 = Box2Pt(PointA=pt_8, PointB=pt_11, Plane=pt_9)
g_box_14 = Box2Pt(PointA=pt_6, PointB=pt_2, Plane=pt_4)
g_box_15 = Box2Pt(PointA=pt_2, PointB=pt_3, Plane=pt_4)
g_box_16 = Box2Pt(PointA=pt_6, PointB=pt_8, Plane=pt_2)
