# Grasshopper definition extrusions.gh (Grasshopper 0.9.76)
# plug-ins: Biomorpher

genes = GenePool(
    Decimals=2,
    Maximum=100,
    Minimum=0,
    Value=[55.44867842, 83.47159799, 65.32355191, 55.35311835, 66.48404185, 34.05401005, 83.03384372, 78.54722413, 69.08359521, 74.86499034, 49.92509584, 74.33846656, 21.21507573, 11.78030309, 73.83656565, 11.32094043, 61.59553326, 70.61285731, 27.78398954, 7.911107208])
genes_2 = GenePool(
    Decimals=2,
    Maximum=40,
    Minimum=0,
    Value=[0.4494426892, 23.81656569, 1.707247271, 12.09783701, 29.43010545, 31.6577207, 34.58380387, 35.28328804, 36.86931922, 24.91641046, 26.49464012, 5.7827423, 25.06373687, 23.64733289, 20.37588078, 38.36640333, 18.85188752, 31.50148311, 4.400277656, 39.10111299])
genes_3 = GenePool(
    Decimals=2,
    Maximum=100,
    Minimum=0,
    Value=[79.88760633, 11.95327072, 34.60682611, 76.98473599, 31.30679253, 63.42928728, 31.08145419, 4.77157715, 96.05385444, 16.75051895, 93.74842123, 83.86104357, 14.15681828, 38.94935716, 50.00282545, 25.70699566, 27.56745331, 38.30964412, 40.31627641, 57.1231841])
genes_4 = GenePool(
    Decimals=2,
    Maximum=100,
    Minimum=0,
    Value=[47.09450037, 95.32562363, 86.87392607, 6.292569058, 9.128390047, 34.96824009, 12.17912438, 61.59674351, 60.34060113, 77.42055732, 63.69122163, 82.3418255, 60.11216317, 30.53120706, 27.51566365, 48.58937666, 22.85343227, 84.07925408, 63.41916943, 54.16530895])
genes_5 = GenePool(
    Decimals=2,
    Maximum=20,
    Minimum=0,
    Value=[3.099666784, 16.8165989, 4.619085718, 10.49828261, 19.63591275, 1.856400859, 0.9862402345, 6.050834593, 0.6237509682, 11.00648755, 3.542505703, 2.610151886, 19.39517061, 4.53219081, 10.03165642, 17.01396399, 13.1320608, 5.879082576, 2.21209481, 6.371436602])
genes_6 = GenePool(
    Decimals=2,
    Maximum=100,
    Minimum=0,
    Value=[80.89544356, 52.03423006, 36.18798194, 20.6888641, 67.3254231, 19.90995467, 63.14596784, 2.876515191, 64.61279151, 39.18188502, 63.61146239, 57.454596, 10.02565458, 31.90516921, 55.49957738, 96.40726421, 78.70347982, 34.57895938, 82.27785472, 87.83974009])
pt = ConstructPoint(XCoordinate=genes_3, YCoordinate=genes, ZCoordinate=0)
pt_2 = ConstructPoint(XCoordinate=genes_6, YCoordinate=genes_4, ZCoordinate=0)
qt = QuadTree(Points=pt, Plane=PlaneXY(0, 0, 0), Square=False, Group=Slider(1, range=0..10))  # -> Quads, Points
qt_2 = QuadTree(Points=pt_2, Plane=PlaneXY(0, 0, 0), Square=False, Group=Slider(1, range=0..10))  # -> Quads, Points
runion = RegionUnion(Curves=qt.Quads)
runion_2 = RegionUnion(Curves=qt_2.Quads)
fillet = Fillet(Curve=runion, Radius=Slider(8.4, range=0..10))
fillet_2 = Fillet(Curve=runion_2, Radius=Slider(2.9, range=0..10))
lng = ListLength(List=fillet)
lng_2 = ListLength(List=fillet_2)
split = SplitList(List=genes_2, Index=lng)  # -> ListA, ListB
split_2 = SplitList(List=genes_5, Index=lng_2)  # -> ListA, ListB
Z = UnitZ(Factor=split.ListA)
extr = Extrude(Base=fillet, Direction=Z)
Z_2 = UnitZ(Factor=split_2.ListA)
extr_2 = Extrude(Base=fillet_2, Direction=Z_2)
cap = CapHoles(Brep=extr)
cap_2 = CapHoles(Brep=extr_2)
smooth = SettingsQuality()
smooth_2 = SettingsQuality()
mesh = MeshBrep(Brep=cap_2, Settings=smooth)
mesh_2 = MeshBrep(Brep=cap, Settings=smooth_2)
preview = CustomPreview(Geometry=mesh_2, Shader="Pink")
preview_2 = CustomPreview(Geometry=mesh, Shader="LightBlue")
biomorpher = Biomorpher(Genome=[genes_3, genes, genes_2, genes_6, genes_4, genes_5], Geometry=[mesh_2, mesh])
