# Grasshopper definition genepools.gh (Grasshopper 0.9.76)
# plug-ins: Biomorpher

genes = GenePool(
    Decimals=2,
    Maximum=100,
    Minimum=0,
    Value=[83.42290569, 39.37934722, 15.58125182, 11.90288964, 75.62036616, 91.76326827, 16.94937345, 46.92580639, 25.75292425, 0.2801711151])
genes_2 = GenePool(
    Decimals=2,
    Maximum=100,
    Minimum=0,
    Value=[16.762256, 45.41896047, 46.08697726, 58.41880577, 69.59078705, 11.34666546, 79.36153932, 37.12221479, 96.23455609, 73.13829609])
genes_3 = GenePool(
    Decimals=2,
    Maximum=100,
    Minimum=0,
    Value=[42.78690232, 87.59122522, 8.523010946, 5.040196372, 10.51952197, 5.516273947, 66.94181838, 76.70640538, 71.37669656, 93.49774446])
genes_4 = GenePool(
    Decimals=2,
    Maximum=100,
    Minimum=0,
    Value=[94.09969484, 5.952726792, 19.27651095, 27.26151394, 21.81982308, 57.58789771, 38.95445778, 68.14227518, 83.70602751, 64.12730569])
genes_5 = GenePool(
    Decimals=2,
    Maximum=100,
    Minimum=0,
    Value=[69.01014526, 2.957596355, 61.43283008, 85.64420831, 75.04483848, 27.83306854, 1.202364616, 48.03758431, 35.32082119, 28.9202163])
genes_6 = GenePool(
    Decimals=2,
    Maximum=100,
    Minimum=0,
    Value=[31.33030296, 92.63518107, 73.58986285, 89.73173438, 94.48420088, 76.34640097, 13.76484642, 33.76777072, 7.098407376, 95.64361093])
pt = ConstructPoint(XCoordinate=genes_4, YCoordinate=genes_5, ZCoordinate=genes_6)
pt_2 = ConstructPoint(XCoordinate=genes, YCoordinate=genes_2, ZCoordinate=genes_3)
series = Series(Start=0, Step=1, Count=10)
box = Box2Pt(PointA=pt_2, PointB=pt, Plane=PlaneXY(0, 0, 0))
bnd = Bounds(Numbers=series)
smesh = SimpleMesh(Brep=box)
dedomain = DeconstructDomain(Domain=bnd)  # -> Start, End
volume = Volume(Geometry=smesh)  # -> Volume, Centroid
gradient = Gradient(
    LowerLimit=dedomain.Start,
    UpperLimit=dedomain.End,
    Parameter=series,
    stops=[0: RGB(234, 38, 0), 0.25: RGB(234, 126, 0), 0.5: RGB(254, 244, 84), 0.75: RGB(173, 203, 249), 1: RGB(75, 107, 169)])
ma = MassAddition(Input=volume.Volume)  # -> Result, PartialResults
biomorpher = Biomorpher(Genome=[genes, genes_2, genes_3, genes_4, genes_5, genes_6], Geometry=smesh, Performance=ma.Result)
preview = CustomPreview(Geometry=smesh, Shader=gradient)
