# Grasshopper definition henryMoore.gh (Grasshopper 0.9.76)
# plug-ins: Biomorpher, Karamba, MarchingCubes, MeshEdit Components, Kangaroo Components, Weaverbird

genes = GenePool(Decimals=4, Maximum=1, Minimum=0, Value=[0.9149927242, 0.6022206965, 0.2322777744, 0.2628457652, 0.6999864977])
crv = Curve(reparameterize(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))
seam = Seam(Curve=crv, Seam=Slider(0.34, range=0..1))
eval = EvaluateCurve(Curve=reparameterize(seam), Parameter=genes)  # -> Point, Tangent, Angle
offset = Offset(Curve=crv, Distance=Slider(10, range=0..10), Plane=PlaneXY(0, 0, 0), Corners=1)
srf = Surface(offset)
preview = CustomPreview(Geometry=srf, Shader=ColourSwatch(SwatchColor=RGB(173, 173, 173)))
nearn = NearestNeighborsKaramba(FromPoints=eval.Point, ToPoints=eval.Point, NumberOfNeighbors=Slider(2, range=0..10), LimitDistance=-1)  # -> flatten(Line), Connectivity, Points
len = Length(Curve=nearn.Line)
division = Division(A=len, B=Slider(8, range=0..100))
end = EndPoints(Curve=nearn.Line)  # -> Start, End
divide = DivideCurve(Curve=nearn.Line, Count=division, Kinks=False)  # -> Points, Tangents, Parameters
pline = PolyLine(Vertices=divide.Points, Closed=False)
explode = Explode(Curve=pline, Recursive=True)  # -> Segments, Vertices
Z = UnitZ(Factor=Slider(20, range=0..100))
uforce = UnaryForce(Point=explode.Vertices, Force=Z)
springs = SpringsFromLine(
    Connection=explode.Segments,
    Stiffness=Slider(9, range=0..1000),
    Damping=10,
    RestLength=0,
    UpperCutoff=0,
    LowerCutoff=0,
    Plasticity=0)
zombie = ZombieKangaroo(
    ForceObjects=flatten([springs, uforce]),
    AnchorPoints=[end.Start, end.End],
    Settings=null,
    Geometry=pline,
    Threshold=0.1,
    MaxIters=2000)  # -> Out, Iterations, ParticlesOut, GeometryOut, KE
curve_charge = CurveCharge(Curve=flatten(zombie.GeometryOut), Radius=Slider(12, range=0..100), ChargeStrengths=Slider(7.76, range=0..10))
cocoon = Cocoon(
    Charges=flatten(curve_charge),
    Iso=Slider(4.01, range=0..10),
    CellSize=Slider(4, range=0..10),
    Execute=Toggle(True),
    Simple=False)  # -> Mesh, RefinementData
wblaplace = WeaverbirdsLaplacianSmoothing(MeshCurves=cocoon.Mesh, Level=Slider(10, range=0..10), SmoothNakedEdges=2, Thin=1)
volume = MeshVolume(Mesh=wblaplace)  # -> Volume, Centroid
preview_2 = CustomPreview(Geometry=wblaplace, Shader=ColourSwatch(SwatchColor=RGB(129, 67, 141)))
addition = Addition(A=volume.Volume, B=Slider(0, range=0..100))
biomorpher = Biomorpher(Genome=genes, Geometry=wblaplace, Performance=addition)
