# Grasshopper definition karamba.gh (Grasshopper 0.9.76)
# plug-ins: Biomorpher, Karamba, Kangaroo Components, LunchBox

# ---- group: u
# Manually optimise a complex truss (yes, Voronoi again... bah humbug)
# You will need Karamba3d and the Lunch box plug-ins.
# Double click on the biomorpher component to begin.
genes = GenePool(
    Decimals=3,
    Maximum=1,
    Minimum=0,
    Value=[0.4576993927, 0.3653588739, 0.5552672374, 0.1197834286, 0.7238192641, 0.4651649042, 0.9497743766, 0.0782518499, 0.3583987445, 0.1308822451, 0.8442528242, 0.2247912703])

# ---- group: v
genes_2 = GenePool(
    Decimals=3,
    Maximum=1,
    Minimum=0,
    Value=[0.1903640345, 0.9850544864, 0.4975956397, 0.7393037275, 0.2574609999, 0.9097722503, 0.8666450264, 0.8373036607, 0.006354022774, 0.1451801831, 0.6088575924, 0.0350524746])

# ----
crv = Curve(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)
crv_2 = Curve(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)
number_slider = Slider(1, range=0..10)
rulesrf = RuledSurface(CurveA=crv, CurveB=crv_2)
rebuildsrf = RebuildSurface(
    Surface=rulesrf,
    UDegree=number_slider,
    VDegree=number_slider,
    UNumber=Slider(20, range=0..100),
    VNumber=Slider(5, range=0..10))

# ---- group: w
genes_3 = GenePool(
    Decimals=3,
    Maximum=5,
    Minimum=0,
    Value=[1.239257418, 2.095798856, 1.098147503, 3.200740923, 2.92908328, 3.79625797, 3.911399533, 4.804946938, 3.043483297, 1.834716055, 4.670783959, 0.4810224639])

# ----
Y = UnitY(Factor="5")
pt = ConstructPoint(XCoordinate=genes, YCoordinate=genes_2, ZCoordinate=0)
extr = Extrude(Base=rebuildsrf, Direction=Y)
evalsrf = EvaluateSurface(Surface=reparameterize(rebuildsrf), Point=pt)  # -> Point, Normal, Frame
bbox = BoundingBox(Content=extr, Plane=PlaneXY(0, 0, 0))  # -> Box, Box_2
Y_2 = UnitY(Factor=genes_3)
volume = Volume(Geometry=bbox.Box)  # -> Volume, Centroid
move = Move(Geometry=evalsrf.Point, Motion=Y_2)  # -> Geometry, Transform
scale = Scale(Geometry=bbox.Box, Center=volume.Centroid, Factor="1.1")  # -> Geometry, Transform
debrep = DeconstructBrep(Brep=extr)  # -> Faces, Edges, Vertices
voronoi³ = Voronoi3D(Points=move.Geometry, Box=scale.Geometry)  # -> Cells, Boundary
sint = SolidIntersection(BrepsA=graft(extr), BrepsB=graft(voronoi³.Cells))
edges = BrepEdges(Brep=sint)  # -> Naked, Interior, NonManifold
item = ListItem(List=debrep.Vertices, Index="31", Wrap=True)
item_2 = ListItem(List=debrep.Vertices, Index="1", Wrap=True)
basesupports = BaseSupports(pt=debrep.Vertices)  # -> supports, not
explode = Explode(Curve=flatten([edges.Naked, edges.Interior, edges.NonManifold]), Recursive=True)  # -> Segments, Vertices
Z = UnitZ(Factor=Slider(-300, range=-1000..0))
dupln = RemoveDuplicateLines(Lines=flatten(explode.Segments), Tolerance=0.01)
loads = LoadsKaramba(ForceVector=Z, Local=True, PosInd=[item, item_2], LCase=0, mode="Point")
supp = SupportKaramba(PosInd=basesupports.supports, menu=[buttons(on, on, on, on, on, on)])
linetobeam = LineToBeamKaramba(Line=dupln, New=True, Remove=True, LimitDistance_m=0.005)  # -> Points, Element, Info
crosecrselect = CrossSectionRangeSelectorKaramba(MaximumHeight_cm=-1, MaximumWidth_cm=-1, menu=[dropdown(2), dropdown(3), dropdown(4)])
item_3 = ListItem(List=crosecrselect, Index="174", Wrap=True)
assemble = AssembleModelKaramba(Elem=linetobeam.Element, Support=supp, Load=loads, CrossSection=item_3, LimitDistance_m=0.005)  # -> Model, Info, Mass_kg, CenterOfGravity
analyzethi = AnalyzeThIKaramba(Model=assemble.Model)  # -> CalculatedModel, MaximumDisplacement_m, ResultingForceOfGravity_kN, ElasticEnergy_kNm
modelview = ModelViewKaramba(Model=analyzethi.CalculatedModel, LoadCaseFactorsForLinearSuperposition=1, IndexIncrementOfVisibleLoadcase=0)  # -> Model, DeformedMesh, DeformedAxes, DeformedModel
beamview = BeamViewKaramba(Model=modelview.Model)  # -> Model, MeshesOfRenderedBeams, DeformedBeamAxes, LegendColors, LegendTags
mesh = Mesh(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)
biomorpher = Biomorpher(
    Genome=[genes, genes_3, genes_2],
    Geometry=[beamview.MeshesOfRenderedBeams, mesh],
    Performance=analyzethi.MaximumDisplacement_m)

# ==== cluster BaseSupports: Gets bottom 1% of points (in z direction)
pt = ClusterInput()
pt_2 = Point(pt)
pdecon = Deconstruct(Point=pt_2)  # -> XComponent, YComponent, ZComponent
bnd = Bounds(Numbers=pdecon.ZComponent)
dedomain = DeconstructDomain(Domain=bnd)  # -> Start, End
subtraction = Subtraction(A=dedomain.End, B=dedomain.Start)
multiplication = Multiplication(A=subtraction, B=Slider(0.01, range=0..0.01))
addition = Addition(A=dedomain.Start, B=multiplication)
smaller = SmallerThan(FirstNumber=pdecon.ZComponent, SecondNumber=addition)  # -> SmallerThan, OrEqualTo
dispatch = Dispatch(List=pt_2, DispatchPattern=smaller.SmallerThan)  # -> Supports, ListB
supports = ClusterOutput(dispatch.Supports)
not = ClusterOutput(dispatch.ListB)
