# Grasshopper definition mobius (with cluster visualisation).gh (Grasshopper 0.9.76)
# plug-ins: Biomorpher, MeshEdit Components, LunchBox, Weaverbird

# Simple mobius band that is discretised into hexgaonal cells.
# Requires Weaverbird and Lunchbox plug-ins to run.
number_slider = Slider(5, range=0..5)
number_slider_2 = Slider(5, range=2..10)
number_slider_3 = Slider(92, range=29..100)
mobius = MobiusSurface(
    UDivisions=100,
    VDivisions=100,
    RParameter=4,
    TParameter=number_slider,
    Scale=5,
    Domain1=Domain(-3.141592654, 3.141592654),
    Domain2=Domain(-1, 1))
hex = HexagonCells(Surface=mobius, UDivisions=number_slider_3, VDivisions=number_slider_2, TParameter=0.25)  # -> HexagonCells, Centers
number_slider_4 = Slider(0.63, range=0..1)
number_slider_5 = Slider(0.4279, range=0..1)
number_slider_6 = Slider(0.3424, range=0..1)
wbframe = WeaverbirdsPictureFrame(MeshPolylines=hex.HexagonCells, Distance=5, InsetType=0)
wbthicken = WeaverbirdsMeshThicken(MeshCurves=wbframe, Distance=Slider(2.9, range=0..10), OffsetType=0)
frgb = ColourRGBF(Alpha=1, Red=number_slider_4, Green=number_slider_6, Blue=number_slider_5)
mcol = MeshColours(Mesh=wbthicken, Colours=frgb)
demesh = DeconstructMesh(Mesh=mcol)  # -> Vertices, Faces, Colours, Normals
lng = ListLength(List=demesh.Vertices)
# (Performance 'parameter names'
# will be picked up automatically)
lng_2 = ListLength(List=demesh.Faces)
area = MeshArea(Mesh=mcol)  # -> Area, Centroid
biomorpher = Biomorpher(
    Genome=[number_slider_2, number_slider_3, number_slider, number_slider_4, number_slider_6, number_slider_5],
    Geometry=mcol,
    Performance=[lng, lng_2, area.Area])

# ---- group: Normalised 5D cluster data
panel = Panel(biomorpher)

# ---- group: We can only show 3 of the 5 dimensions, due to our brains
item = ListItem(List=biomorpher, Index=0, Wrap=True)  # -> Item, Item1, Item2

# ----
pt = ConstructPoint(XCoordinate=item.Item, YCoordinate=item.Item1, ZCoordinate=item.Item2)
cluster = Slider(0, range=0..12)
pshift = ShiftPaths(Data=pt, Offset=-1)
branch = TreeBranch(Tree=pshift, Path=cluster, MaintainPaths=True)
tstat = TreeStatistics(Tree=pshift)  # -> Paths, Length, Count
range = Range(Domain=Domain(0, 1), Steps=expr("X-1", tstat.Count))
scale = Scale(Geometry=pshift, Center=Point(0, 0, 0), Factor=Slider(74, range=0..100))  # -> Geometry, Transform
gradient = Gradient(
    LowerLimit=0,
    UpperLimit=1,
    Parameter=range,
    stops=[0: RGB(243, 57, 0), 0.1: RGB(236, 27, 60), 0.2: RGB(210, 0, 118), 0.3: RGB(103, 0, 120), 0.4: RGB(39, 72, 161), 0.5: RGB(1, 192, 229), 0.6: RGB(18, 178, 90), 0.7: RGB(79, 186, 8), 0.8: RGB(220, 237, 32), 0.9: RGB(247, 159, 20), 1: RGB(243, 57, 0)])
col = Colour(graft(gradient))
dots = DotDisplay(Point=scale.Geometry, Colour=col, Size=Slider(1.29, range=0..10))
