# Grasshopper definition mobius.gh (Grasshopper 0.9.76)
# plug-ins: Biomorpher, MeshEdit Components, LunchBox, Weaverbird

# Simple mobius band that is discretised into hexgaonal cells.
# Requires Weaverbird and Lunchbox plug-ins to run.
number_slider = Slider(2, range=0..5)
number_slider_2 = Slider(7, range=2..10)
number_slider_3 = Slider(72, range=29..100)
mobius = MobiusSurface(
    UDivisions=100,
    VDivisions=100,
    RParameter=4,
    TParameter=number_slider,
    Scale=5,
    Domain1=Domain(-3.141592654, 3.141592654),
    Domain2=Domain(-1, 1))
hex = HexagonCells(Surface=mobius, UDivisions=number_slider_3, VDivisions=number_slider_2, TParameter=0.25)  # -> HexagonCells, Centers
number_slider_4 = Slider(0.735, range=0..1)
number_slider_5 = Slider(0.6754, range=0..1)
number_slider_6 = Slider(0.8347, range=0..1)
number_slider_7 = Slider(1, range=0..10)
wbframe = WeaverbirdsPictureFrame(MeshPolylines=hex.HexagonCells, Distance=5, InsetType=0)
wbthicken = WeaverbirdsMeshThicken(MeshCurves=wbframe, Distance=number_slider_7, OffsetType=0)
frgb = ColourRGBF(Alpha=1, Red=number_slider_4, Green=number_slider_6, Blue=number_slider_5)
mcol = MeshColours(Mesh=wbthicken, Colours=frgb)
demesh = DeconstructMesh(Mesh=mcol)  # -> Vertices, Faces, Colours, Normals
lng = ListLength(List=demesh.Vertices)
# (Performance 'parameter names'
# will be picked up automatically)
lng_2 = ListLength(List=demesh.Faces)
area = MeshArea(Mesh=mcol)  # -> Area, Centroid
num = Number(Tree({0}: [0.8538517807, 0.273010459, 0.3091504641, 0.7139534408, 0.9048138565, 0.2854109894, 0.5485110037], {1}: [0.8546431088, 0.273292196, 0.3092412413, 0.7144105486, 0.9039897556, 0.2854165597, 0.5488126218], {2}: [0.8535262197, 0.07222955704, 0.3091857636, 0.7147030172, 0.9037242769, 0.7360483939, 0.5488577355], {3}: [0.8539764032, 0.2732531271, 0.3093658153, 0.7138212558, 0.9039636952, 0.2851219192, 0.5480674706], {4}: [0.8541639812, 0.2728781258, 0.309432595, 0.713987802, 0.9042614727, 0.2853436517, 0.5483562606], {5}: [0.8543435833, 0.07161274639, 0.3096384995, 0.7142902076, 0.9039303053, 0.7362021409, 0.548328834]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))
num_2 = Number(Tree({0}: [0.851358503, 0.3859486679, 0.4381381164, 0.7019964558, 0.5170921313, 0.9979377771, 0.2222161778], {1}: [0.6189563352, 0.0977930604, 0.6202507087, 0.1272111261, 0.3078495293, 0.2771668543, 0.6716241476], {2}: [0.4256226129, 0.64041349, 0.8689613779, 0.358589247, 0.3013822498, 0.1218833621, 0.9016285273], {3}: [0.8605560026, 0.8143670786, 0.9665074809, 0.2986708443, 0.7568800946, 0.2631979614, 0.7185321016], {4}: [0.6909934099, 0.6331694944, 0.1614850164, 0.6995232905, 0.2112381371, 0.9410306108, 0.6205411812], {5}: [0.4201376026, 0.6808643209, 0.5372184373, 0.2762371936, 0.2897907124, 0.01242135373, 0.873947571]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))
item = ListItem(List=num_2, Index=0, Wrap=True)
panel = Panel(num)
biomorpher = Biomorpher(
    Genome=[number_slider_5, number_slider_6, number_slider_4, number_slider_7, number_slider, number_slider_2, number_slider_3],
    Geometry=mcol,
    Performance=[area.Area, lng, lng_2])  # -> Population, Historic, Clusters, Data
panel_2 = Panel("""56
34""")
data = Data("Grasshopper.Kernel.Types.GH_ObjectWrapper")
series = Series(Start=0, Step=1, Count=10)
path = ConstructPath(Indices=panel_2)
data_2 = Data(null)
biomorpherreader = BiomorpherReader(Data=data_2, DesignID=Slider(100, range=0..100))
