# Grasshopper definition DendroExample.gh (Grasshopper 1.0.7)
# plug-ins: Biomorpher, DendroGH

number_slider = Slider(6, range=3..12)
pi = Pi(Factor=number_slider)
crv = Curve([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])
range = Range(Domain=pi, Steps=expr("x*2", number_slider))
number_slider_2 = Slider(8.59, range=1..10)
neg = Negative(Value=range)
pframes = PerpFrames(Curve=crv, Count=expr("x*2", number_slider), Align=True)  # -> Frames, Parameters
entwine = Entwine(Branch00=range, Branch01=neg, FlattenInputs=True)
prot = RotatePlane(Plane=pframes.Frames, Angle=entwine)  # -> simplify(Plane)
pt = PointOriented(BasePlane=prot, UComponent=number_slider_2, VComponent=0, WComponent=0)
genes = GenePool(Decimals=2, Maximum=2, Minimum=0, Value=[1.447208158, 1.961840617, 1.679515526])
number_slider_3 = Slider(7.8, range=0..20)
shift = ShiftList(List=pt, Shift=Slider(9, range=0..10), Wrap=Toggle(True))
crv_2 = Curve(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)
crv_3 = Curve(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)
crv_4 = Curve(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)
intcrv = Interpolate(Vertices=shift, Degree=3, Periodic=False, KnotStyle=1)  # -> Curve, Length, Domain
vsettings = CreateSettings(VoxelSize=1, Bandwidth=1, Isovalue=0, Adaptivity=0.1)
genes_2 = GenePool(
    Decimals=3,
    Maximum=10,
    Minimum=0,
    Value=[9.59383831, 0.8871704984, 2.948993354, 7.820496278, 0.5899463963, 9.383859948, 1.949692365])
vcurve = CurveToVolume(Curves=flatten([crv_4, crv_3, crv_2, crv, intcrv.Curve]), CurveRadius=genes_2, Settings=vsettings)
mvolume = VolumeToMesh(Volume=vcurve, VolumeSettings=vsettings)
biomorpher = Biomorpher(Genome=[genes_2, number_slider_2], MeshEs=mvolume)
