# Grasshopper definition Fields.gh (Grasshopper 0.9.76)
# plug-ins: Biomorpher, Mesh Pipe

number_slider = Slider(17.3, range=0..20)
number_slider_2 = Slider(6.9, range=0..20)
number_slider_3 = Slider(19.4, range=0..20)
number_slider_4 = Slider(3, range=0..20)
number_slider_5 = Slider(15.2, range=0..20)
number_slider_6 = Slider(8.5, range=0..20)
pt = ConstructPoint(XCoordinate=number_slider_2, YCoordinate=number_slider, ZCoordinate=0)
pt_2 = ConstructPoint(XCoordinate=number_slider_5, YCoordinate=number_slider_3, ZCoordinate=0)
pt_3 = ConstructPoint(XCoordinate=number_slider_6, YCoordinate=number_slider_4, ZCoordinate=0)
ln = Line(StartPoint=pt_3, EndPoint=pt)
point = Point(Point(9.382775003, 11.6396961, 0))
curve = Curve(ln)
point_charge = PointCharge(Point=pt_2, Charge=Slider(0.4, range=0..10), Decay=2)
line_charge = LineCharge(Line=curve, Charge=Slider(0.5, range=0..10))
merge_fields = MergeFields(Fields=[point_charge, line_charge])
rectangle = Rectangle(Plane=PlaneXY(0, 0, 0), XSize=Domain(0, 20), YSize=Domain(0, 20), Radius=0)  # -> Rectangle, Length
populate_2d = Populate2D(Region=rectangle.Rectangle, Count=Slider(433, range=0..1000), Seed=1)
scalar_display = ScalarDisplay(Field=merge_fields, Section=rectangle.Rectangle, Samples=1000)
tensor_display = TensorDisplay(Field=merge_fields, Section=rectangle.Rectangle, Samples=1000)
field_line = FieldLine(Field=merge_fields, Point=populate_2d, Steps=Slider(141, range=0..1000), Accuracy=0.1, Method=3)
custom_preview = CustomPreview(Geometry=field_line, Shader=ColourSwatch(SwatchColor=RGB(255, 255, 255)))
mpipe = MeshPipe(Curve=field_line, Radius=Slider(0.1, range=0..0.1), Accuracy=Slider(0.2, range=0..1), Rotation=0, Segments=3, Caps=0)

# ---- group: Don't forget to join meshes for speed
mjoin = MeshJoin(Meshes=mpipe)

# ----
biomorpher = Biomorpher(
    Genome=[number_slider_2, number_slider, number_slider_6, number_slider_4, number_slider_5, number_slider_3],
    Geometry=mjoin)  # -> GenoGuids, Population, Historic, Clusters
