# Grasshopper definition Ishigami.gh (Grasshopper 0.9.76)
# plug-ins: Biomorpher, Human

genes = GenePool(
    Decimals=0,
    Maximum=50,
    Minimum=0,
    Value=[16.49068288, 44, 20.71689288, 25.89507887, 24.16497171, 13.29590841, 19.17093899, 35, 23.93962789, 40.61946941, 9, 24.48631648, 42.58015055, 32, 37, 26, 0.4888895963, 17, 8, 48])
genes_2 = GenePool(
    Decimals=0,
    Maximum=50,
    Minimum=0,
    Value=[23, 42, 36, 29.71723561, 50, 5.554475285, 15.25608272, 46.25750802, 42.44886396, 6.826976381, 10.44039916, 11.19348037, 15.76356931, 22.21947098, 18.1607835, 17.10396907, 43.86893818, 48.20393958, 43.89784856, 8.823759982])
genes_3 = GenePool(Decimals=0, Maximum=25, Minimum=0, Value=[8.846885558, 4.323955677, 4.196438453, 7])
genes_4 = GenePool(Decimals=0, Maximum=50, Minimum=0, Value=[39, 45.23034742, 25.50235692, 16.7433727])
genes_5 = GenePool(Decimals=0, Maximum=50, Minimum=0, Value=[36, 19, 49, 0])
genes_6 = GenePool(Decimals=0, Maximum=30, Minimum=0, Value=[3.955650065, 0.1560230479, 16.71268151, 24])
genes_7 = GenePool(
    Decimals=0,
    Maximum=50,
    Minimum=0,
    Value=[40.19110081, 45.55270025, 24.19727974, 37.98622984, 10, 40.49077773, 9.266164755, 16.04960118, 17.98192669, 34.83615402])
genes_8 = GenePool(
    Decimals=0,
    Maximum=50,
    Minimum=0,
    Value=[0, 0, 0, 8, 0, 25.24422637, 14.77356539, 5.683279397, 19.36966198, 7.715814635])
genes_9 = GenePool(
    Decimals=0,
    Maximum=50,
    Minimum=0,
    Value=[14.09130882, 45, 27, 7.326365143, 22.41577594, 13.3880114, 41.90248364, 8.715942313, 42.51194832, 5.481234254])
genes_10 = GenePool(
    Decimals=0,
    Maximum=50,
    Minimum=0,
    Value=[45.25164533, 29.64568507, 3.543189326, 5.487528625, 29.31850595, 1.067788499, 24.27895417, 4.121338887, 34.17787231, 8.976065728])
genes_11 = GenePool(
    Decimals=0,
    Maximum=50,
    Minimum=0,
    Value=[48.96013093, 47.73940916, 17.49371195, 47.17212568, 32.03644491, 31.94035377, 15.92742432, 37.14117763, 13.39952968, 7.805714877])
genes_12 = GenePool(
    Decimals=0,
    Maximum=50,
    Minimum=0,
    Value=[25, 42.25008745, 8.785674422, 24.97743207, 32, 39.61199704, 12.52732001, 29.74220812, 42.31497821, 30.00737607])
genes_13 = GenePool(
    Decimals=0,
    Maximum=20,
    Minimum=5,
    Value=[14.56496701, 13, 17, 14, 6.258279354, 9.399788389, 11.59138237, 8.218188874, 7.545829618, 12.69570336])
genes_14 = GenePool(
    Decimals=0,
    Maximum=50,
    Minimum=0,
    Value=[18.54217594, 23.75490522, 24.20434878, 8, 44.3481953, 48.50535304, 12.18327484, 43.50430323, 41.52905719, 44.22805898])
genes_15 = GenePool(
    Decimals=0,
    Maximum=50,
    Minimum=0,
    Value=[21.7223903, 21.82406241, 39.51147866, 23.37777598, 38, 21.57131958, 44.4151883, 31.51687699, 19.08766943, 48.0968359])
genes_16 = GenePool(
    Decimals=0,
    Maximum=10,
    Minimum=5,
    Value=[6.569792522, 7, 8, 9.464214142, 9.709393193, 9.904801204, 6.11942042, 6.376090283, 8.55358284, 8.847789338])
pt = ConstructPoint(XCoordinate=genes_7, YCoordinate=genes_8, ZCoordinate=0)
pt_2 = ConstructPoint(XCoordinate=genes_11, YCoordinate=genes_12, ZCoordinate=0)
X = UnitX(Factor=1)
pt_3 = ConstructPoint(XCoordinate=genes_4, YCoordinate=genes_5, ZCoordinate=0)
Y = UnitY(Factor=1)
pt_4 = ConstructPoint(XCoordinate=genes_14, YCoordinate=genes_15, ZCoordinate=0)
pt_5 = ConstructPoint(XCoordinate=genes_9, YCoordinate=genes_10, ZCoordinate=0)
rectangle = Rectangle(Plane=pt, XSize=Domain(-1, 1), YSize=Domain(-2, 2), Radius=0)  # -> Rectangle, Length
neg = Negative(Value=genes_3)
rectangle_2 = Rectangle(Plane=pt_5, XSize=Domain(-4, 4), YSize=Domain(-1, 1), Radius=0)  # -> Rectangle, Length
line = LineSDL(Start=pt_2, Direction=X, Length=genes_13)
neg_2 = Negative(Value=genes_6)
line_2 = LineSDL(Start=pt_4, Direction=Y, Length=genes_16)
dom = ConstructDomain(DomainStart=neg, DomainEnd=genes_3)
dom_2 = ConstructDomain(DomainStart=genes_6, DomainEnd=neg_2)
previewlw = CustomPreviewLineweights(Geometry=line_2, Shader=ColourSwatch(SwatchColor=RGB(0, 0, 0)), Thickness=Slider(1, range=0..10), Absolute=False)
rectangle_3 = Rectangle(Plane=pt_3, XSize=dom, YSize=dom_2, Radius=0)  # -> Rectangle, Length
previewlw_2 = CustomPreviewLineweights(Geometry=line, Shader=ColourSwatch(SwatchColor=RGB(0, 0, 0)), Thickness=Slider(2, range=0..10), Absolute=False)
srf = Surface(rectangle_3.Rectangle)  # disabled
number_slider = Slider(-1, range=-1..0)  # disabled
smesh = SimpleMesh(Brep=rectangle_3.Rectangle)  # disabled
previewlw_3 = CustomPreviewLineweights(
    Geometry=rectangle.Rectangle,
    Shader=ColourSwatch(SwatchColor=RGB(102, 102, 102)),
    Thickness=Slider(1, range=0..10),
    Absolute=False)
pt_6 = ConstructPoint(XCoordinate=genes, YCoordinate=genes_2, ZCoordinate=0)
previewlw_4 = CustomPreviewLineweights(
    Geometry=rectangle_2.Rectangle,
    Shader=ColourSwatch(SwatchColor=RGB(0, 0, 0)),
    Thickness=Slider(1, range=0..10),
    Absolute=False)
Z = UnitZ(Factor=number_slider)  # disabled
surfacemap = SurfaceMapping(Mesh=smesh, Surface=srf)  # disabled
lng = ListLength(List=pt_6)
random = Random(Range=Domain(3, 5), Number=lng, Seed=2)
random_2 = Random(Range=Domain(3, 5), Number=lng, Seed=2)
neg_3 = Negative(Value=random)
neg_4 = Negative(Value=random_2)
dom_3 = ConstructDomain(DomainStart=neg_3, DomainEnd=random)
dom_4 = ConstructDomain(DomainStart=neg_4, DomainEnd=random_2)
panel = Panel("C:\Users\je3-harding\Documents\Materials\maple_plywood.jpg")  # disabled
move = Move(Geometry=surfacemap, Motion=Z)  # -> Geometry, Transform; disabled
planesrf = PlaneSurface(Plane=pt_6, XSize=dom_3, YSize=dom_4)
previewlw_5 = CustomPreviewLineweights(
    Geometry=rectangle_3.Rectangle,
    Shader=ColourSwatch(SwatchColor=RGB(0, 0, 0)),
    Thickness=Slider(1, range=0..1),
    Absolute=False)
previewmat = CustomPreviewMaterials(
    Geometry=planesrf,
    DiffuseColor=RGB(255, 255, 255),
    DiffuseBitmap="C:\Users\je3-harding\Pictures\tree2.png",
    TransparencyBitmap="C:\Users\je3-harding\Pictures\tree2-alpha.png")
previewmat_2 = CustomPreviewMaterials(Geometry=move.Geometry, DiffuseColor=RGB(255, 255, 255))  # disabled
biomorpher = Biomorpher(
    Genome=[genes_3, genes_4, genes_5, genes_6, genes_7, genes_8, genes_9, genes_10, genes_11, genes_12, genes_13, genes_14, genes_15, genes_16, genes, genes_2],
    Geometry=line)  # -> GenoGuids, Population, Historic, Clusters
data = Data(Tree({0}: [0.1353462305, 0.07566216085, 0.7171447789, 0.6697462581, 0.6683528902, 0.387461118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], {1}: [0.1354561159, 0.07591524722, 0.7170160908, 0.6699723154, 0.6685221487, 0.3870047323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], {2}: [0.1361498786, 0.07518948955, 0.7176984773, 0.6695215279, 0.6676761095, 0.3876093892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], {3}: [0.1354725939, 0.0757724507, 0.7176703774, 0.6692911533, 0.6683026528, 0.3875001009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], {4}: [0.1355223608, 0.07538544378, 0.7178680857, 0.6697938925, 0.6675259321, 0.3870326263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], {5}: [0.136140569, 0.07537398349, 0.7176082283, 0.6694495353, 0.6679083654, 0.3878364758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], {6}: [0.1362474441, 0.07579513368, 0.7171531812, 0.6696335611, 0.6676540658, 0.3876857463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], {7}: [0.1356425683, 0.07521402888, 0.7170805546, 0.669536002, 0.6680851161, 0.3871586425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], {8}: [0.1357137306, 0.07571102416, 0.7175380727, 0.6700822212, 0.6678921504, 0.3870673246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], {9}: [0.1357375246, 0.07596594992, 0.7169500604, 0.6694625294, 0.6676289027, 0.3870288947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], {10}: [0.1360023664, 0.07529360646, 0.7176226223, 0.6693996847, 0.6682378371, 0.3872443725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], {11}: [0.1357010866, 0.07548849653, 0.7173494757, 0.6698226924, 0.6678391831, 0.3874319951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]))
txt = Text(["7c8f9950-6664-478d-92be-bdd31d5cd12e", "fe84d401-607e-4fd0-8f1f-84d6f8fab3fd", "295152db-c3f7-4f5e-a3df-8ee34a525d66", "2e647f66-6e34-4034-a768-49bea0522510", "4a04ebe0-6a2b-4a7d-bfbe-9a3f227ff064", "4dd114c0-5c1a-4210-8bb1-b1adb937155c", "4b424613-14f3-45f8-84b9-53f0dff78855", "c84d2aa5-f612-429d-9b4b-36c076b9e444", "7583b9e7-3823-408b-a981-129ec166cbce", "4e53cc4d-0d2e-4d9f-901e-b4326d3af3e1", "add68c31-190b-4826-8d04-1c2fd08bbe6c", "98684fc9-5f39-4df7-8709-2afeabc9d994", "7b2bbafa-6dbc-449e-aa59-1dd6fbc5091d", "d442a397-5913-4f14-99f7-03213c32ddb2", "8478789a-e79a-4f89-8c18-3ee660f15f44", "73f81965-c801-4060-a833-fab568075b61"])
biomorpherreader = BiomorpherReader(GenoGuids=txt, Population=data, DesignID=Slider(3, range=0..10))
