# Grasshopper definition Simple Test Biomorpher+.gh (Grasshopper 1.0.7)
# plug-ins: Biomorpher

number_slider = Slider(16, range=0..100)
number_slider_2 = Slider(7, range=0..10)
number_slider_3 = Slider(2, range=0..10)
random = Random(Range=Domain(0, 1), Number=1, Seed=number_slider)
msphereex = MeshSphereEx(Base=PlaneXY(0, 0, 0), Radius=number_slider, Count=5)
button = Button()
number_slider_4 = Slider(12, range=0..100)
panel = Panel("""3
6
9
11""")
random_2 = Random(Range=Domain(0, 1), Number=1, Seed=2)
pt = ConstructPoint(XCoordinate=0, YCoordinate=0, ZCoordinate=0)
biomorpher = Biomorpher(
    Genome=number_slider,
    Geometry=msphereex,
    Performs=random,
    ClusterSelect=panel,
    ClusterShow=Slider(4, range=0..10),
    NewEpoch=Slider(78, range=0..100))
