# Grasshopper definition The simplest optimisation you could ever wish to see.gh (Grasshopper 1.0.7)
# plug-ins: Biomorpher

number_slider = Slider(10, range=0..10)
msphere = MeshSphere(Base=PlaneXY(0, 0, 0), Radius=number_slider, UCount=10, VCount=20)
num = Number(number_slider)
biomorpher = Biomorpher(Genome=number_slider, Meshes=msphere, Perform=num)
