# Grasshopper definition spiderweb_nearestNeighbbours.gh (Grasshopper 0.9.76)
# plug-ins: Biomorpher, SpiderWeb :: Graph Tools, Mesh Pipe

genes = GenePool(
    Decimals=2,
    Maximum=10,
    Minimum=0,
    Value=[8.181696696, 0.9983916678, 4.97582122, 9.108250248, 2.858341375, 1.148753446, 9.442207254, 8.052902305, 5.470856091, 2.352323487])
genes_2 = GenePool(
    Decimals=2,
    Maximum=10,
    Minimum=0,
    Value=[7.236699242, 6.443475916, 2.232264537, 8.935703169, 2.499893323, 3.779302306, 2.970339997, 8.326741009, 1.94443083, 5.054155744])
number_slider = Slider(5.6, range=0..10)
number_slider_2 = Slider(2.5, range=0..10)
pt = ConstructPoint(XCoordinate=number_slider_2, YCoordinate=number_slider, ZCoordinate=0)
pt_2 = ConstructPoint(XCoordinate=genes, YCoordinate=genes_2, ZCoordinate=0)
cir = Circle(Plane=pt, Radius=0.5)
gs = GraphStyle(Color=RGB(255, 20, 147), TxtSize=1, Update=True)
gfp = GraphFromPoints(GraphPoints=pt_2, ConnectingDistance=Slider(3.85, range=0..10))
dg = DisplayGraph(Graph=gfp, GraphPoints=pt_2, GraphStyle=gs, hidden=True)  # -> VertexCount, EdgeCount, Edge
line = Line(dg.Edge)
len = Length(Curve=line)
mpipe = MeshPipe(Curve=[line, cir], Radius=Slider(0.09, range=0..1), Accuracy=0.2, Rotation=0, Segments=10, Caps=2)
ma = MassAddition(Input=len)  # -> TotalLength, PartialResults
mcol = MeshColours(Mesh=mpipe, Colours="magenta")
biomorpher = Biomorpher(
    Genome=[number_slider, number_slider_2, genes, genes_2],
    Geometry=mcol,
    Performance=[ma.TotalLength, dg.VertexCount, dg.EdgeCount])  # -> Clusters, History
