# Grasshopper definition 02 Untangle (Reader).gh (Grasshopper 1.0.7)
# plug-ins: Biomorpher

# Controlled gene pool
genes = GenePool(
    Decimals=2,
    Maximum=100,
    Minimum=-100,
    Value=[-32.40405104, 88.17513175, -0.906459196, -79.34074801, 37.65203605, -57.53526499, -52.12420232, -54.59007507, -93.38340712, -35.01609263])
genes_2 = GenePool(
    Decimals=2,
    Maximum=100,
    Minimum=-100,
    Value=[-57.58667102, 44.81799693, -33.1078381, 72.14880724, 41.72499894, 78.99550254, -42.75931592, -96.31828852, -35.86135522, 7.298751225])
genes_3 = GenePool(
    Decimals=2,
    Maximum=100,
    Minimum=0,
    Value=[40.94290433, 21.42045345, 60.0254827, 50.14206676, 90.40698986, 0.9751389739, 20.62436893, 54.49475514, 75.8699919, 74.51363163])
# The reader component can show designs from a historic evolutionary process using Biomorpher.
# In this example the length of the curve was minimised. Try moving the generation and design sliders.
number_slider = Slider(0, range=0..72)

# ---- group: Historic biomorpher solution (internalised)
biomorphersolution = BiomorpherSolution({popCount=64, Count=4672, Count=30, Path="{0;0;0}", number=0.3379797448, number=0.9408756587, number=0.495467704, number=0.1032962599, number=0.6882601803, number=0.212323675, number=0.2393789884, number=0.2270496247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})

# ----
biomorpherreader = BiomorpherReader(Solution=biomorphersolution, Branch="0", Generation=number_slider, Design=Slider(0, range=0..63))
pt = ConstructPoint(XCoordinate=genes, YCoordinate=genes_2, ZCoordinate=genes_3)
intcrv = Interpolate(Vertices=pt, Degree=3, Periodic=True, KnotStyle=1)  # -> Curve, Length, Domain
divide = DivideCurve(Curve=intcrv.Curve, Count=Slider(100, range=0..100), Kinks=False)  # -> Points, Tangents, Parameters
curvature = Curvature(Curve=intcrv.Curve, Parameter=divide.Parameters)  # -> P, K, C
vdisex = VectorDisplayEx(Point=curvature.P, Vector=expr("x*100", curvature.K), Colour=RGB(0, 0, 0), Width=2)

# ---- group: Variance of curvature
vlen = VectorLength(Vector=curvature.K)
cluster = Cluster(num=vlen)

# ----
multiplication = Multiplication(A=cluster, B=Slider(1000, range=0..1000))

# ==== cluster Cluster
num = ClusterInput()
num_2 = Number(num)
avr = Average(Input=num_2)
subtraction = Subtraction(A=avr, B=num_2)
lng = ListLength(List=num_2)
sqr = Square(Value=subtraction)
ma = MassAddition(Input=sqr)  # -> Result, PartialResults
division = Division(A=ma.Result, B=lng)
R = ClusterOutput(division)
