# Grasshopper definition 04 Biomorphs.gh (Grasshopper 1.0.7)
# plug-ins: Biomorpher

# Simple Biomorphs implementation based on:
# https://www.codeproject.com/Articles/17387/AI-Dawkins-Biomorphs-And-Other-Evolving-Creatures.
# Note: Licence for this definition: (CPOL) 1.02
genes = GenePool(
    Decimals=2,
    Maximum=5,
    Minimum=-5,
    Value=[4.327705693, -1.288941436, -3.237002528, -0.6932746226, 0.8717540865, -2.02221691, -2.420021532, 0.5232956612, -4.655082398, 0.5660324151])
c_script = CSharpScript(gene=genes)  # -> A; inputs gene: list of Double
# ---------- c_script: C# ----------
    // Original code by Sacha Barber
    // https://www.codeproject.com/Articles/17387/AI-Dawkins-Biomorphs-And-Other-Evolving-Creatures
    double order = gene[9];

    double[] dx = new double[8];
    double[] dy = new double[8];

    dx[3] = gene[1];
    dx[4] = gene[2];
    dx[5] = gene[3];
    dx[1] = -dx[3];
    dx[0] = -dx[4];
    dx[2] = 0;
    dx[6] = 0;
    dx[7] = -dx[5];
    dy[2] = gene[4];
    dy[3] = gene[5];
    dy[4] = gene[6];
    dy[5] = gene[7];
    dy[6] = gene[8];
    dy[0] = dy[4];
    dy[1] = dy[3];
    dy[7] = dy[5];

    List<Line> myLines = new List<Line>();

    tree(0, 0, order, 2, dx, dy, myLines);

    A = myLines;
# ---------- c_script: C# additional code ----------
  /// <summary>
  /// Draws the Dawkins bio-morph structure (No segmentation, in this
  /// implementation)
  /// </summary>
  /// <param name="g">The graphics to use</param>
  /// <param name="i">The x position to start drawing</param>
  /// <param name="j">The x position to stop drawing</param>
  /// <param name="k">The y position to start drawing</param>
  /// <param name="l">The y position to stop drawing</param>
  void tree(double i, double j, double k, double l, double[] dx, double[] dy, List<Line> myLines)
  {
    try
    {
      if (l < 0)
        l += 8;
      if (l >= 8)
        l -= 8;
      double i1 = i + k * -dx[(int) l];
      double j1 = j - k * -dy[(int) l];

      //g.DrawLine(new Pen(new SolidBrush(Color.White), 1.8F), i, j, i1, j1);

      myLines.Add(new Line(i, j, 0, i1, j1, 0));

      if (k > 0)
      {
        tree(i1, j1, k - 1, l - 1, dx, dy, myLines);
        tree(i1, j1, k - 1, l + 1, dx, dy, myLines);
      }
    }
    catch (Exception)
    {
    }
  }
# ---------- end c_script ----------
biomorpher = Biomorpher(Genome=genes, Geometry=c_script)
