# Grasshopper definition 06 Quadtree Extrusions.gh (Grasshopper 1.0.7)
# plug-ins: MeshEdit Components, Biomorpher

genes = GenePool(
    Decimals=2,
    Maximum=100,
    Minimum=0,
    Value=[50.48015689, 28.82183319, 41.976034, 32.83490425, 40.8322637, 0.01062853816, 49.06330485, 44.49158148, 85.16037712, 92.56604917, 79.26159413, 48.87399507, 47.51563733, 75.54214949, 16.8549353, 5.134418515, 33.01468472, 3.344191459, 45.42716232, 5.05442135])
genes_2 = GenePool(
    Decimals=2,
    Maximum=50,
    Minimum=0,
    Value=[24.86477662, 39.93577972, 15.6920947, 49.56182863, 23.89578594, 10.14303864, 20.48270148, 35.57841923, 44.92181569, 20.71694918, 34.29692759, 24.84053437, 12.16745682, 46.15391214, 28.26110526, 24.89254696, 24.16446754, 49.99141095, 34.87784169, 29.81679169])
# Modelling
genes_3 = GenePool(
    Decimals=2,
    Maximum=100,
    Minimum=0,
    Value=[1.656749877, 60.69044817, 32.70791263, 10.64616954, 27.64113131, 37.31245715, 36.94613402, 45.55931118, 52.41911124, 97.41710914, 46.3791462, 40.33670256, 7.809447177, 61.56635347, 71.49444019, 60.95493891, 15.68064984, 1.400897519, 71.30384615, 56.46949346])
pt = ConstructPoint(XCoordinate=genes_3, YCoordinate=genes, ZCoordinate=0)
qt = QuadTree(Points=pt, Plane=PlaneXY(0, 0, 0), Square=False, Group=Slider(1, range=0..10))  # -> Quads, Points
runion = RegionUnion(Curves=qt.Quads)
fillet = Fillet(Curve=runion, Radius=Slider(2, range=0..10))
lng = ListLength(List=fillet)
split = SplitList(List=genes_2, Index=lng)  # -> ListA, ListB
Z = UnitZ(Factor=split.ListA)
extr = Extrude(Base=fillet, Direction=Z)
cap = CapHoles(Brep=extr)
smooth = SettingsQuality()
mesh = MeshBrep(Brep=cap, Settings=smooth)
lng_2 = ListLength(List=mesh)
random = Random(Range=Domain(0, 1), Number=lng_2, Seed=2)
random_2 = Random(Range=Domain(0, 1), Number=lng_2, Seed=3)
random_3 = Random(Range=Domain(0, 1), Number=lng_2, Seed=4)
frgb = ColourRGBF(Alpha=1, Red=random, Green=random_2, Blue=random_3)
mcol = MeshColours(Mesh=graft(mesh), Colours=graft(frgb))
preview = CustomPreview(Geometry=cap, Shader=frgb)
# Analysis
demesh = DeconstructMesh(Mesh=mcol)  # -> flatten(Vertices), Faces, Colours, Normals
volume = Volume(Geometry=mcol)  # -> flatten(Volume), Centroid
area = MeshArea(Mesh=mcol)  # -> flatten(Area), Centroid
pdecon = Deconstruct(Point=demesh.Vertices)  # -> XComponent, YComponent, ZComponent
ma = MassAddition(Input=volume.Volume)  # -> Result, PartialResults
floor_to_floor_height = Slider(3, range=0..10)
ma_2 = MassAddition(Input=area.Area)  # -> Result, PartialResults
sort = SortList(Keys=pdecon.ZComponent)  # -> reverse(Keys), ValuesA
item = ListItem(List=sort.Keys, Index=0, Wrap=True)
division = Division(A=ma_2.Result, B=ma.Result)
division_2 = Division(A=ma.Result, B=floor_to_floor_height)
peakheight_m = Number(item)
biomorpher = Biomorpher(Genome=[genes_3, genes, genes_2], Geometry=mcol, Performs=[peakheight_m, division_2, division])
