# Grasshopper definition 07 Boolean Boxes.gh (Grasshopper 1.0.7)
# plug-ins: MeshEdit Components, Biomorpher

genes = GenePool(
    Decimals=2,
    Maximum=10,
    Minimum=0,
    Value=[1.161769597, 4.828551908, 8.845561392, 1.501800051, 9.915419791, 4.852839094, 3.033986778, 6.692857155, 6.142987417, 4.850153697])
genes_2 = GenePool(
    Decimals=2,
    Maximum=10,
    Minimum=0,
    Value=[6.134860967, 6.698253508, 3.13628846, 4.508396275, 8.452001659, 6.49812632, 6.0761935, 4.327824935, 8.07296027, 3.504642946])
genes_3 = GenePool(
    Decimals=2,
    Maximum=10,
    Minimum=0,
    Value=[3.243798657, 3.67129586, 0.5439260993, 9.001929113, 8.354358666, 3.104458383, 7.632329082, 3.657296876, 5.542021744, 7.840057276])
genes_4 = GenePool(
    Decimals=2,
    Maximum=10,
    Minimum=0,
    Value=[0.04675086634, 3.557459627, 4.150828215, 5.961794032, 5.176485639, 9.118559603, 1.37846722, 8.525963733, 2.011559928, 5.78477823])
genes_5 = GenePool(
    Decimals=2,
    Maximum=10,
    Minimum=0,
    Value=[2.472970234, 4.185154836, 0.4909218832, 3.146035444, 9.846430619, 5.23203308, 2.242487159, 1.121752997, 9.648179732, 9.888670462])
genes_6 = GenePool(
    Decimals=2,
    Maximum=10,
    Minimum=0,
    Value=[5.275985599, 1.795956774, 0.8810736685, 5.869649264, 1.634786804, 7.495473737, 4.289625809, 9.84863228, 3.152441385, 6.805961408])
dom = ConstructDomain(DomainStart=genes, DomainEnd=genes_2)
dom_2 = ConstructDomain(DomainStart=genes_3, DomainEnd=genes_4)
dom_3 = ConstructDomain(DomainStart=genes_5, DomainEnd=genes_6)
box = DomainBox(Base=PlaneXY(0, 0, 0), X=dom, Y=dom_2, Z=dom_3)
bbox = BoundingBox(Content=box, Plane=PlaneXY(0, 0, 0), UnionBox=True)  # -> Box, Box_2
volume = Volume(Geometry=bbox.Box)  # -> Volume, Centroid
scale = Scale(Geometry=bbox.Box, Center=volume.Centroid, Factor="0.9")  # -> Geometry, Transform
number_slider = Slider(228, range=0..254)
number_slider_2 = Slider(238, range=0..254)
number_slider_3 = Slider(124, range=0..254)
sdiff = SolidDifference(BrepsA=scale.Geometry, BrepsB=box)
rgb = ColourRGB(Alpha=255, Red=number_slider, Green=number_slider_2, Blue=number_slider_3)
edges = BrepEdges(Brep=sdiff)  # -> Naked, Interior, NonManifold
mesh = MeshBrep(
    Brep=sdiff,
    Settings={GridMaxCount=0, GridMinCount=16, JaggedSeams=False, MaxEdgeLength=0, MinEdgeLength=0.0001, MinTolerance=0, Refine=True, RefineAngle=0, RelativeTolerance=0.65, SimplePlanes=True, Tolerance=0})
mjoin = MeshJoin(Meshes=mesh)
mcol = MeshColours(Mesh=mjoin, Colours=rgb)
# Analyse volume
volume_2 = MeshVolume(Mesh=mcol)  # -> Volume, Centroid
biomorpher = Biomorpher(
    Genome=[genes, genes_2, genes_3, genes_4, genes_5, genes_6, number_slider, number_slider_2, number_slider_3],
    Geometry=[mcol, edges.Interior],
    Performs=volume_2.Volume)
