# Grasshopper definition 10 Spaceframe (Karamba).gh (Grasshopper 1.0.7)
# plug-ins: Karamba, Biomorpher

# ---- group: Fixed points
panel = Panel("""4
-4""")
# Evolves a 3d space frame problem by minimising deflection.
# Requires Karamba FE Analysis to run
panel_2 = Panel("""1
-1""")
pt = ConstructPoint(XCoordinate=Slider(12, range=0..100), YCoordinate=panel, ZCoordinate=0)
pt_2 = ConstructPoint(XCoordinate=0, YCoordinate=0, ZCoordinate=0)
pt_3 = ConstructPoint(XCoordinate=0, YCoordinate=panel_2, ZCoordinate=Slider(4, range=0..10))

# ---- group: Variable points
genes = GenePool(Decimals=1, Maximum=8, Minimum=0, Value=[6.869533876, 6.371742742])
genes_2 = GenePool(Decimals=1, Maximum=8, Minimum=0, Value=[1.621430925, 1.037940215])
genes_3 = GenePool(Decimals=1, Maximum=8, Minimum=0, Value=[4.888254105, 2.798782911])

# ----
pt_4 = ConstructPoint(XCoordinate=genes, YCoordinate=genes_2, ZCoordinate=genes_3)
merge = Merge(Data1=pt_2, Data2=pt_3, Data3=pt, Data4=pt_4)
xz = XZPlane(Origin=Point(0, 0, 0))

# ---- group: Make frame
con = DelaunayEdges(Points=merge, Plane=xz)  # -> Connectivity, Edges
mirror = Mirror(Geometry=pt_4, Plane=xz)  # -> Geometry, Transform
mirror_2 = Mirror(Geometry=con.Edges, Plane=xz)  # -> Geometry, Transform
ln = Line(StartPoint=pt_4, EndPoint=mirror.Geometry)

# ----
pt_5 = Point([pt_2, pt_3])
Z = UnitZ(Factor="-2500")
supp = SupportKaramba(PosInd=pt_5, menu=[buttons(on, on, on, on, off, on)])
linetobeam = LineToBeamKaramba(Line=flatten([con.Edges, mirror_2.Geometry, ln]), New=True, Remove=True, LimitDistance_m=0.005)  # -> Element, Points, Info
loads = LoadsKaramba3D(ForceVector=Z, Local=False, PosInd=pt, LCase=0, mode="Point")

# ---- group: Display supports
msphereex = MeshSphereEx(Base=pt_5, Radius=0.5, Count=2)
mjoin = MeshJoin(Meshes=msphereex)
mcol = MeshColours(Mesh=graft(mjoin), Colours=graft(ColourSwatch(SwatchColor=RGB(255, 255, 255))))

# ----
assemble = AssembleModelKaramba(Points=pt, Elem=linetobeam.Element, Support=supp, Load=loads, LimitDistance_m=0.005)  # -> Model, Info, Mass_kg, CenterOfGravity
analyzethi = AnalyzeThIKaramba(Model=assemble.Model)  # -> CalculatedModel, MaximumDisplacement_m, ResultingForceOfGravity_kN, ElasticEnergy_kNm
modelview = ModelViewKaramba(Model=analyzethi.CalculatedModel, LoadCaseFactorsForLinearSuperposition=1, IndexOfVisibleLoadcase=-1)  # -> Model, DeformedMesh, DeformedAxes, DeformedModel
beamview = BeamViewKaramba(Model=modelview.Model)  # -> Model, MeshesOfRenderedBeams, DeformedBeamAxes, LegendColors, LegendTags

# ---- group: Show forces
disassemble = DisassembleModelKaramba3D(Model=modelview.DeformedModel)  # -> Model, Point, Beam, Shell, Support, Load, Line, Mesh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
panel_3 = Panel("""0
1""")
item = ListItem(List=disassemble.Point, Index=panel_3, Wrap=True)
cluster = Cluster(pt=item)

# ----
mcol_2 = MeshColours(Mesh=graft(beamview.MeshesOfRenderedBeams), Colours=graft(ColourSwatch(SwatchColor=RGB(255, 0, 0))))
biomorpher = Biomorpher(Genome=[genes, genes_2, genes_3], Geometry=[mcol, mcol_2, cluster], Performs=analyzethi.MaximumDisplacement_m)

# ==== cluster Cluster
pt = ClusterInput()
pt_2 = Point(pt)
vec = VectorXYZ(XComponent=0, YComponent="-1", ZComponent="1")  # -> Vector, Length
vec_2 = VectorXYZ(XComponent=0, YComponent="1", ZComponent="1")  # -> Vector, Length
line = LineSDL(Start=pt_2, Direction=vec.Vector, Length=1)
line_2 = LineSDL(Start=pt_2, Direction=vec_2.Vector, Length=1)
line_3 = LineSDL(Start=pt_2, Direction=Vector(0, 0, 1), Length="5")
crv = Curve([line_2, line_3, line])
crv_2 = ClusterOutput(crv)
