# Grasshopper definition 12 Vases (Pancake).gh (Grasshopper 1.0.7)
# plug-ins: Biomorpher, Pancake

genes = GenePool(
    Decimals=2,
    Maximum=2,
    Minimum=0.05,
    Value=[1.215054504, 1.800956294, 1.642036639, 1.139809992, 1.578760802, 0.3909361432])
pt = ConstructPoint(XCoordinate=0, YCoordinate=0, ZCoordinate=0)
Z = UnitZ(Factor=1)
line = LineSDL(Start=pt, Direction=Z, Length="10")
number_slider = Slider(5, range=3..20)
pframes = PerpFrames(Curve=line, Count=Slider(6, range=0..10), Align=True)  # -> Frames, Parameters
polygon = Polygon(Plane=pframes.Frames, Radius=genes, Segments=number_slider, FilletRadius=0)  # -> Polygon, Length
loft = Loft(Curves=polygon.Polygon, Options={Adjust=False, Closed=False, LoftEnds=0, LoftSimp=0, LoftType=0, Rebuild=10, Refit=0.01})
debrep = DeconstructBrep(Brep=loft)  # -> Faces, Edges, Vertices
number_slider_2 = Slider(0.3974, range=0..1)
number_slider_3 = Slider(0.0223, range=0..1)
number_slider_4 = Slider(0.5518, range=0..1)
area = Area(Geometry=loft)  # -> SurfaceArea, Centroid
variance = Variance(num=genes)
mesh_uv = MeshSurface(Surface=debrep.Faces, UCount="20", VCount="1", Overhang=True, Equalize=False)
frgb = ColourRGBF(Alpha=Slider(0.45, range=0..1), Red=number_slider_2, Green=number_slider_3, Blue=number_slider_4)
mcol = MeshColours(Mesh=mesh_uv, Colours=frgb)
medges = MeshEdges(Mesh=mcol)  # -> NakedEdges, InteriorEdges, NonManifoldEdges
join = JoinCurves(Curves=medges.NakedEdges, Preserve=False)
biomorpher = Biomorpher(
    Genome=[number_slider_4, number_slider_3, number_slider_2, genes, number_slider],
    Geometry=[mcol, join],
    Performs=[area.SurfaceArea, variance])

# ---- group: (Optional Counter method)
toggle = BooleanToggle(True)  # disabled
timer = Timer(Interval=1000, TimerInterval=1000, Target=c_script)  # disabled
c_script = CSharpScript(Reset=toggle)  # -> Count; inputs Reset: Boolean; disabled
# ---------- c_script: C# ----------
    if (Reset) myCount = 0;
    else myCount++;
    Count = myCount;
# ---------- c_script: C# additional code ----------
  int myCount;
# ---------- end c_script ----------

# ---- group: Right click and animate this slider
step_thru_all_designs = Slider(-1, range=-1..35)

# ---- group: Join and weld to keep the STL clean
mjoin = MeshJoin(Meshes=mesh_uv)
weld = WeldMesh(Mesh=mjoin, Angle=3.141592654)

# ---- group: You will have to reset this each time. Delete all previous STLs in your target folder also
button = Button()

# ----
int = Integer(expr("x+1", step_thru_all_designs))
mod = Modulus(A=step_thru_all_designs, B="12")
integer_division = IntegerDivision(A=step_thru_all_designs, B="12")

# ---- group: A set of solutions I made earlier. Replace with your own evolutionary run
biomorphersolution = BiomorpherSolution({popCount=12, Count=36, Count=10, Path="{0;0;0}", number=0.1416701321, number=0.9583755322, number=0.3827907473, number=0.4664384944, number=0.8654842632, number=0.675924755, number=0.454702202, number=0.4597752529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})

# ----
pcfileseries = FilepathSeries(
    PatternOfFilepath="C:\mySTLs\Vase{0}.stl",
    StartingIndex="0",
    QuantityOfFilenames=-1,
    GenerateNext=int,
    Reset=button,
    LastSaveLocalization="neutral,N")  # -> Filepath, ListOfFilepath, CounterOfFirstFile
biomorpherreader = BiomorpherReader(Solution=biomorphersolution, Branch=0, Generation=integer_division, Design=mod)
pcexportstl = ExportSTL(
    Mesh=weld,
    Relocate=True,
    SavePath=pcfileseries.Filepath,
    SaveAsBinaryFile=True,
    SaveNow=int,
    LastSaveLocalization="neutral,N")

# ==== cluster Variance: Variance
num = ClusterInput()
num_2 = Number(num)
avr = Average(Input=num_2)
subtraction = Subtraction(A=avr, B=num_2)
lng = ListLength(List=num_2)
sqr = Square(Value=subtraction)
ma = MassAddition(Input=sqr)  # -> Result, PartialResults
division = Division(A=ma.Result, B=lng)
R = ClusterOutput(division)
