# Grasshopper definition BooleanBoxes.gh (Grasshopper 1.0.7)
# plug-ins: MeshEdit Components, Embryo, Biomorpher

genes = GenePool(
    Decimals=2,
    Maximum=10,
    Minimum=0,
    Value=[9.571275026, 1.167424326, 5.217996582, 2.686802034, 0.662650741, 6.848088888, 9.852472069, 4.638754621, 8.955964832, 7.238030237])
genes_2 = GenePool(
    Decimals=2,
    Maximum=10,
    Minimum=0,
    Value=[1.440404417, 3.541865923, 6.627213637, 7.824273732, 3.333424708, 8.177405316, 2.178667436, 9.677575403, 2.948198813, 8.399914204])
genes_3 = GenePool(
    Decimals=2,
    Maximum=10,
    Minimum=0,
    Value=[0.5140330412, 3.301868575, 9.216196956, 1.598630069, 7.817519525, 1.75663095, 3.986880334, 4.046200981, 5.667426049, 9.111463055])
genes_4 = GenePool(
    Decimals=2,
    Maximum=10,
    Minimum=0,
    Value=[3.846376158, 0.8764290301, 5.414025954, 4.61787625, 7.261337162, 1.875767723, 6.394346085, 1.936061807, 6.882107247, 8.431003466])
genes_5 = GenePool(
    Decimals=2,
    Maximum=10,
    Minimum=0,
    Value=[1.956914962, 7.374900308, 1.622503866, 8.233963311, 8.804715317, 6.153481214, 7.786094298, 3.666277851, 6.720128952, 1.925811429])
genes_6 = GenePool(
    Decimals=2,
    Maximum=10,
    Minimum=0,
    Value=[5.136431719, 9.913004292, 8.594691166, 7.008442258, 1.555100061, 6.269406451, 1.951227371, 3.619366513, 4.869282509, 8.906019791])
dom = ConstructDomain(DomainStart=genes_5, DomainEnd=genes_6)
dom_2 = ConstructDomain(DomainStart=genes_3, DomainEnd=genes_4)
dom_3 = ConstructDomain(DomainStart=genes, DomainEnd=genes_2)
box = DomainBox(Base=PlaneXY(0, 0, 0), X=dom_3, Y=dom_2, Z=dom)
bbox = BoundingBox(Content=box, Plane=PlaneXY(0, 0, 0), UnionBox=True)  # -> Box, Box_2
volume = Volume(Geometry=bbox.Box)  # -> Volume, Centroid
scale = Scale(Geometry=bbox.Box, Center=volume.Centroid, Factor="0.9")  # -> Geometry, Transform
number_slider = Slider(53, range=0..254)
number_slider_2 = Slider(137, range=0..254)
number_slider_3 = Slider(39, range=0..254)
sdiff = SolidDifference(BrepsA=scale.Geometry, BrepsB=box)
rgb = ColourRGB(Alpha=255, Red=number_slider, Green=number_slider_2, Blue=number_slider_3)
mesh = MeshBrep(
    Brep=sdiff,
    Settings={GridMaxCount=0, GridMinCount=16, JaggedSeams=False, MaxEdgeLength=0, MinEdgeLength=0.0001, MinTolerance=0, Refine=True, RefineAngle=0, RelativeTolerance=0.65, SimplePlanes=True, Tolerance=0})
mjoin = MeshJoin(Meshes=mesh)
mcol = MeshColours(Mesh=mjoin, Colours=rgb)
num = Number(Tree({0}: [0.6541241271, 0.6960090947, 0.655669323, 0.3297932857, 0.1231674189, 0.149462456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], {1}: [0.1342055021, 0.227353497, 0.03073510855, 0.6662764655, 0.2770747926, 0.03492233624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], {2}: [0.4871715584, 0.9708778108, 0.1854579776, 0.3892826016, 0.566058988, 0.584700452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], {3}: [0.5284747279, 0.2674473283, 0.205211076, 0.2260298376, 0.3041465191, 0.9194827759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], {4}: [0.02222211613, 0.7353420051, 0.2031032817, 0.5257840583, 0.1266440307, 0.1629205417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], {5}: [0.1384193805, 0.1413312429, 0.322569037, 0.7582760643, 0.3988022364, 0.9348235512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]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))
volume_2 = MeshVolume(Mesh=mcol)  # -> Volume, Centroid
biomorpher = Biomorpher(
    Genome=[number_slider_3, number_slider_2, number_slider, genes, genes_2, genes_3, genes_4, genes_5, genes_6],
    MeshEs=mcol,
    Performance=volume_2.Volume,
    InitialPop=num)  # -> GenoGuids, Population, Historic, Clusters
embryo = EmbryoSettings(Preview=True, SliderDomain=Domain(-10, 10), OneToOne=True, GridX=120, GridY=120, RemoveDead=True, OnlyTerminals=False)
data = Data(null)

# ---- group: Internalise these to store data
id = Guid([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])
num_2 = Number(Tree({0}: [0.6172481787, 0.9206840731, 0.2258505566, 0.2938435372, 0.6656749848, 0.4623977996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], {1}: [0.0218849443, 0.3865758425, 0.04050513918, 0.3820396528, 0.4954084686, 0.7614226014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], {2}: [0.4101331553, 0.6609654667, 0.5391960952, 0.4453300095, 0.8863127864, 0.5292228882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], {3}: [0.6993170831, 0.1739423849, 0.7879292191, 0.4227795002, 0.2000209699, 0.1062663361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], {4}: [0.5199322857, 0.9863361064, 0.604032439, 0.7746475035, 0.3644976948, 0.2340449897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], {5}: [0.003043550068, 0.8403189326, 0.8355986512, 0.3052467468, 0.8955638539, 0.2896880104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]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))
num_3 = Number()

# ---- group: Visualise Cluster Distribution
viewer = ParamViewer(biomorpher.Clusters)

# ----
biomorpherreader = BiomorpherReader(GenoGuids=id, Population=num_2, DesignID=Slider(7, range=0..10))
