# Grasshopper definition CocoonExample.gh (Grasshopper 0.9.76)
# plug-ins: Biomorpher, MarchingCubes

number_slider = Slider(6, range=0..12)
pi = Pi(Factor=number_slider)
crv = Curve([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])
range = Range(Domain=pi, Steps=expr("x*2", number_slider))
number_slider_2 = Slider(73, range=0..100)
number_slider_3 = Slider(8.5, range=1..10)
neg = Negative(Value=range)
pframes = PerpFrames(Curve=crv, Count=expr("x*2", number_slider), Align=True)  # -> Frames, Parameters
number_slider_4 = Slider(2, range=0..12)
entwine = Entwine(Branch00=range, Branch01=neg, FlattenInputs=True)
range_2 = Range(Domain=Domain(0, 1), Steps=number_slider_2)
number_slider_5 = Slider(64, range=0..100)
graph = GraphMapper(range_2, x0=0, x1=1, y0=0, y1=1, container_name="Parabola", Ox=0.5, Oy=0, Px=0.75, Py=0.25)
prot = RotatePlane(Plane=pframes.Frames, Angle=entwine)  # -> simplify(Plane)
number_slider_6 = Slider(3, range=0..10)
pi_2 = Pi(Factor=number_slider_4)
pt = PointOriented(BasePlane=prot, UComponent=number_slider_3, VComponent=0, WComponent=0)
range_3 = Range(Domain=pi_2, Steps=number_slider_5)
number_slider_7 = Slider(0.17, range=-3..2)
number_slider_8 = Slider(-0.21, range=-3..0)
genes = GenePool(Decimals=2, Maximum=2, Minimum=0, Value=[1.595692294, 0.2762711208, 1.793978763])
genes_2 = GenePool(Decimals=2, Maximum=2, Minimum=0, Value=[1.438183165, 1.894051389, 1.352903093])
number_slider_9 = Slider(1.5, range=1..30)
number_slider_10 = Slider(27.25, range=1..30)
number_slider_11 = Slider(26.94, range=1..30)
number_slider_12 = Slider(5.74, range=1..30)
number_slider_13 = Slider(25.9, range=1..30)
number_slider_14 = Slider(11.7, range=0..20)
sin = Sine(Value=range_3)
shift = ShiftList(List=pt, Shift=number_slider_6, Wrap=False)
intcrv = Interpolate(Vertices=shift, Degree=3, Periodic=False, KnotStyle=1)  # -> Curve, Length, Domain
abs = Absolute(Value=sin)
curve_charge = CurveCharge(Curve=intcrv.Curve, Radius=number_slider_13, ChargeStrengths=number_slider_7)  # -> flatten(CurveCharge)
curve_charge_2 = CurveCharge(Curve=crv, Radius=number_slider_14, ChargeStrengths=genes_2)
crv_2 = Curve(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)
curve_charge_3 = CurveCharge(Curve=crv_2, Radius=number_slider_9, ChargeStrengths=genes)
crv_3 = Curve(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)
curve_charge_4 = CurveCharge(Curve=crv_3, Radius=number_slider_10, ChargeStrengths=graph)
crv_4 = Curve(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)
curve_charge_5 = CurveCharge(Curve=crv_4, Radius=number_slider_11, ChargeStrengths=number_slider_8)
curve_charge_6 = CurveCharge(Curve=crv_4, Radius=number_slider_12, ChargeStrengths=abs)
merge = Merge(
    Data1=curve_charge_3,
    Data2=curve_charge_4,
    Data3=curve_charge_5,
    Data4=curve_charge_6,
    Data5=curve_charge_2,
    Data6=curve_charge)  # -> flatten(Result)
number_slider_15 = Slider(0.74, range=0..1)
number_slider_16 = Slider(7.6, range=0.5..10)
number_slider_17 = Slider(9, range=0..10)
number_slider_18 = Slider(7, range=0..10)
execute = BooleanToggle(True)
number_slider_19 = Slider(1.39, range=0..10)
number_slider_20 = Slider(3, range=0..30)
number_slider_21 = Slider(2, range=0..3)
cocoon = Cocoon(Charges=merge, Iso=number_slider_15, CellSize=number_slider_16, Execute=execute, Simple=False)  # -> Mesh, RefinementData
refine = Refine(
    RefinementData=cocoon.RefinementData,
    Samples=number_slider_20,
    SampleSize=number_slider_19,
    SampleTolerance="0.005",
    LaplacianSmoothing=number_slider_18,
    ValencePasses=number_slider_17,
    SubD=number_slider_21,
    Execute=Toggle(False))
preview = CustomPreview(
    Geometry=refine,
    Shader={ambient=RGB(128, 128, 128), diffuse=RGB(0, 0, 0), emission=RGB(51, 111, 111), shine=0.25, specular=RGB(255, 255, 255), transparency=0})
biomorpher = Biomorpher(
    Genome=[number_slider_6, number_slider_7, number_slider_13, number_slider_3, number_slider, number_slider_14, number_slider_9, number_slider_8, number_slider_11, number_slider_12, number_slider_2, number_slider_21, number_slider_17, number_slider_18, number_slider_19, number_slider_20, number_slider_16, number_slider_15, number_slider_10, number_slider_5, number_slider_4],
    Geometry=refine)  # -> Clusters, Population, Historic, Clusters_2
