# Grasshopper definition EmbryoExample.gh (Grasshopper 1.0.7)
# plug-ins: Embryo, Biomorpher

pt = ConstructPoint(XCoordinate=0, YCoordinate=0, ZCoordinate=0)
pt_2 = ConstructPoint(XCoordinate=0, YCoordinate=0, ZCoordinate=0)
pt_3 = ConstructPoint(XCoordinate=0, YCoordinate=0, ZCoordinate=0)
box_corners = BoxCorners()  # -> CornerA, CornerB, CornerC, CornerD, CornerE, CornerF, CornerG, CornerH
pl_3pt = Plane3Pt()
pl_3pt_2 = Plane3Pt()
box = Box2Pt(Plane=PlaneXY(0, 0, 0))
box_2 = CenterBox(Base=PlaneXY(0, 0, 0), X=1, Y=1, Z=1)
g_slider19 = Slider(0.68, range=-10..10)
g_slider18 = Slider(-2.03, range=-10..10)
g_slider17 = Slider(3.13, range=-10..10)
g_slider16 = Slider(-2.03, range=-10..10)
g_slider15 = Slider(2.44, range=-10..10)
g_slider14 = Slider(-5.53, range=-10..10)
g_slider13 = Slider(-7.91, range=-10..10)
g_slider12 = Slider(-6.63, range=-10..10)
g_slider11 = Slider(3.62, range=-10..10)
g_slider10 = Slider(4.06, range=-10..10)
g_slider9 = Slider(0.68, range=-10..10)
g_slider8 = Slider(-2.03, range=-10..10)
g_slider7 = Slider(3.13, range=-10..10)
g_slider6 = Slider(-2.03, range=-10..10)
g_slider5 = Slider(2.44, range=-10..10)
g_slider4 = Slider(-5.53, range=-10..10)
g_slider3 = Slider(-7.91, range=-10..10)
g_slider2 = Slider(-6.63, range=-10..10)
g_slider1 = Slider(3.62, range=-10..10)
# Needs 'Embryo' to run
# https://www.food4rhino.com/app/embryo
g_slider0 = Slider(4.06, range=-10..10)
genes = GenePool(
    Decimals=2,
    Maximum=10,
    Minimum=-10,
    Value=[4.060092547, 3.620910064, -6.628707208, -7.909917989, -5.534970637, 2.441507276, -2.033337286, 3.134314769, -2.032469023, 0.6831012809])
genes_2 = GenePool(
    Decimals=0,
    Maximum=100,
    Minimum=0,
    Value=[61.18412674, 27.42272387, 12.40727284, 35.31561718, 6.426925679, 31.80136859, 99.20622234, 95.72961541, 60.61712861, 17.57222517])
genes_3 = GenePool(
    Decimals=0,
    Maximum=100,
    Minimum=0,
    Value=[74.17007074, 53.73019526, 22.13645221, 78.1710453, 20.08306925, 29.16691385, 83.62480215, 68.2188475, 3.279423377, 64.68713946])
embryo = EmbryoSettings(
    Preview=Toggle(False),
    SliderDomain=Domain(-10, 10),
    OneToOne=Toggle(True),
    GridX=120,
    GridY=120,
    RemoveDead=True,
    OnlyTerminals=Toggle(True))
embryo_2 = Embryo(
    Reset=Toggle(True),
    Sliders=Slider(20, range=0..100),
    Components=Slider(32, range=0..1000),
    MetricGenes=genes,
    TopologyGenes=genes_2,
    FunctionGenes=genes_3,
    Settings=embryo,
    RandomOveride=0)  # -> Iterations, Components
g_pt = ConstructPoint(XCoordinate=0, YCoordinate=0, ZCoordinate=0)
g_pt_2 = ConstructPoint(XCoordinate=0, YCoordinate=0, ZCoordinate=0)
g_pt_3 = ConstructPoint(XCoordinate=0, YCoordinate=0, ZCoordinate=0)
g_pt_4 = ConstructPoint(XCoordinate=0, YCoordinate=0, ZCoordinate=0)
g_pt_5 = ConstructPoint(XCoordinate=g_slider10, YCoordinate=g_slider19, ZCoordinate=g_slider8)
g_pt_6 = ConstructPoint(XCoordinate=g_slider11, YCoordinate=g_slider5, ZCoordinate=g_slider7)
g_box = CenterBox(Base=PlaneXY(0, 0, 0), X=g_slider15, Y=g_slider3, Z=g_slider2)
g_box_2 = CenterBox(Base=PlaneXY(0, 0, 0), X=g_slider6, Y=g_slider12, Z=g_slider0)
g_pt_7 = ConstructPoint(XCoordinate=g_slider1, YCoordinate=g_slider9, ZCoordinate=g_slider14)
g_box_3 = CenterBox(Base=g_pt_7, X=g_slider13, Y=g_slider17, Z=g_slider4)
g_box_corners = BoxCorners(Box=g_box_2)  # -> CornerA, CornerB, CornerC, CornerD, CornerE, CornerF, CornerG, CornerH
g_box_corners_2 = BoxCorners(Box=g_box)  # -> CornerA, CornerB, CornerC, CornerD, CornerE, CornerF, CornerG, CornerH
g_box_4 = CenterBox(Base=g_box_corners_2.CornerA, X=1, Y=1, Z=1)
g_box_5 = CenterBox(Base=g_box_corners.CornerB, X=1, Y=1, Z=1)
g_box_6 = CenterBox(Base=g_box_corners.CornerG, X=1, Y=1, Z=1)
g_box_7 = CenterBox(Base=g_box_corners.CornerH, X=g_slider16, Y=g_slider18, Z=1)
g_box_corners_3 = BoxCorners(Box=g_box_3)  # -> CornerA, CornerB, CornerC, CornerD, CornerE, CornerF, CornerG, CornerH
g_box_8 = Box2Pt(PointA=g_box_corners.CornerC, PointB=g_box_corners.CornerE, Plane=g_box_corners_3.CornerE)
g_box_9 = CenterBox(Base=g_box_corners_3.CornerG, X=1, Y=1, Z=1)
g_pl_3pt = Plane3Pt(PointA=g_box_corners_2.CornerE, PointB=g_box_corners_3.CornerD, PointC=g_box_corners_2.CornerF)
g_box_corners_4 = BoxCorners(Box=g_box_5)  # -> CornerA, CornerB, CornerC, CornerD, CornerE, CornerF, CornerG, CornerH
g_box_corners_5 = BoxCorners(Box=g_box_7)  # -> CornerA, CornerB, CornerC, CornerD, CornerE, CornerF, CornerG, CornerH
g_box_corners_6 = BoxCorners(Box=g_box_6)  # -> CornerA, CornerB, CornerC, CornerD, CornerE, CornerF, CornerG, CornerH
g_box_10 = CenterBox(Base=g_box_corners_6.CornerH, X=1, Y=1, Z=1)
g_box_corners_7 = BoxCorners(Box=g_box_9)  # -> CornerA, CornerB, CornerC, CornerD, CornerE, CornerF, CornerG, CornerH
g_box_11 = Box2Pt(PointA=g_box_corners_6.CornerG, PointB=g_box_corners_6.CornerF, Plane=g_box_corners_7.CornerF)
g_pl_3pt_2 = Plane3Pt(PointA=g_box_corners_6.CornerB, PointB=g_box_corners_7.CornerC, PointC=g_box_corners.CornerA)
get_geometry = GetGeometry(G=[g_box_3, g_box_2, g_box, g_box_7, g_box_9, g_box_6, g_box_8, g_box_5, g_box_4, g_box_10, g_box_11])
clean = CleanTree(RemoveNulls=True, RemoveInvalid=True, RemoveEmpty=False, Tree=get_geometry)

# ---- group: Site contraints
dom = ConstructDomain(DomainStart=Slider(-83, range=-100..0), DomainEnd=Slider(86.79, range=0..100))
dom_2 = ConstructDomain(DomainStart=Slider(-50.232, range=-100..0), DomainEnd=Slider(50.09, range=0..100))
box_3 = DomainBox(Base=PlaneXY(0, 0, 0), X=dom, Y=dom_2, Z=Domain(0, 140))

# ----
# Post-production phase
lng = ListLength(List=flatten(clean))

# ---- group: Remove zero volume and boolean
cluster = Cluster(geo=clean)

# ----
bbox = BoundingBox(Content=cluster, Plane=PlaneXY(0, 0, 0), UnionBox=True)  # -> Box, Box_2

# ---- group: Map to site constraints
boxmap = BoxMapping(Geometry=cluster, Source=bbox.Box, Target=box_3)  # -> Geometry, Transform

# ----
target_gea = Panel("144000")
floor_to_floor_height = Panel("3.6")
fastbrepvolume = FastBrepVolume(InputBrep=boxmap.Geometry)
multiplication = Multiplication(A=target_gea, B=floor_to_floor_height)
number_slider = Slider(100, range=0..100)
# Scales in Z to meet a target GEA
division = Division(A=multiplication, B=fastbrepvolume)
custom_mesh_settings = SettingsCustom(
    StitchSeams=True,
    SimplePlanes=False,
    Refine=True,
    MinCount=Slider(0, range=0..100),
    MaxCount=400,
    AspectRatio=20,
    MaxDistance=0,
    MaxAngle=20,
    MinEdge=number_slider,
    MaxEdge=number_slider)
scale_nu = ScaleNU(Geometry=boxmap.Geometry, Plane=PlaneXY(0, 0, 0), ScaleX=1, ScaleY=1, ScaleZ=division)  # -> Geometry, Transform
mesh = MeshBrep(Brep=scale_nu.Geometry, Settings=custom_mesh_settings)
wires = BrepWireframe(Brep=scale_nu.Geometry, Density=-1)
mjoin = MeshJoin(Meshes=mesh)
preview = CustomPreview(Geometry=wires, Shader=ColourSwatch(SwatchColor=RGB(0, 0, 0)))

# ---- group: Ground plane
number_slider_2 = Slider(100, range=0..100)
dom_3 = ConstructDomain(DomainStart=expr("x*-1", number_slider_2), DomainEnd=number_slider_2)
rectangle = Rectangle(Plane=PlaneXY(0, 0, 0), XSize=dom_3, YSize=dom_3, Radius=0)  # -> Rectangle, Length
mplane = MeshPlane(Boundary=rectangle.Rectangle, WidthCount="1", HeightCount="1")  # -> Mesh, Area
mcol = MeshColours(Mesh=mplane.Mesh, Colours=ColourSwatch(SwatchColor=RGB(128, 128, 128)))

# ---- group: Create columns
cluster_2 = Cluster_2(M=mjoin)

# ----
clean_2 = CleanTree(RemoveNulls=True, RemoveInvalid=True, RemoveEmpty=False, Tree=cluster_2)
mjoin_2 = MeshJoin(Meshes=clean_2)
lng_2 = ListLength(List=clean_2)
mcol_2 = MeshColours(Mesh=mjoin, Colours=ColourSwatch(SwatchColor=RGB(255, 255, 255)))
mcol_3 = MeshColours(Mesh=mjoin_2, Colours=ColourSwatch(SwatchColor=RGB(0, 0, 0)))
# Make some columns
biomorpher = Biomorpher(Genome=[genes, genes_2, genes_3], Meshes=[mcol_2, mcol_3, mcol], Perform=[lng_2, lng])

# ==== cluster Cluster
geo = ClusterInput()
geo_2 = Geometry(geo)
fastbrepvolume = FastBrepVolume(InputBrep=geo_2)
larger = LargerThan(FirstNumber=fastbrepvolume, SecondNumber="10")  # -> LargerThan, OrEqualTo
dispatch = Dispatch(List=geo_2, DispatchPattern=larger.LargerThan)  # -> ListA, ListB
cap = CapHoles(Brep=dispatch.ListA)
sunion = SolidUnion(Breps=flatten(cap))
R = ClusterOutput(sunion)

# ==== cluster Cluster_2
M = ClusterInput()
Z = UnitZ(Factor=1)
facen = FaceNormals(Mesh=M)  # -> Centers, Normals
dprod = DotProduct(VectorA=facen.Normals, VectorB=Z, Unitize=True)
smaller = SmallerThan(FirstNumber=dprod, SecondNumber="-0.9")  # -> SmallerThan, OrEqualTo
dispatch = Dispatch(List=facen.Centers, DispatchPattern=smaller.SmallerThan)  # -> ListA, ListB
pdecon = Deconstruct(Point=dispatch.ListA)  # -> XComponent, YComponent, ZComponent
pt = ConstructPoint(XCoordinate=pdecon.XComponent, YCoordinate=pdecon.YComponent, ZCoordinate=0)
ln = Line(StartPoint=dispatch.ListA, EndPoint=pt)
len = Length(Curve=ln)
addition = Addition(A=len, B=Slider(0.01, range=0..0.01))
multiplication = Multiplication(A=addition, B=Slider(0.05, range=0..0.1))
mpipe = MeshPipe(Curve=ln, Radius=multiplication, Accuracy=0.2, Rotation=0, Segments=10, Caps=0)
M_2 = ClusterOutput(mpipe)
