# Grasshopper definition K1Example_Origami.gh (Grasshopper 0.9.76)
# plug-ins: Biomorpher, Kangaroo Components, Mesh Pipe

# ---- group: Try increasing, then run Kangaroo again
number_slider = Slider(25, range=0..100)

# ----
rectangle = Rectangle(Plane=PlaneXY(0, 0, 0), XSize=Domain(-1, 1), YSize=Domain(-2, 2), Radius=0)  # -> Rectangle, Length
pop2d = Populate2D(Region=rectangle.Rectangle, Count=number_slider, Seed=Slider(3, range=0..10))
del = DelaunayMesh(Points=pop2d, Plane=rectangle.Rectangle)
genes = GenePool(
    Decimals=0,
    Maximum=1,
    Minimum=0,
    Value=[0.9532753923, 0.1821976915, 0.04467957096, 0.04131543685, 0.8866189839, 0.8354064076, 0.1811923958, 0.001199785155, 0.590651531, 0.0962941959, 0.2181355344, 0.3092849372])
medges = MeshEdges(Mesh=del)  # -> NakedEdges, InteriorEdges, NonManifoldEdges

# ---- group: Target angles (it will try, but it might not fold to this depending on pattern)
rad = Radians(Degrees=Slider(90, range=0..100))
rad_2 = Radians(Degrees=Slider(-90, range=-100..0))

# ----
dispatch = Dispatch(List=medges.InteriorEdges, DispatchPattern=genes)  # -> ListA, ListB

# ---- group: % of angle. Use to show folding
number_slider_2 = Slider(1, range=0..1)

# ---- group: Stick all geometry into a tree, that can be exploded on the other side
entwine = Entwine(Branch00=del, Branch01=dispatch.ListA, Branch02=dispatch.ListB, FlattenInputs=True)

# ---- group: Pinned node
item = ListItem(List=pop2d, Index=0, Wrap=True)

# ----
kangaroo_settings = KangarooSettings(
    Tolerance=0.001,
    TimeStep=Slider(0.03, range=0..0.1),
    SubIterations=10,
    Floor=Toggle(True),
    Drag=1,
    Restitution=0.7,
    StaticFriction=10,
    KineticFriction=10,
    Settle=2,
    Tumble=1,
    Sound=False,
    Solver=0)
origami = Origami(mesh=del, C=dispatch.ListA, num_4=rad, C_2=dispatch.ListB, num_2=rad_2, num=number_slider_2)  # -> data_2, R
zombie = ZombieKangaroo(
    ForceObjects=flatten(origami.data_2),
    AnchorPoints=item,
    Settings=kangaroo_settings,
    Geometry=entwine,
    Threshold=Slider(0, range=0..0.01),
    MaxIters=2000)  # -> Out, Iterations, ParticlesOut, GeometryOut, KE

# ---- group: Explode bits of geometry
bang = ExplodeTree(Data=zombie.GeometryOut)  # -> Branch0, Branch1, Branch2

# ----
mcol = MeshColours(Mesh=bang.Branch0, Colours=ColourSwatch(SwatchColor=RGB(227, 227, 227)))
mpipe = MeshPipe(Curve=bang.Branch2, Radius=0.01, Accuracy=0.2, Rotation=0, Segments=3, Caps=2)
mpipe_2 = MeshPipe(Curve=bang.Branch1, Radius=0.01, Accuracy=0.2, Rotation=0, Segments=3, Caps=2)
lng = ListLength(List=bang.Branch1)
lng_2 = ListLength(List=bang.Branch2)
mjoin = MeshJoin(Meshes=mpipe)
mjoin_2 = MeshJoin(Meshes=mpipe_2)

# ---- group: Initial edge lengths
len = Length(Curve=[dispatch.ListA, dispatch.ListB])
ma = MassAddition(Input=len)  # -> Result, PartialResults
panel = Panel(ma.Result)

# ---- group: Check lengths after origami (should be approximately same)
len_2 = Length(Curve=flatten([bang.Branch1, bang.Branch2]))
ma_2 = MassAddition(Input=len_2)  # -> Result, PartialResults
panel_2 = Panel(ma_2.Result)

# ----
mcol_2 = MeshColours(Mesh=mjoin, Colours=ColourSwatch(SwatchColor=RGB(255, 0, 0)))
mcol_3 = MeshColours(Mesh=mjoin_2, Colours=ColourSwatch(SwatchColor=RGB(140, 0, 255)))
biomorpher = Biomorpher(Genome=genes, Geometry=[mcol_3, mcol_2, mcol], Performance=[lng, lng_2])  # -> GenoGuids, Population, Historic, Clusters

# ==== cluster Origami: Fold a flat pattern into 3d origami
mesh = ClusterInput()
mesh_2 = Mesh(mesh)
num = ClusterInput()
num_2 = ClusterInput()
hingepoints = HingePoints(Mesh=mesh_2)  # -> _1, _2, _3, _4
strength = Panel("1")
num_3 = Number(num)
C = ClusterInput()
C_2 = ClusterInput()
num_4 = ClusterInput()
strength_2 = Panel("1")
num_5 = Number(num_2)
num_6 = Number(strength)
eval = EvaluateCurve(Curve=reparameterize(C), Parameter=0.5)  # -> Point, Tangent, Angle
eval_2 = EvaluateCurve(Curve=reparameterize(C_2), Parameter=0.5)  # -> Point, Tangent, Angle
ln = Line(StartPoint=hingepoints._1, EndPoint=hingepoints._2)
num_7 = Number(num_4)
num_8 = Number(strength_2)
tri = Triangulate(Mesh=mesh_2)  # -> Mesh, Count
multiplication = Multiplication(A=num_7, B=num_3)
multiplication_2 = Multiplication(A=num_5, B=num_3)
eval_3 = EvaluateCurve(Curve=reparameterize(ln), Parameter=0.5)  # -> graft(Point), Tangent, Angle
springsfrommesh = SpringsFromMesh(M=tri.Mesh, stiffness=100, B=1)
planarizequads = PlanarizeQuads(M=mesh_2, planarizestrength=1000)
unweld = UnweldMesh(Mesh=mesh_2, Angle=0)
cp = ClosestPoint(Point=eval_3.Point, Cloud=eval_2.Point)  # -> ClosestPoint, CPIndex, Distance
cp_2 = ClosestPoint(Point=eval_3.Point, Cloud=eval.Point)  # -> ClosestPoint, CPIndex, Distance
R = ClusterOutput(unweld)
larger = LargerThan(FirstNumber=0.01, SecondNumber=cp.Distance)  # -> LargerThan, OrEqualTo
larger_2 = LargerThan(FirstNumber=0.01, SecondNumber=cp_2.Distance)  # -> LargerThan, OrEqualTo
cull = CullPattern(List=num_8, CullPattern=larger_2.LargerThan)
cull_2 = CullPattern(List=multiplication, CullPattern=larger_2.LargerThan)
cull_3 = CullPattern(List=num_6, CullPattern=larger.LargerThan)
cull_4 = CullPattern(List=multiplication_2, CullPattern=larger.LargerThan)
addition = Addition(A=cull, B=cull_3)
addition_2 = Addition(A=cull_2, B=cull_4)
addition_3 = Addition(A=0, B=addition)  # -> flatten(Result)
addition_4 = Addition(A=0, B=addition_2)  # -> flatten(Result)
hinge = Hinge(
    Point1=hingepoints._1,
    Point2=hingepoints._2,
    Point3=hingepoints._3,
    Point4=hingepoints._4,
    Strength=addition_3,
    RestAngle=addition_4)
data = Data([springsfrommesh, hinge, planarizequads])
data_2 = ClusterOutput(data)

# ==== cluster PlanarizeQuads: Applies a planarization force to any quads in a mesh
M = ClusterInput()
mcomp = Decompose(Mesh=M)  # -> Vertices, Faces, Colours, Normals
vertices = FaceVertices(Face=mcomp.Faces)  # -> CornerA, CornerB, CornerC, CornerD
planarizestrength = ClusterInput()
item = ListItem(List=mcomp.Vertices, Index=vertices.CornerA, Wrap=False)
item_2 = ListItem(List=mcomp.Vertices, Index=vertices.CornerB, Wrap=False)
item_3 = ListItem(List=mcomp.Vertices, Index=vertices.CornerC, Wrap=False)
item_4 = ListItem(List=mcomp.Vertices, Index=vertices.CornerD, Wrap=False)
planarize = Planarize(Point1=item, Point2=item_2, Point3=item_3, Point4=item_4, PlanarizeStrength=planarizestrength)
equals = Equality(FirstNumber=vertices.CornerC, SecondNumber=vertices.CornerD)  # -> Equality, Inequality
cull = CullPattern(List=planarize, CullPattern=equals.Inequality)
L = ClusterOutput(cull)

# ==== cluster SpringsFromMesh: Turns all edges of a mesh into springs
M = ClusterInput()
medges = MeshEdges(Mesh=M)  # -> NakedEdges, InteriorEdges, NonManifoldEdges
crv = Curve([medges.NakedEdges, medges.InteriorEdges])
B = ClusterInput()
len = Length(Curve=crv)
multiplication = Multiplication(A=len, B=B)
stiffness = ClusterInput()
springs = SpringsFromLine(Connection=crv, Stiffness=stiffness, Damping=10, RestLength=multiplication, UpperCutoff=0, LowerCutoff=0, Plasticity=0)
S = ClusterOutput(springs)
