# Grasshopper definition K2 HenryMoore.gh (Grasshopper 1.0.7)
# plug-ins: MarchingCubes, MeshEdit Components, Biomorpher, Weaverbird, Kangaroo2 Components

# ---- group: Boundary curve
crv = Curve(reparameterize(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))

# ----
number_slider = Slider(0.64, range=0..1)
# Sculptures are generated resembling the work of the artist Henry Moore.
# You will need Kangaroo 2, Weaverbird and Cocoon plug-ins.
# Double click on the Biomorpher component to begin.
# I know Henry Moore would probably hate this.
panel = Panel("""1
1""")
rotate = Rotate(Geometry=crv, Angle=1.570796327, Plane=PlaneXY(0, 0, 0))  # -> Geometry, Transform
genes = GenePool(Decimals=4, Maximum=1, Minimum=0, Value=[0.3114076328, 0.1537547401, 0.0008642412726, 0.5956234581, 0.7931934603])
dash = DashPattern(Curve=rotate.Geometry, Pattern=panel)  # -> Dashes, Gaps
seam = Seam(Curve=rotate.Geometry, Seam=number_slider)
pipe = Pipe(Curve=seam, Radius=0.5, Caps=0)
eval = EvaluateCurve(Curve=reparameterize(seam), Parameter=genes)  # -> Point, Tangent, Angle
mesh_uv = MeshSurface(Surface=pipe, UCount=50, VCount=5, Overhang=True, Equalize=False)
cps = ClosestPoints(Point=eval.Point, Cloud=eval.Point, Count=Slider(3, range=0..10))  # -> ClosestPoint, CPIndex, Distance

# ---- group: Exclude self
split = SplitList(List=simplify(cps.ClosestPoint), Index=Slider(1, range=0..1))  # -> ListA, ListB

# ----
ln = Line(StartPoint=graft(eval.Point), EndPoint=split.ListB)  # -> flatten(Line)
len = Length(Curve=ln)
division = Division(A=len, B=Slider(8, range=0..100))
divide = DivideCurve(Curve=ln, Count=division, Kinks=False)  # -> Points, Tangents, Parameters
pline = PolyLine(Vertices=divide.Points, Closed=False)
explode = Explode(Curve=pline, Recursive=True)  # -> Segments, Vertices
Z = UnitZ(Factor=Slider(40, range=0..100))
end = EndPoints(Curve=ln)  # -> Start, End
load = Load(Point=explode.Vertices, ForceVector=Z)
length_line = LengthLine(Line=explode.Segments, Length=Slider(0, range=0..100), Strength=10)
anchor = Anchor(Point=[end.Start, end.End], Strength=10000)
show = Show(G=pline)
entwine = Entwine(Branch00=show, Branch01=length_line, Branch02=load, Branch03=anchor, FlattenInputs=True)
zombiesolver = ZombieSolver(GoalObjects=entwine, Threshold=1e-10, Tolerance=0.01, MaxIterations=50000)  # -> I, V, O
lng = ListLength(List=ln)

# ---- group: K2 Zombie Solver won't preserve tree structure
split_2 = SplitList(List=zombiesolver.O, Index=lng)  # -> ListA, ListB

# ----
curve_charge = CurveCharge(Curve=flatten(split_2.ListA), Radius=Slider(12, range=0..100), ChargeStrengths=Slider(7.76, range=0..10))
cocoon = Cocoon(
    Charges=flatten(curve_charge),
    Iso=Slider(4.01, range=0..10),
    CellSize=Slider(5, range=0..10),
    Execute=Toggle(True),
    Simple=False)  # -> Mesh, RefinementData
wblaplace = WeaverbirdsLaplacianSmoothing(MeshCurves=cocoon.Mesh, Level=Slider(10, range=0..10), SmoothNakedEdges=2, Thin=1)
mjoin = MeshJoin(Meshes=wblaplace)
volume = MeshVolume(Mesh=mjoin)  # -> Volume, Centroid
mcol = MeshColours(Mesh=mjoin, Colours=ColourSwatch(SwatchColor=RGB(255, 255, 255)))
medges = MeshEdges(Mesh=mcol)  # -> NakedEdges, InteriorEdges, NonManifoldEdges

# ---- group: (Avoid null)
addition = Addition(A=volume.Volume, B=Slider(0.01, range=0..0.01))

# ----
biomorpher = Biomorpher(Genome=[number_slider, genes], Meshes=[mcol, mesh_uv], Perform=addition)
preview = CustomPreview(Geometry=medges.InteriorEdges, Material=ColourSwatch(SwatchColor=RGB(59, 59, 59)))

# ---- group: Internalise Biomorpher Solutions here
biomorphersolution = BiomorpherSolution()

# ----
biomorpherreader = BiomorpherReader(Branch=Slider(0, range=0..10), Generation=Slider(0, range=0..10), Design=Slider(10, range=0..10))
