# Grasshopper definition K2Example_Origami.gh (Grasshopper 1.0.7)
# plug-ins: Biomorpher, Kangaroo2 Components

# In this example, a flat triangulated mesh is
# folded to a a given angle (90 degrees) with
# valley and mountain folds determined by the
# genome.
# 
# Geometric constraints will mean the shape
# does not fully fold, but assume an
# unpredictable final form.
mplane = MeshPlane(Boundary={Plane=PlaneXY(0, 0, 0), Size=Domain2(u=-10..10, v=-10..10)}, WidthCount=4, HeightCount=4)  # -> Mesh, Area

# ---- group: Your mesh here
mesh = Mesh(mplane.Mesh)

# ----
genes = GenePool(
    Decimals=0,
    Maximum=1,
    Minimum=0,
    Value=[0.7933465451, 0.6906100175, 0.3596412378, 0.6118302898, 0.5836787944, 0.7841962854, 0.1590987333, 0.2805996385, 0.3904225698, 0.1993352334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])
tri = Triangulate(Mesh=mesh)  # -> Mesh, Count
folding = Slider(0.5, range=0..0.99)
medges = MeshEdges(Mesh=tri.Mesh)  # -> NakedEdges, InteriorEdges, NonManifoldEdges
angle = Panel("-pi")
angle_2 = Panel("pi")
dispatch = Dispatch(List=medges.InteriorEdges, DispatchPattern=genes)  # -> ListA, ListB
hingepoints = HingePoints(Mesh=tri.Mesh)  # -> _1, _2, _3, _4
multiplication = Multiplication(A=angle_2, B=folding)
multiplication_2 = Multiplication(A=angle, B=folding)
ln = Line(StartPoint=hingepoints._1, EndPoint=hingepoints._2)

# ---- group: maintain edge lengths
medges_2 = MeshEdges(Mesh=tri.Mesh)  # -> NakedEdges, InteriorEdges, NonManifoldEdges
length_line = LengthLine(Line=[medges_2.NakedEdges, medges_2.InteriorEdges], Strength=10)

# ---- group: a weak plastic anchor on all points prevents drift
demesh = DeconstructMesh(Mesh=tri.Mesh)  # -> Vertices, Faces, Colours, Normals
plasticanchor = PlasticAnchor(Point=demesh.Vertices, Limit=0.01, Strength=0.01)

# ----
show = Show(G=tri.Mesh)
hinge = Hinge(
    FoldStart=hingepoints._1,
    FoldEnd=hingepoints._2,
    Tip1=hingepoints._3,
    Tip2=hingepoints._4,
    RestAngle=multiplication,
    Strength=0.01)
eval = EvaluateCurve(Curve=reparameterize(dispatch.ListA), Parameter=0.5)  # -> Point, Tangent, Angle
eval_2 = EvaluateCurve(Curve=reparameterize(dispatch.ListB), Parameter=0.5)  # -> Point, Tangent, Angle
eval_3 = EvaluateCurve(Curve=ln, Parameter=0.5)  # -> graft(Point), Tangent, Angle
hinge_2 = Hinge(
    FoldStart=hingepoints._1,
    FoldEnd=hingepoints._2,
    Tip1=hingepoints._3,
    Tip2=hingepoints._4,
    RestAngle=multiplication_2,
    Strength=0.01)
dist = Distance(PointA=eval.Point, PointB=eval_3.Point)
dist_2 = Distance(PointA=eval_2.Point, PointB=eval_3.Point)
sort = SortList(Keys=dist)  # -> Keys, ValuesA
sort_2 = SortList(Keys=dist_2)  # -> Keys, ValuesA
item = ListItem(List=sort.Keys, Index=0, Wrap=True)
item_2 = ListItem(List=sort_2.Keys, Index=0, Wrap=True)
smaller = SmallerThan(FirstNumber=item, SecondNumber=0.01)  # -> flatten(SmallerThan), OrEqualTo
smaller_2 = SmallerThan(FirstNumber=item_2, SecondNumber=0.01)  # -> flatten(SmallerThan), OrEqualTo
cull = CullPattern(List=hinge_2, CullPattern=smaller.SmallerThan)
cull_2 = CullPattern(List=hinge, CullPattern=smaller_2.SmallerThan)
zombiesolver = ZombieSolver(
    GoalObjects=[show, plasticanchor, length_line, cull, cull_2],
    Threshold=1e-10,
    Tolerance=0.01,
    MaxIterations=Slider(1000, range=0..1000))  # -> I, V, O
item_3 = ListItem(List=zombiesolver.O, Index=0, Wrap=True)
preview = CustomPreview(
    Geometry=item_3,
    Material={diffuse=RGB(221, 160, 221), emission=RGB(66, 48, 66), shine=0.5, specular=RGB(255, 255, 255), transparency=0})
mcol = MeshColours(Mesh=item_3, Colours=ColourSwatch(SwatchColor=RGB(168, 168, 168)))
biomorpher = Biomorpher(Genome=genes, MeshEs=mcol)  # -> GenoGuids, Population, Historic, Clusters
