# Grasshopper definition KarambaExample.gh (Grasshopper 0.9.76)
# plug-ins: Biomorpher, Karamba

genes = GenePool(
    Decimals=3,
    Maximum=1,
    Minimum=0,
    Value=[0.9588098046, 0.3744414683, 0.1246528095, 0.4737203817, 0.9799453742, 0.351504137, 0.5667336558, 0.9781799493, 0.4785193026, 0.1058133701])
genes_2 = GenePool(
    Decimals=3,
    Maximum=1,
    Minimum=0,
    Value=[0.3817062268, 0.4100272583, 0.8619884629, 0.6012630428, 0.8049712529, 0.8711170176, 0.06389640228, 0.07774876481, 0.8611080874, 0.1269090307])
genes_3 = GenePool(
    Decimals=3,
    Maximum=1,
    Minimum=0,
    Value=[0.5339389753, 0.144996049, 0.02577549826, 0.7270001465, 0.4201187605, 0.9003652362, 0.6615856596, 0.1213823385, 0.222569733, 0.264182177])

# ---- group: Edge curves
# Geometry
crv = Curve(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)
crv_2 = Curve(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)

# ----
divide = DivideCurve(Curve=crv, Count=10, Kinks=False)  # -> Points, Tangents, Parameters
divide_2 = DivideCurve(Curve=crv_2, Count=10, Kinks=False)  # -> Points, Tangents, Parameters
xz = XZPlane(Origin=Point(0, 0, 0))
pt = ConstructPoint(XCoordinate=genes, YCoordinate=genes_2, ZCoordinate=0)
rulesrf = RuledSurface(CurveA=crv, CurveB=crv_2)
mirror = Mirror(Geometry=divide_2.Points, Plane=xz)  # -> Geometry, Transform
mirror_2 = Mirror(Geometry=divide.Points, Plane=xz)  # -> Geometry, Transform

# ---- group: Support locations
pt_2 = Point([Point(0, 6.781586872, -0.6067542443), Point(0, -6.781586872, -0.6067542443), Point(10.52206223, -6.781586872, -0.6067542443), Point(10.52206223, 6.781586872, -0.6067542443)])

# ----
evalsrf = EvaluateSurface(Surface=reparameterize(rulesrf), Point=pt)  # -> Point, Normal, Frame

# ---- group: Load locations
pt_3 = Point([Point(30.56491157, -2.585793222, 15.02513154), Point(30.56491157, 2.585793222, 15.02513154)])

# ----
xz_2 = XZPlane(Origin=Point(0, 0, 0))
pt_4 = Point(flatten([divide.Points, divide_2.Points, mirror_2.Geometry, mirror.Geometry]))
project = Project(Geometry=evalsrf.Point, Plane=xz_2)  # -> Geometry, Transform
vec2pt = Vector2Pt(PointA=evalsrf.Point, PointB=project.Geometry, Unitize=False)  # -> Vector, Length
multiplication = Multiplication(A=vec2pt.Vector, B=genes_3)
move = Move(Geometry=evalsrf.Point, Motion=multiplication)  # -> Geometry, Transform
mirror_3 = Mirror(Geometry=move.Geometry, Plane=xz_2)  # -> Geometry, Transform
merge = Merge(Data1=mirror_3.Geometry, Data2=move.Geometry)
merge_2 = Merge(Data1=pt_2, Data2=merge, Data3=pt_4, Data4=pt_3)  # -> flatten(Result)

# ---- group: Show supports
msphereex = MeshSphereEx(Base=pt_2, Radius="0.75", Count=5)

# ----
nearn = NearestNeighborsKaramba(FromPoints=merge_2, ToPoints=merge_2, NumberOfNeighbors=Slider(5, range=0..10), LimitDistance=Slider(5, range=0..10))  # -> Line, Connectivity, Points
rdlines = RemoveDuplicateLinesKaramba(Line=flatten(nearn.Line), LimitDistance=0.005)  # -> OutLine, Info, Indexes
linetobeam = LineToBeamKaramba(Line=rdlines.OutLine, New=True, Remove=True, LimitDistance_m=0.005)  # -> Element, Points, Info
Z = UnitZ(Factor="-10")
supp = SupportKaramba(PosInd=pt_2, menu=[buttons(on, on, on, on, on, on)])
loads = LoadsKaramba(ForceVector=Z, Local=False, PosInd=pt_3, LCase=0, mode="Point")
crosecrselect = CrossSectionRangeSelectorKaramba(MaximumHeight_cm=-1, MaximumWidth_cm=-1, menu=[dropdown(2), dropdown(3), dropdown(4)])
item = ListItem(List=crosecrselect, Index="174", Wrap=True)
assemble = AssembleModelKaramba(Elem=linetobeam.Element, Support=supp, Load=loads, CrossSection=item, LimitDistance_m=0.005)  # -> Model, Info, Mass_kg, CenterOfGravity
# Analysis
analyzethii = AnalyzeThIIKaramba(Model=assemble.Model, LoadCase=-1, RTolerance=1e-07, MaxIterations=50, NoTensionalNII=False)  # -> CalculatedModel, MaximumDisplacement_m, ResultingForceOfGravity_kN, ElasticEnergy_kNm
analyzethi = AnalyzeThIKaramba(Model=assemble.Model)  # -> CalculatedModel, MaximumDisplacement_m, ResultingForceOfGravity_kN, ElasticEnergy_kNm
modelview = ModelViewKaramba(Model=analyzethi.CalculatedModel, LoadCaseFactorsForLinearSuperposition=1, IndexIncrementOfVisibleLoadcase=0)  # -> Model, DeformedMesh, DeformedAxes, DeformedModel
beamview = BeamViewKaramba(Model=modelview.Model)  # -> Model, MeshesOfRenderedBeams, DeformedBeamAxes, LegendColors, LegendTags
mjoin = MeshJoin(Meshes=msphereex)
mjoin_2 = MeshJoin(Meshes=beamview.MeshesOfRenderedBeams)

# ---- group: Convert to mm
multiplication_2 = Multiplication(A=analyzethii.MaximumDisplacement_m, B=Slider(1000, range=0..1000))

# ----
mcol = MeshColours(Mesh=mjoin, Colours=ColourSwatch(SwatchColor=RGB(0, 0, 0)))
entwine = Entwine(Branch00=mjoin_2, Branch01=mcol, FlattenInputs=True)  # -> flatten(Result)
# Metaheuristic
biomorpher = Biomorpher(Genome=[genes, genes_2, genes_3], Geometry=entwine, Performance=multiplication_2)  # -> Clusters, Population, Historic, Clusters_2
