# Grasshopper definition KarambaExample2.gh (Grasshopper 0.9.76)
# plug-ins: Biomorpher, Karamba

panel = Panel("""4
-4""")
panel_2 = Panel("""1
-1""")
genes = GenePool(Decimals=1, Maximum=8, Minimum=0, Value=[2.242779599, 2.622988486])
genes_2 = GenePool(Decimals=1, Maximum=8, Minimum=0, Value=[3.6, 4])
genes_3 = GenePool(Decimals=1, Maximum=8, Minimum=0, Value=[1.381297365, 4.463898821])
pt = ConstructPoint(XCoordinate=0, YCoordinate=0, ZCoordinate=0)
pt_2 = ConstructPoint(XCoordinate=0, YCoordinate=panel_2, ZCoordinate=Slider(4, range=0..10))
pt_3 = ConstructPoint(XCoordinate=Slider(6, range=0..10), YCoordinate=panel, ZCoordinate=0)
pt_4 = ConstructPoint(XCoordinate=genes_3, YCoordinate=genes_2, ZCoordinate=genes)
merge = Merge(Data1=pt, Data2=pt_2, Data3=pt_3, Data4=pt_4)
xz = XZPlane(Origin=Point(0, 0, 0))
mirror = Mirror(Geometry=pt_4, Plane=xz)  # -> Geometry, Transform
ln = Line(StartPoint=pt_4, EndPoint=mirror.Geometry)
Z = UnitZ(Factor="-100")
pt_5 = Point([pt, pt_2])
Z_2 = UnitZ(Factor="-1")
con = DelaunayEdges(Points=merge, Plane=xz)  # -> Connectivity, Edges
mirror_2 = Mirror(Geometry=con.Edges, Plane=xz)  # -> Geometry, Transform
supp = SupportKaramba(PosInd=pt_5, menu=[buttons(on, on, on, on, off, on)])
loads = LoadsKaramba(ForceVector=Z, Local=False, PosInd=pt_3, LCase=0, mode="Point")
msphereex = MeshSphereEx(Base=pt_5, Radius=0.3, Count=2)
line = LineSDL(Start=pt_3, Direction=Z_2, Length=1)
linetobeam = LineToBeamKaramba(Line=flatten([con.Edges, mirror_2.Geometry, ln]), New=True, Remove=True, LimitDistance_m=0.005)  # -> Element, Points, Info
pipe = Pipe(Curve=line, Radius=0.1, Caps=0)  # -> flatten(Pipe)
mjoin = MeshJoin(Meshes=msphereex)
mesh_uv = MeshSurface(Surface=pipe, UCount=5, VCount=5, Overhang=True, Equalize=False)
mcol = MeshColours(Mesh=mjoin, Colours=ColourSwatch(SwatchColor=RGB(0, 64, 255)))
assemble = AssembleModelKaramba(Elem=linetobeam.Element, Support=supp, Load=loads, LimitDistance_m=0.005)  # -> Model, Info, Mass_kg, CenterOfGravity
mcol_2 = MeshColours(Mesh=mesh_uv, Colours=ColourSwatch(SwatchColor=RGB(255, 0, 0)))
analyzethi = AnalyzeThIKaramba(Model=assemble.Model)  # -> CalculatedModel, MaximumDisplacement_m, ResultingForceOfGravity_kN, ElasticEnergy_kNm
modelview = ModelViewKaramba(Model=analyzethi.CalculatedModel, LoadCaseFactorsForLinearSuperposition=1, IndexOfVisibleLoadcase=-1)  # -> Model, DeformedMesh, DeformedAxes, DeformedModel
beamview = BeamViewKaramba(Model=modelview.Model)  # -> Model, MeshesOfRenderedBeams, DeformedBeamAxes, LegendColors, LegendTags
mjoin_2 = MeshJoin(Meshes=beamview.MeshesOfRenderedBeams)
biomorpher = Biomorpher(Genome=[genes_3, genes], MeshEs=[mcol, mjoin_2, mcol_2], Performance=analyzethi.MaximumDisplacement_m)  # -> GenoGuids, Population, Historic, Clusters
