# Grasshopper definition LandscapeTest.gh (Grasshopper 1.0.7)
# plug-ins: Biomorpher

number_slider = Slider(0.862843, range=0..1)
number_slider_2 = Slider(0.763399, range=0..1)
srf = Surface(reparameterize(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))
pt = ConstructPoint(XCoordinate=number_slider_2, YCoordinate=number_slider, ZCoordinate=0)
mesh_uv = MeshSurface(Surface=srf, UCount=15, VCount=15, Overhang=True, Equalize=False)
evalsrf = EvaluateSurface(Surface=srf, Point=pt)  # -> Point, Normal, UDirection, VDirection, Frame
msphereex = MeshSphereEx(Base=evalsrf.Point, Radius=0.1, Count=5)
pdecon = Deconstruct(Point=evalsrf.Point)  # -> XComponent, YComponent, ZComponent
galapagos = Galapagos(fitness=pdecon, gene=[number_slider_2, number_slider])
biomorpher = Biomorpher(Genome=[number_slider_2, number_slider], Meshes=[mesh_uv, msphereex], Perform=pdecon.ZComponent)
