# Grasshopper definition LunchboxExample.gh (Grasshopper 1.0.7)
# plug-ins: Biomorpher, MeshEdit Components, LunchBox, Weaverbird

# Möbius band that is discretised into hexgaonal cells.
# Requires Weaverbird and Lunchbox plug-ins.
number_slider = Slider(1, range=0..5)
number_slider_2 = Slider(8, range=2..10)
number_slider_3 = Slider(93, range=29..100)
mobius = MobiusSurface(
    UDivisions=100,
    VDivisions=100,
    RParameter=4,
    TParameter=number_slider,
    Scale=5,
    Domain1=Domain(-3.141592654, 3.141592654),
    Domain2=Domain(-1, 1))
hex = HexagonCells(Surface=mobius, UDivisions=number_slider_3, VDivisions=number_slider_2, TParameter=0.25)  # -> HexagonCells, Centers
number_slider_4 = Slider(0.5233, range=0..1)
number_slider_5 = Slider(0.1733, range=0..1)
number_slider_6 = Slider(0.9877, range=0..1)
number_slider_7 = Slider(7.5, range=0..10)
wbframe = WeaverbirdsPictureFrame(MeshPolylines=hex.HexagonCells, Distance=5, InsetType=0)
wbthicken = WeaverbirdsMeshThicken(MeshCurves=wbframe, Distance=number_slider_7, OffsetType=0)
frgb = ColourRGBF(Alpha=1, Red=number_slider_4, Green=number_slider_6, Blue=number_slider_5)
mcol = MeshColours(Mesh=wbthicken, Colours=frgb)
argb = SplitARGB(Colour=frgb)  # -> Alpha, Red, Green, Blue
demesh = DeconstructMesh(Mesh=mcol)  # -> Vertices, Faces, Colours, Normals
ma = MassAddition(Input=[argb.Red, argb.Green, argb.Blue])  # -> Result, PartialResults
division = Division(A=ma.Result, B="3")
lng = ListLength(List=demesh.Vertices)
area = MeshArea(Mesh=mcol)  # -> Area, Centroid

# ---- group: Try using an iniial population
num = Number(Tree({0}: [0.4729744911, 0.3088956318, 0.2994010208, 0.1540541608, 0.8977035791, 0.1529138783, 0.1248360281], {1}: [0.3436780601, 0.7891755061, 0.3621062075, 0.006236092656, 0.9116534036, 0.5184979357, 0.416556841], {2}: [0.207301031, 0.1762760566, 0.155733123, 0.629456403, 0.03194887519, 0.1249112711, 0.1931166864], {3}: [0.70505035, 0.5249011435, 0.6211788257, 0.7382715986, 0.6000307219, 0.6431155892, 0.9868990108], {4}: [0.2927757782, 0.8827862278, 0.008460145913, 0.4664106828, 0.7183785279, 0.8144395192, 0.2248932092], {5}: [0.1867518798, 0.7846368303, 0.4218627738, 0.03206568166, 0.8026366815, 0.5050472275, 0.122999745]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))

# ----
biomorpher = Biomorpher(
    Genome=[number_slider_5, number_slider_6, number_slider_4, number_slider, number_slider_2, number_slider_3, number_slider_7],
    MeshEs=mcol,
    Performance=[area.Area, lng])  # -> GenoGuids, Population, Historic, Clusters

# ---- group: Visualise Cluster Distribution
viewer = ParamViewer(biomorpher.Clusters)

# ---- group: Internalise these to store data
num_2 = Number(biomorpher.Historic)
id = Guid(biomorpher.GenoGuids)

# ----
num_3 = Number(biomorpher.Population)

# ---- group: Mask to identify a specific population
panel = Panel("{0;1;?}")

# ---- group: Example GUIDs
id_2 = Guid([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])

# ---- group: Example Population data
num_4 = Number(Tree({0}: [0.1890335497, 0.1242170113, 0.998752759, 0.1961316246, 0.5925103792, 0.3414337247, 0.7279842908], {1}: [0.2826036034, 0.117571215, 0.5675696918, 0.1912455085, 0.5924531562, 0.2334249886, 0.613455895], {2}: [0.4441530317, 0.1156563438, 0.9995708517, 0.1970799147, 0.6918476601, 0.09993579457, 0.5845890403], {3}: [0.9152493746, 0.115467513, 0.9988965683, 0.1959078792, 0.593176374, 0.6374284051, 0.5817666967], {4}: [0.1888914975, 0.1160008995, 0.9993218109, 0.1964554784, 0.5919666984, 0.3408859217, 0.7279703993], {5}: [0.9132539312, 0.8749213374, 0.9998682158, 0.1967917312, 0.6918217971, 0.09944351487, 0.8327774061]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))

# ---- group: Example Historic Data
num_5 = Number(Tree({0;0;0}: [0.55239706, 0.4646391694, 0.2318116977, 0.00657430664, 0.678519524, 0.003749547528, 0.3820717155], {0;0;1}: [0.7928806477, 0.8917642645, 0.8481872696, 0.9107162114, 0.7645069369, 0.4208457439, 0.7912640892], {0;0;2}: [0.1721039192, 0.7559592178, 0.6718950931, 0.8524837181, 0.7387195014, 0.2497752925, 0.6433302707], {0;0;3}: [0.637166546, 0.8397098341, 0.0202827938, 0.1866106313, 0.625952977, 0.7161322612, 0.9297328591], {0;0;4}: [0.5265048265, 0.3884976108, 0.5029038473, 0.9737291066, 0.07493799649, 0.4726874705, 0.9976634844], {0;0;5}: [0.874312194, 0.8983247722, 0.4976757939, 0.183298525, 0.7346817324, 0.1774099237, 0.9750488256]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))

# ----
split = SplitTree(Data=num_5, Masks=flatten(panel))  # -> simplify(Positive), Negative

# ---- group: Biomorpher Reader component
biomorpherreader = BiomorpherReader(GenoGuids=id_2, Population=split.Positive, DesignID=Slider(77, range=0..99))
