# Grasshopper definition LunchboxExample_TEMP.gh (Grasshopper 1.0.7)
# plug-ins: MeshEdit Components, Biomorpher, LunchBox, Weaverbird

# Möbius band that is discretised into hexgaonal cells.
# Requires Weaverbird and Lunchbox plug-ins.
number_slider = Slider(1, range=0..5)
number_slider_2 = Slider(4, range=4..10)
number_slider_3 = Slider(12, range=12..50)
mobius = MobiusSurface(
    UDivisions=100,
    VDivisions=100,
    RParameter=4,
    TParameter=number_slider,
    Scale=5,
    Domain1=Domain(-3.141592654, 3.141592654),
    Domain2=Domain(-1, 1))
hex = HexagonCells(Surface=mobius, UDivisions=number_slider_3, VDivisions=number_slider_2, TParameter=0.25)  # -> HexagonCells, Centers
number_slider_4 = Slider(0.5004, range=0.5..1)
number_slider_5 = Slider(0.5001, range=0.5..1)
number_slider_6 = Slider(0.5001, range=0.5..1)
number_slider_7 = Slider(0, range=0..10)
wbframe = WeaverbirdsPictureFrame(MeshPolylines=hex.HexagonCells, Distance=5, InsetType=0)
wbthicken = WeaverbirdsMeshThicken(MeshCurves=wbframe, Distance=number_slider_7, OffsetType=0)
frgb = ColourRGBF(Alpha=1, Red=number_slider_4, Green=number_slider_6, Blue=number_slider_5)
mcol = MeshColours(Mesh=wbthicken, Colours=frgb)
demesh = DeconstructMesh(Mesh=mcol)  # -> Vertices, Faces, Colours, Normals
lng = ListLength(List=demesh.Vertices)
area = MeshArea(Mesh=mcol)  # -> Area, Centroid
ma = MassAddition(Input=[number_slider_4, number_slider_6, number_slider_5])  # -> Lightness, PartialResults
biomorpher = Biomorpher(
    Genome=[number_slider_3, number_slider_2, number_slider_4, number_slider_6, number_slider_5, number_slider_7],
    Meshes=mcol,
    Perform=[lng, area.Area, ma.Lightness])
