# Grasshopper definition QuadtreeExtrusions.gh (Grasshopper 1.0.7)
# plug-ins: Biomorpher, MeshEdit Components

genes = GenePool(
    Decimals=2,
    Maximum=100,
    Minimum=0,
    Value=[91.50062934, 58.42532416, 19.96422928, 78.37907266, 22.11080972, 9.831629884, 36.17479817, 27.85912753, 57.93215649, 83.19041058, 33.69834741, 7.727717286, 67.95115493, 29.89048866, 48.9786641, 61.84875828, 1.265413641, 30.65631391, 7.702525522, 69.36573562])
genes_2 = GenePool(
    Decimals=2,
    Maximum=50,
    Minimum=0,
    Value=[12.22118126, 44.22499432, 38.67505677, 40.05518863, 4.892841659, 45.72146316, 6.503332223, 45.56239818, 11.40994938, 42.89474112, 29.08703258, 36.66254102, 42.83948196, 10.39756907, 8.024381687, 37.24431793, 33.36314421, 17.31305307, 0.04417565653, 40.28106872])
# In this example, genepools are used to
# create planar curves that are then extruded.
# Double click on the biomorpher component to begin.
genes_3 = GenePool(
    Decimals=2,
    Maximum=100,
    Minimum=0,
    Value=[32.91396002, 86.6905177, 13.0051788, 22.19916104, 90.39376732, 82.38573483, 89.03380101, 19.88218018, 80.08722592, 14.10057545, 42.84747608, 65.18282595, 1.148578432, 53.55122008, 59.72196844, 13.49974927, 16.88605264, 70.06699828, 28.43309121, 61.7374894])
pt = ConstructPoint(XCoordinate=genes_3, YCoordinate=genes, ZCoordinate=0)
qt = QuadTree(Points=pt, Plane=PlaneXY(0, 0, 0), Square=False, Group=Slider(1, range=0..10))  # -> Quads, Points
runion = RegionUnion(Curves=qt.Quads)
fillet = Fillet(Curve=runion, Radius=Slider(2.5, range=0..10))
lng = ListLength(List=fillet)
split = SplitList(List=genes_2, Index=lng)  # -> ListA, ListB
Z = UnitZ(Factor=split.ListA)
extr = Extrude(Base=fillet, Direction=Z)
cap = CapHoles(Brep=extr)
smooth = SettingsQuality()
mesh = MeshBrep(Brep=cap, Settings=smooth)
lng_2 = ListLength(List=mesh)
random = Random(Range=Domain(0, 1), Number=lng_2, Seed=2)
random_2 = Random(Range=Domain(0, 1), Number=lng_2, Seed=3)
random_3 = Random(Range=Domain(0, 1), Number=lng_2, Seed=4)
frgb = ColourRGBF(Alpha=1, Red=random, Green=random_2, Blue=random_3)
mcol = MeshColours(Mesh=graft(mesh), Colours=graft(frgb))
preview = CustomPreview(Geometry=cap, Shader=frgb)
demesh = DeconstructMesh(Mesh=mcol)  # -> flatten(Vertices), Faces, Colours, Normals
area = MeshArea(Mesh=mcol)  # -> flatten(Area), Centroid
volume = Volume(Geometry=mcol)  # -> flatten(Volume), Centroid
floor_to_floor = Slider(3, range=0..10)
pdecon = Deconstruct(Point=demesh.Vertices)  # -> XComponent, YComponent, ZComponent
ma = MassAddition(Input=area.Area)  # -> Result, PartialResults
ma_2 = MassAddition(Input=volume.Volume)  # -> Result, PartialResults
sort = SortList(Keys=pdecon.ZComponent)  # -> reverse(Keys), ValuesA
division = Division(A=ma_2.Result, B=floor_to_floor)
division_2 = Division(A=ma.Result, B=ma_2.Result)
item = ListItem(List=sort.Keys, Index=0, Wrap=True)
peakheight_m = Number(item)

# ---- group: Try an initial population
num = Number(Tree({0}: [0.1318837181, 0.1220438495, 0.4482882276, 0.6958550581, 0.6418843296, 0.2590407195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], {1}: [0.4151497532, 0.434424605, 0.2929050086, 0.1997524966, 0.6112884593, 0.7778038959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], {2}: [0.09769629319, 0.7615103762, 0.6158182158, 0.6702732177, 0.2074497227, 0.5578652795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], {3}: [0.9713377855, 0.5266667025, 0.6600308426, 0.801374711, 0.7045073568, 0.1616930487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], {4}: [0.9434405453, 0.29806923, 0.5641738361, 0.4279576984, 0.5799704094, 0.4454123468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], {5}: [0.09924853924, 0.6915303528, 0.7202166443, 0.391575779, 0.8111520404, 0.8143718149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]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))

# ----
biomorpher = Biomorpher(Genome=[genes_3, genes, genes_2], MeshEs=mcol, Performance=[division, division_2, peakheight_m])  # -> GenoGuids, Population, Historic, Clusters
