# Grasshopper definition Simple - Möbius Band (Lunchbox).gh (Grasshopper 1.0.7)
# plug-ins: MeshEdit Components, Biomorpher, LunchBox, Weaverbird

# A Möbius band discretised into cells.
# Requires Weaverbird and Lunchbox plug-ins.
number_slider = Slider(3, range=0..3)
number_slider_2 = Slider(9, range=4..10)
number_slider_3 = Slider(14, range=12..50)
mobius = MobiusSurface(
    UDivisions=100,
    VDivisions=100,
    RParameter=4,
    TParameter=number_slider,
    Scale=5,
    Domain1=Domain(-3.141592654, 3.141592654),
    Domain2=Domain(-1, 1))
mesh_uv = MeshSurface(Surface=mobius, UCount=number_slider_3, VCount=number_slider_2, Overhang=True, Equalize=False)
number_slider_4 = Slider(0.8051, range=0..1)
number_slider_5 = Slider(0.7351, range=0..1)
number_slider_6 = Slider(0.1751, range=0..1)
number_slider_7 = Slider(2.6, range=0..10)
wbframe = WeaverbirdsPictureFrame(MeshPolylines=mesh_uv, Distance=5, InsetType=0)
wbthicken = WeaverbirdsMeshThicken(MeshCurves=wbframe, Distance=number_slider_7, OffsetType=0)
frgb = ColourRGBF(Alpha=1, Red=number_slider_4, Green=number_slider_6, Blue=number_slider_5)
mcol = MeshColours(Mesh=wbthicken, Colours=frgb)
demesh = DeconstructMesh(Mesh=mcol)  # -> Vertices, Faces, Colours, Normals
lng = ListLength(List=demesh.Vertices)
ma = MassAddition(Input=[number_slider_4, number_slider_6, number_slider_5])  # -> Lightness, PartialResults
area = MeshArea(Mesh=mcol)  # -> Area, Centroid
biomorpher = Biomorpher(
    Genome=[number_slider, number_slider_5, number_slider_6, number_slider_4, number_slider_7, number_slider_2, number_slider_3],
    Geometry=mcol,
    Performs=[area.Area, lng, ma.Lightness])
