# Grasshopper definition Simple - Untangle.gh (Grasshopper 1.0.7)
# plug-ins: Biomorpher

# A simple thread that can evolved.
# Try untangling it, or creating a curve that has interest.
# Double click on the biomorpher component to begin.
genes = GenePool(
    Decimals=2,
    Maximum=100,
    Minimum=-100,
    Value=[-74.67604283, -31.84434319, 48.02768476, -46.12468914, -46.95070755, 82.1235455, -32.99986007, -95.88310457, -63.69026801, -89.69886621])
genes_2 = GenePool(
    Decimals=2,
    Maximum=100,
    Minimum=-100,
    Value=[18.03748348, 40.55614858, 48.98938632, -38.62098168, -74.60487125, -93.27037306, 54.06408234, 60.08650413, 95.94342832, 10.36189694])
genes_3 = GenePool(
    Decimals=2,
    Maximum=100,
    Minimum=0,
    Value=[37.70081606, 77.60267613, 97.39456491, 90.84737767, 93.56048476, 58.2539041, 14.06462423, 17.22258156, 83.16449279, 65.72493327])
pt = ConstructPoint(XCoordinate=genes, YCoordinate=genes_2, ZCoordinate=genes_3)
intcrv = Interpolate(Vertices=pt, Degree=3, Periodic=True, KnotStyle=1)  # -> Curve, Length, Domain
divide = DivideCurve(Curve=intcrv.Curve, Count=Slider(100, range=0..100), Kinks=False)  # -> Points, Tangents, Parameters
curvature = Curvature(Curve=intcrv.Curve, Parameter=divide.Parameters)  # -> P, K, C
vdisex = VectorDisplayEx(Point=curvature.P, Vector=expr("x*100", curvature.K), Colour=RGB(0, 0, 0), Width=2)

# ---- group: Variance of curvature
vlen = VectorLength(Vector=curvature.K)

# ----
variance = Variance(num=vlen)
multiplication = Multiplication(A=variance, B=Slider(1000, range=0..1000))
biomorpher = Biomorpher(Genome=[genes, genes_2, genes_3], Geometry=intcrv.Curve, Performs=[intcrv.Length, multiplication])

# ==== cluster Variance: Variance
num = ClusterInput()
num_2 = Number(num)
avr = Average(Input=num_2)
subtraction = Subtraction(A=avr, B=num_2)
lng = ListLength(List=num_2)
sqr = Square(Value=subtraction)
ma = MassAddition(Input=sqr)  # -> Result, PartialResults
division = Division(A=ma.Result, B=lng)
R = ClusterOutput(division)
