# Grasshopper definition Superformula.gh (Grasshopper 0.9.76)
# plug-ins: Biomorpher, Mesh Pipe

b = Slider(0.55, range=0..1)

# ---- group: c
number_slider = Slider(0.24, range=0..1)

# ---- group: d
b_2 = Slider(0.73, range=0..1)

# ---- group: a
# https://en.wikipedia.org/wiki/Superformula
# Double click on the biomorpher component to begin.
# Needs meshpipe component.
number_slider_2 = Slider(0.46, range=0..1)

# ----
cluster = Cluster(A=number_slider_2, A_3=b, A_4=number_slider, A_2=b_2)
intcrv = Interpolate(Vertices=cluster, Degree=3, Periodic=True, KnotStyle=1)  # -> Curve, Length, Domain
mpipe = MeshPipe(Curve=intcrv.Curve, Radius=Slider(0.03, range=0..0.1), Accuracy=0.2, Rotation=0, Segments=10, Caps=2)
mcol = MeshColours(Mesh=mpipe, Colours=ColourSwatch(SwatchColor=RGB(0, 0, 0)))
biomorpher = Biomorpher(Genome=[b_2, number_slider, b, number_slider_2], Geometry=mcol, Performance=intcrv.Length)  # -> Clusters, Population, Historic, Clusters_2

# ==== cluster Cluster
number_slider = Slider(300, range=0..1000)
pi = Pi(Factor=Slider(2, range=0..10))
division = Division(A=pi, B=number_slider)
A = ClusterInput()
series = Series(Start=0, Step=division, Count=number_slider)
A_2 = ClusterInput()
A_3 = ClusterInput()
A_4 = ClusterInput()
multiplication = Multiplication(A=A, B="6")
multiplication_2 = Multiplication(A=A_2, B="6")
multiplication_3 = Multiplication(A=A_3, B="6")
multiplication_4 = Multiplication(A=A_4, B="6")
multiplication_5 = Multiplication(A=series, B=multiplication)
j = Slider(3, range=0..10)
multiplication_6 = Multiplication(A=series, B=multiplication_4)

# ---- group: k
j_2 = Slider(3, range=0..10)

# ----
multiplication_7 = Multiplication(A=series, B=multiplication_3)
multiplication_8 = Multiplication(A=series, B=multiplication_2)
sin = Sine(Value=multiplication_6)
cos = Cosine(Value=multiplication_7)
sin_2 = Sine(Value=multiplication_8)
cos_2 = Cosine(Value=multiplication_5)
cos_3 = Cosine(Value=multiplication_6)
pow = Power(A=cos, B=j)
pow_2 = Power(A=sin_2, B=j_2)
subtraction = Subtraction(A=sin, B=pow_2)
subtraction_2 = Subtraction(A=cos_2, B=pow)
pt = ConstructPoint(XCoordinate=subtraction_2, YCoordinate=subtraction, ZCoordinate=0)
pt_2 = ClusterOutput(pt)
