# Grasshopper definition TreeGrowth.gh (Grasshopper 1.0.7)

number_slider = Slider(10, range=0..10)
number_slider_2 = Slider(0, range=0..100)
c_script = CSharpScript(angShift=Slider(0.312, range=0..1), iterations=Slider(167, range=0..1000), bf=Slider(29, range=0..100))  # -> out, A; inputs angShift: Double, iterations: Int32, bf: Int32
# ---------- c_script: C# ----------
    List<Boid> boids = new List<Boid>();
    List<Circle> circles = new List<Circle>();

    int branchFrequency = bf;
    int lifeSpan = 60;

    int treeAge = 0;
    int treeLife = 1250;
    double radius = 0.5;

    boids.Add(new Boid(0.0, 0.0, Math.PI / 2, 0.5, lifeSpan));


    for (int n = 0; n < iterations; n++)
    {
      for (int i = 0; i < boids.Count; i++)
      {
        boids[i].UpdateAV();
      }

      for (int i = 0; i < boids.Count; i++)
      {
        boids[i].UpdatePos();

        circles.Add(new Circle(boids[i].pos, radius));

        boids[i].Draw(treeAge, treeLife, boids, branchFrequency, angShift);
      }

      //remove the dead
      for (int i = boids.Count - 1; i >= 0; i--)
      {
        if(!boids[i].isAlive())
        {
          boids.RemoveAt(i);
        }
      }

      treeAge++;
    }


    A = circles;
# ---------- c_script: C# additional code ----------
  class Boid {

    public double age;
    public int lifespan;
    public double ang;
    public bool alive;
    public Point3d pos;
    public Point3d vel;
    public Point3d acc;

    Random rand;

    // Standard constructor
    public Boid(double x, double y, double angle, double speed, int lifeSpan)
    {
      ang = angle;
      age = 0;
      lifespan = lifeSpan;
      alive = true;
      //float angle = random(TWO_PI);
      pos = new Point3d(x, y, 0.0);
      vel = new Point3d(speed * Math.Cos(ang), speed * Math.Sin(ang), 0.0);
      acc = new Point3d(0.0, 0.0, 0.0);
    }

    public void UpdateAV()
    {
      vel += acc;
    }

    public void UpdatePos()
    {
      pos += vel;
    }

    public bool isAlive()
    {
      return alive;
    }

    public void Draw(int treeLife, int treeAge, List<Boid> boids, int branchFrequency, double angShift)
    {
      age++;
      if(age > lifespan) alive = false;

      if(age % branchFrequency == 0 )
      {
        boids.Add(new Boid(pos.X, pos.Y, ang + angShift, 0.5, lifespan));
      }
    }
  }
# ---------- end c_script ----------
