# Grasshopper definition Turtle.gh (Grasshopper 0.9.76)
# plug-ins: Biomorpher

genes = GenePool(
    Decimals=0,
    Maximum=3,
    Minimum=0,
    Value=[2.050626095, 1.727857175, 1.681449451, 2.529249622, 1.961913787, 0.3852366935, 0.4623695326, 1.968191861, 0.1117150069, 2.826000192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])
genes_2 = GenePool(
    Decimals=0,
    Maximum=3,
    Minimum=0,
    Value=[0.2023100784, 1.365334239, 1.034010209, 1.204006653, 0.06412541217, 0.4640115371, 2.743011535, 1.141608018, 0.2030323694, 0.2307813471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])
genes_3 = GenePool(
    Decimals=0,
    Maximum=3,
    Minimum=0,
    Value=[1.974186467, 2.093340752, 0.8526259261, 0.3575607669, 0.8489333269, 1.74221883, 1.069222108, 0.06655547788, 1.498177082, 0.7250286782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])
entwine = Entwine(Branch00=genes_3, Branch01=genes, Branch02=genes_2, FlattenInputs=True)
c_script = CSharpScript(x=Slider(0, range=0..10), y=Slider(0, range=0..10), z=entwine)  # -> out, A; inputs x: Int32, y: Int32, z: list of Int32
# ---------- c_script: C# ----------
    List<Point3d> pts = new List<Point3d>();

    int currentX = x;
    int currentY = y;

    pts.Add(new Point3d(currentX, currentY, 0));

    for(int i = 0; i < z.Count; i++)
    {
      switch(z[i])
      {
        case 0:
          currentX++;
          break;
        case 1:
          currentY++;
          break;
        case 2:
          currentX--;
          break;
        case 3:
          currentY--;
          break;
      }

      pts.Add(new Point3d(currentX, currentY, 0));
    }


    Polyline myPoly = new Polyline(pts);
    A = myPoly;
# ---------- end c_script ----------
fillet = Fillet(Curve=flatten(c_script.A), Radius=Slider(0.3, range=0..1))
Z = UnitZ(Factor="0.5")
extr = Extrude(Base=fillet, Direction=Z)
len = Length(Curve=fillet)
panel = Panel("""magenta
orange
grey""")
mesh = Mesh(extr)
ma = MassAddition(Input=len)  # -> TotalLength, PartialResults
mcol = MeshColours(Mesh=graft(mesh), Colours=graft(panel))
area = Area(Geometry=extr)  # -> Area, Centroid
biomorpher = Biomorpher(Genome=[genes_3, genes], Geometry=mcol, Performance=ma.TotalLength)  # -> GenoGuids, Population, Historic, Clusters
