# Grasshopper definition UntangleThread (Reader).gh (Grasshopper 1.0.7)
# plug-ins: Biomorpher

genes = GenePool(
    Decimals=2,
    Maximum=100,
    Minimum=-100,
    Value=[-11.78893303, 33.33637851, -31.3311719, -16.20942369, 31.47185861, 82.47188655, 61.994242, 94.83007164, 1.191655314, -14.15356198])
genes_2 = GenePool(
    Decimals=2,
    Maximum=100,
    Minimum=-100,
    Value=[-86.71271828, 36.25720364, -70.05453676, 83.91201765, 28.97086606, -3.270200036, -21.89715743, 43.4253073, -99.04932966, 4.969654747])
genes_3 = GenePool(
    Decimals=2,
    Maximum=100,
    Minimum=0,
    Value=[3.644200416, 91.76448052, 50.97445434, 55.7100748, 23.44076057, 99.91345252, 90.73956329, 57.35284856, 2.918248765, 51.99322857])
# The reader component can show designs from a historic evolutionary process using Biomorpher.
# In this example the length of the curve was minimised. Try moving the generation and design sliders.
number_slider = Slider(0, range=0..72)

# ---- group: Historic biomorpher solution (internalised)
biomorphersolution = BiomorpherSolution({popCount=64, Count=4672, Count=30, Path="{0;0;0}", number=0.3379797448, number=0.9408756587, number=0.495467704, number=0.1032962599, number=0.6882601803, number=0.212323675, number=0.2393789884, number=0.2270496247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})

# ----
biomorpherreader = BiomorpherReader(Solution=biomorphersolution, Branch="0", Generation=number_slider, Design=Slider(36, range=0..63))
pt = ConstructPoint(XCoordinate=genes, YCoordinate=genes_2, ZCoordinate=genes_3)
intcrv = Interpolate(Vertices=pt, Degree=3, Periodic=True, KnotStyle=1)  # -> Curve, Length, Domain
divide = DivideCurve(Curve=intcrv.Curve, Count=Slider(100, range=0..100), Kinks=False)  # -> Points, Tangents, Parameters
curvature = Curvature(Curve=intcrv.Curve, Parameter=divide.Parameters)  # -> P, K, C
unit = UnitVector(Vector=curvature.K)
vdisex = VectorDisplayEx(Point=curvature.P, Vector=expr("x*100", curvature.K), Colour=RGB(0, 0, 0), Width=2)

# ---- group: Variance of curvature
vlen = VectorLength(Vector=curvature.K)
cluster = Cluster(num=vlen)

# ----
line = LineSDL(Start=curvature.P, Direction=unit, Length=Slider(6, range=0..10))
loft = Loft(Curves=line, Options={Adjust=False, Closed=True, LoftEnds=0, LoftSimp=0, LoftType=0, Rebuild=10, Refit=0.01})
multiplication = Multiplication(A=cluster, B=Slider(1000, range=0..1000))
preview = CustomPreview(
    Geometry=loft,
    Shader={diffuse=RGB(255, 105, 180), emission=RGB(76, 32, 54), shine=0.5, specular=RGB(255, 255, 255), transparency=0})
mesh_uv = MeshSurface(Surface=loft, UCount=200, VCount=5, Overhang=True, Equalize=False)

# ==== cluster Cluster
num = ClusterInput()
num_2 = Number(num)
avr = Average(Input=num_2)
subtraction = Subtraction(A=avr, B=num_2)
lng = ListLength(List=num_2)
sqr = Square(Value=subtraction)
ma = MassAddition(Input=sqr)  # -> Result, PartialResults
division = Division(A=ma.Result, B=lng)
R = ClusterOutput(division)
