# Grasshopper definition Vases.gh (Grasshopper 1.0.7)
# plug-ins: Biomorpher

genes = GenePool(
    Decimals=2,
    Maximum=2,
    Minimum=0,
    Value=[0.2264018575, 0.2776375897, 0.4124039754, 1.033445663, 1.546941832, 0.9974917987])
pt = ConstructPoint(XCoordinate=0, YCoordinate=0, ZCoordinate=0)
Z = UnitZ(Factor=1)
line = LineSDL(Start=pt, Direction=Z, Length="10")
number_slider = Slider(8, range=3..20)
pframes = PerpFrames(Curve=line, Count=Slider(6, range=0..10), Align=True)  # -> Frames, Parameters
polygon = Polygon(Plane=pframes.Frames, Radius=genes, Segments=number_slider, FilletRadius=0)  # -> Polygon, Length
loft = Loft(Curves=polygon.Polygon, Options={Adjust=False, Closed=False, LoftEnds=0, LoftSimp=0, LoftType=0, Rebuild=10, Refit=0.01})
debrep = DeconstructBrep(Brep=loft)  # -> Faces, Edges, Vertices
area = Area(Geometry=loft)  # -> Area, Centroid
area_2 = Area(Geometry=loft)  # -> Area, Centroid
mesh_uv = MeshSurface(Surface=debrep.Faces, UCount="20", VCount="4", Overhang=True, Equalize=False)
biomorpher = Biomorpher(Genome=[genes, number_slider], Geometry=mesh_uv, Performs=area.Area)
