# Grasshopper definition WeaverbirdExample.gh (Grasshopper 1.0.7)
# plug-ins: MeshEdit Components, Biomorpher, Weaverbird

number_slider = Slider(6, range=4..10)
# Möbius band that is discretised into hexgaonal cells.
# Requires Weaverbird and Lunchbox plug-ins.
number_slider_2 = Slider(30, range=12..50)
srf = Surface(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)
mesh_uv = MeshSurface(Surface=srf, UCount=number_slider_2, VCount=number_slider, Overhang=True, Equalize=False)
number_slider_3 = Slider(0.5295, range=0.5..1)
number_slider_4 = Slider(0.544, range=0.5..1)
number_slider_5 = Slider(0.9932, range=0.5..1)
number_slider_6 = Slider(1.3, range=0..10)
wbframe = WeaverbirdsPictureFrame(MeshPolylines=mesh_uv, Distance=5, InsetType=0)
wbthicken = WeaverbirdsMeshThicken(MeshCurves=wbframe, Distance=number_slider_6, OffsetType=0)
frgb = ColourRGBF(Alpha=1, Red=number_slider_3, Green=number_slider_5, Blue=number_slider_4)
mcol = MeshColours(Mesh=wbthicken, Colours=frgb)
demesh = DeconstructMesh(Mesh=mcol)  # -> Vertices, Faces, Colours, Normals
lng = ListLength(List=demesh.Vertices)
area = MeshArea(Mesh=mcol)  # -> Area, Centroid
ma = MassAddition(Input=[number_slider_3, number_slider_5, number_slider_4])  # -> Lightness, PartialResults
biomorpher = Biomorpher(
    Genome=[number_slider_2, number_slider, number_slider_3, number_slider_5, number_slider_4, number_slider_6],
    Meshes=mcol,
    Perform=[lng, area.Area, ma.Lightness])
