# Grasshopper definition WordGenerator.gh (Grasshopper 1.0.7)
# plug-ins: Squid, Biomorpher, Mesh Pipe

genes = GenePool(Decimals=0, Maximum=24, Minimum=1, Value=[9.147510223, 23.9654064, 22.70773063, 13.10634467, 16.190456, 12.5])
c_script = CSharpScript(x=genes)  # -> A; inputs x: Int32
# ---------- c_script: C# ----------
    switch (x){
      case 1: A = "a"; break;
      case 2: A = "b"; break;
      case 3: A = "c"; break;
      case 4: A = "d"; break;
      case 5: A = "e"; break;
      case 6: A = "f"; break;
      case 7: A = "g"; break;
      case 8: A = "h"; break;
      case 9: A = "i"; break;
      case 10: A = "j"; break;
      case 11: A = "k"; break;
      case 12: A = "l"; break;
      case 13: A = "m"; break;
      case 14: A = "n"; break;
      case 15: A = "o"; break;
      case 16: A = "p"; break;
      case 17: A = "q"; break;
      case 18: A = "r"; break;
      case 19: A = "s"; break;
      case 20: A = "t"; break;
      case 21: A = "u"; break;
      case 22: A = "v"; break;
      case 23: A = "w"; break;
      case 24: A = "x"; break;
      case 25: A = "y"; break;
      case 26: A = "z"; break;
    }
# ---------- end c_script ----------
item = ListItem(List=c_script, Index=0, Wrap=True)  # -> Item, Item1, Item2, Item3, Item4, Item5
concat = Concatenate(
    FragmentA=item.Item,
    FragmentB=item.Item1,
    FragmentC=item.Item2,
    FragmentD=item.Item3,
    FragmentE=item.Item4,
    FragmentF=item.Item5)
textc = TextCurves(Plane=PlaneXY(0, 0, 0), Text=concat)
mpipe = MeshPipe(Curve=textc, Radius=0.4, Accuracy=0.2, Rotation=0, Segments=4, Caps=2)
biomorpher = Biomorpher(Genome=genes, Meshes=mpipe)
