# Grasshopper definition spiderweb.gh (Grasshopper 0.9.76)
# plug-ins: Biomorpher, SpiderWeb :: Graph Tools, Mesh Pipe

genes = GenePool(
    Decimals=2,
    Maximum=10,
    Minimum=0,
    Value=[7.6320216, 2.441460193, 2.973418009, 1.512690434, 6.785239706, 7.067700749, 7.816556407, 2.332856866, 2.793586665, 2.27098527])
genes_2 = GenePool(
    Decimals=2,
    Maximum=10,
    Minimum=0,
    Value=[1.636004006, 2.4252122, 6.460698539, 9.996067495, 9.122050386, 8.840801818, 5.809504448, 1.518665874, 5.327443693, 4.710877125])
number_slider = Slider(5.7, range=0..10)
number_slider_2 = Slider(5, range=0..10)
pt = ConstructPoint(XCoordinate=number_slider_2, YCoordinate=number_slider, ZCoordinate=0)
pt_2 = ConstructPoint(XCoordinate=genes_2, YCoordinate=genes, ZCoordinate=0)
cir = Circle(Plane=pt, Radius=0.5)
gfp = GraphFromPoints(GraphPoints=pt_2, ConnectingDistance=Slider(3.85, range=0..10))
gs = GraphStyle(Color=RGB(255, 20, 147), TxtSize=1, Update=True)
dg = DisplayGraph(Graph=gfp, GraphPoints=pt_2, GraphStyle=gs, hidden=True)  # -> VertexCount, EdgeCount, Edge
gm = GraphMatrix(Graph=gfp, Parameter=1)
esys = Eigensystem(GraphMatrix=gm, degenerated=False, zero=False)  # -> EigenValues, EigenVectors, KDimension
line = Line(dg.Edge)
mpipe = MeshPipe(Curve=[line, cir], Radius=Slider(0.09, range=0..1), Accuracy=0.2, Rotation=0, Segments=10, Caps=2)
len = Length(Curve=line)
mcol = MeshColours(Mesh=mpipe, Colours="magenta")
ma = MassAddition(Input=len)  # -> TotalLength, PartialResults
biomorpher = Biomorpher(
    Genome=[number_slider, number_slider_2, genes_2, genes],
    Geometry=mcol,
    Performance=[ma.TotalLength, dg.VertexCount, dg.EdgeCount])
