# Grasshopper definition spiderweb_adjacencygraph.gh (Grasshopper 0.9.76)
# plug-ins: Biomorpher, SpiderWeb :: Graph Tools, Mesh Pipe

genes = GenePool(Decimals=0, Maximum=3, Minimum=0, Value=[0.2025368163, 1.82404173, 2.199244322, 1.721277547, 1.220809496])
genes_2 = GenePool(Decimals=0, Maximum=3, Minimum=0, Value=[0.8951218376, 1.493095457, 1.202794215, 1.581440586, 2.26929504])
genes_3 = GenePool(Decimals=0, Maximum=3, Minimum=0, Value=[0.5877540536, 1.985140766, 0.6870087375, 2.451045124, 2.29433352])
genes_4 = GenePool(Decimals=0, Maximum=3, Minimum=0, Value=[0.6986057385, 1.669771444, 2.917151127, 1.851757262, 2.000197565])
genes_5 = GenePool(Decimals=0, Maximum=3, Minimum=0, Value=[1.066458074, 0.7331944651, 0.3108869994, 1.229223954, 0.0625401106])
entwine = Entwine(Branch00=genes, Branch01=genes_2, Branch02=genes_3, Branch03=genes_4, Branch04=genes_5, FlattenInputs=True)
polygon = Polygon(Plane=PlaneXY(0, 0, 0), Radius=3, Segments=Slider(5, range=0..10), FilletRadius=0)  # -> Polygon, Length
disc = Discontinuity(Curve=polygon.Polygon, Level=1)  # -> Points, Parameters
dtg = DataTreeToGraph(DataTree=simplify(entwine), methode=1)
dg = DisplayGraph(Graph=dtg, GraphPoints=disc.Points, hidden=True)  # -> VertexCount, EdgeCount, Edge
len = Length(Curve=dg.Edge)
larger = LargerThan(FirstNumber=len, SecondNumber="0")  # -> LargerThan, OrEqualTo
dispatch = Dispatch(List=dg.Edge, DispatchPattern=larger.LargerThan)  # -> ListA, ListB
len_2 = Length(Curve=dispatch.ListA)
mpipe = MeshPipe(Curve=dispatch.ListA, Radius=Slider(0.16, range=0..1), Accuracy=0.2, Rotation=0, Segments=10, Caps=2)
ma = MassAddition(Input=len_2)  # -> Result, PartialResults
biomorpher = Biomorpher(Genome=[genes, genes_2, genes_3, genes_4, genes_5], Geometry=mpipe, Performance=ma.Result)  # -> Clusters, History
