# Grasshopper definition tempMesh.gh (Grasshopper 0.9.76)
# plug-ins: Biomorpher, Weaverbird

number_slider = Slider(7, range=2..10)
msphereex = MeshSphereEx(Base=PlaneXY(0, 0, 0), Radius=number_slider, Count=Slider(4, range=0..10))
tri = Triangulate(Mesh=msphereex)  # -> Mesh, Count
wbjoin = WeaverbirdsJoinMeshesAndWeld(Mesh=tri.Mesh, Weld=True)
demesh = DeconstructMesh(Mesh=wbjoin)  # -> Vertices, Faces, Colours, Normals
pdecon = Deconstruct(Point=demesh.Vertices)  # -> XComponent, YComponent, ZComponent
normalise = Normalise(num=pdecon.ZComponent)
normalise_2 = Normalise(num=pdecon.XComponent)
mcol = MeshColours(Mesh=wbjoin, Colours="blue")
frgb = ColourRGBF(Alpha=1, Red=normalise, Green=0, Blue=0)
biomorpher = Biomorpher(Genome=number_slider, Geometry=mcol)

# ==== cluster Normalise: Normalises a list of data (range 0 to 1)
num = ClusterInput()

num_2 = Number(num)
bnd = Bounds(Numbers=num_2)
dedomain = DeconstructDomain(Domain=bnd)  # -> Start, End
subtraction = Subtraction(A=dedomain.End, B=dedomain.Start)
subtraction_2 = Subtraction(A=num_2, B=dedomain.Start)
division = Division(A=subtraction_2, B=subtraction)

R = ClusterOutput(division)
