# Grasshopper definition towerHamlets.gh (Grasshopper 0.9.76)
# plug-ins: Biomorpher, Fröbel, HDTReference, Mesh Pipe, embryoA

# Component pool
block1 = Block1(InTrans=0)  # -> OutBox, OutPlane1, OutPlane2
block2 = Block2(InTrans=1, InHeight=1)  # -> OutBox, OutPlane1, OutPlane2, OutPlane3, OutPoint1
block2_2 = Block2(InTrans=1, InHeight=1)  # -> OutBox, OutPlane1, OutPlane2, OutPlane3, OutPoint1
link2 = Link2()
g_slider5 = Slider(2.112, range=-5..5)
g_slider4 = Slider(3.018, range=-5..5)
g_slider3 = Slider(1.236, range=-5..5)
g_slider2 = Slider(3.246, range=-5..5)
g_slider1 = Slider(2.856, range=-5..5)
# DAG Phenotype
g_slider0 = Slider(2.358, range=-5..5)
genes = GenePool(
    Decimals=3,
    Maximum=1,
    Minimum=0,
    Value=[0.3932345606, 0.4764445287, 0.5406329137, 0.2061850834, 0.5029875438, 0.3519744781, 0.1387570335, 0.758812762, 0.1090411578, 0.02132941225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])
pt = ConstructPoint(XCoordinate=Slider(54.9, range=0..1000), YCoordinate=50, ZCoordinate=0)
xz = XZPlane(Origin=Point(0, 0, 0))
xz_2 = XZPlane(Origin=pt)
# Generate DAG Phenotype
number_slider = Slider(6, range=0..10)
parent_output = ParentOutput(O=[xz, xz_2])

# ----
# (Embryo)
# (de-normalise parameters)
num = Number(genes)
subset = SubList(List=num, Domain=Domain(0, 5), Wrap=True)  # -> List, Index
subset_2 = SubList(List=num, Domain=Domain(6, 21), Wrap=True)  # -> List, Index
subset_3 = SubList(List=num, Domain=Domain(22, 37), Wrap=True)  # -> List, Index
multiplication = Multiplication(A=subset.List, B="6")
multiplication_2 = Multiplication(A=subset_2.List, B="32")
multiplication_3 = Multiplication(A=subset_3.List, B="7")
int = Integer(number_slider)
int_2 = Integer(Slider(16, range=0..100))
embryo = EmbryoSettings(
    Preview=Toggle(False),
    SliderDomain=Domain(-5, 5),
    OneToOne=True,
    GridX=120,
    GridY=120,
    RemoveDead=Toggle(False),
    OnlyTerminals=False)
embryo_2 = Embryo(
    Reset=Toggle(True),
    Sliders=int,
    Components=int_2,
    MetricGenes=multiplication,
    TopologyGenes=multiplication_2,
    FunctionGenes=multiplication_3,
    Settings=embryo,
    RandomOveride=0)  # -> Iterations, Components

g_block2 = Block2(InPlane=xz_2, InLength=1, AddStoreys=1)  # -> OutBox, OutPlane1, OutPlane2, OutPlane3, OutPoint1
g_block2_2 = Block2(InPlane=xz, InLength=g_slider0, AddStoreys=g_slider4)  # -> OutBox, OutPlane1, OutPlane2, OutPlane3, OutPoint1
g_block2_3 = Block2(InPlane=g_block2_2.OutPlane3, InLength=1, AddStoreys=1)  # -> OutBox, OutPlane1, OutPlane2, OutPlane3, OutPoint1
g_block2_4 = Block2(InPlane=g_block2_2.OutPlane1, InLength=g_slider3, AddStoreys=g_slider1)  # -> OutBox, OutPlane1, OutPlane2, OutPlane3, OutPoint1
g_block2_5 = Block2(InPlane=g_block2_2.OutPlane2, InLength=g_slider2, AddStoreys=g_slider5)  # -> OutBox, OutPlane1, OutPlane2, OutPlane3, OutPoint1
g_link2 = Link2(InPoint1=g_block2_5.OutPoint1, InPoint2=g_block2_3.OutPoint1)
g_link2_2 = Link2(InPoint1=g_block2_5.OutPlane2, InPoint2=g_block2_4.OutPoint1)
g_block2_6 = Block2(InPlane=g_block2_4.OutPlane1, InLength=1, AddStoreys=1)  # -> OutBox, OutPlane1, OutPlane2, OutPlane3, OutPoint1
g_block2_7 = Block2(InPlane=g_block2_5.OutPlane3, InLength=1, AddStoreys=1)  # -> OutBox, OutPlane1, OutPlane2, OutPlane3, OutPoint1
g_block1 = Block1(InPlane=g_block2_3.OutPlane1, InLength=1)  # -> OutBox, OutPlane1, OutPlane2
g_block2_8 = Block2(InPlane=g_block2_5.OutPlane1, InLength=1, AddStoreys=1)  # -> OutBox, OutPlane1, OutPlane2, OutPlane3, OutPoint1
g_block2_9 = Block2(InPlane=g_block2_7.OutPlane2, InLength=1, AddStoreys=1)  # -> OutBox, OutPlane1, OutPlane2, OutPlane3, OutPoint1
g_block2_10 = Block2(InPlane=g_block2_8.OutPlane3, InLength=1, AddStoreys=1)  # -> OutBox, OutPlane1, OutPlane2, OutPlane3, OutPoint1
g_block2_11 = Block2(InPlane=g_block2_8.OutPlane1, InLength=1, AddStoreys=1)  # -> OutBox, OutPlane1, OutPlane2, OutPlane3, OutPoint1
g_link2_3 = Link2(InPoint1=g_block2_4.OutPlane2, InPoint2=g_block2_11.OutPlane3)
g_link2_4 = Link2(InPoint1=g_block2_11.OutPlane2, InPoint2=g_block2_8.OutPlane2)
get_geometry = GetGeometry(G=[g_block2_2.OutBox, g_block2_5.OutBox, g_block2_4.OutBox, g_block2_3.OutBox, g_block2_8.OutBox, g_link2_2, g_block2_11.OutBox, g_block1.OutBox, g_block2_7.OutBox, g_link2, g_link2_4, g_block2_10.OutBox, g_block2_6.OutBox, g_link2_3, g_block2_9.OutBox, g_block2.OutBox])
number_slider_2 = Slider(23, range=0..100)  # disabled
rec = DataRecorder(DataLimit=-10, RecordData=False)  # disabled
item = ListItem(List=rec, Index=number_slider_2, Wrap=True)  # -> flatten(Item); disabled
number_slider_3 = Slider(40, range=0..100)  # disabled
number_slider_4 = Slider(4, range=0..10)  # disabled
series = Series(Start=number_slider_4, Step=number_slider_4, Count=number_slider_3)  # disabled
xy = XYPlane(Origin=Point(0, 0, 0))  # disabled
Z = UnitZ(Factor=series)  # disabled
move = Move(Geometry=xy, Motion=Z)  # -> Geometry, Transform; disabled
number_slider_5 = Slider(5, range=0..100)  # disabled
number_slider_6 = Slider(3, range=0..100)  # disabled
number_slider_7 = Slider(15, range=0..100)
number_slider_8 = Slider(2, range=0..10)
custom_mesh_settings = SettingsCustom(
    StitchSeams=True,
    SimplePlanes=False,
    Refine=True,
    MinCount=16,
    MaxCount=400,
    AspectRatio=20,
    MaxDistance=0,
    MaxAngle=20,
    MinEdge=number_slider_5,
    MaxEdge=number_slider_6)  # disabled
custom_mesh_settings_2 = SettingsCustom(
    StitchSeams=True,
    SimplePlanes=False,
    Refine=True,
    MinCount=16,
    MaxCount=400,
    AspectRatio=20,
    MaxDistance=0,
    MaxAngle=20,
    MinEdge=number_slider_7,
    MaxEdge=number_slider_7)
mesh = Mesh(<mesh referenced from the Rhino model>)  # disabled
Z_2 = UnitZ(Factor=1)  # disabled
pt_2 = Point(Point(-466.4372875, -524.5035704, 707.998974))  # disabled
pt_3 = Point(Point(28.15146134, -11.85690711, 20.15937565))  # disabled
panel = Panel("0")  # disabled
vec2pt = Vector2Pt(PointA=pt_2, PointB=pt_3, Unitize=False)  # -> Vector, Length; disabled
swatch = ColourSwatch(SwatchColor=RGB(0, 0, 0))  # disabled
swatch_2 = ColourSwatch(SwatchColor=RGBA(91, 147, 240, 182))
number_slider_9 = Slider(6, range=0..10)  # disabled
number_slider_10 = Slider(0.6, range=0..1)  # disabled
swatch_3 = ColourSwatch(SwatchColor=RGB(255, 255, 255))  # disabled
number_slider_11 = Slider(100, range=0..100)  # disabled

bbox = BoundingBox(Content=get_geometry, Plane=PlaneXY(0, 0, 0), UnionBox=True)  # -> Box, Box_2
volume = Volume(Geometry=bbox.Box)  # -> Volume, Centroid
debox = DeconstructBox(Box=bbox.Box)  # -> Plane, X, Y, Z
pdecon = Deconstruct(Point=volume.Centroid)  # -> XComponent, YComponent, ZComponent
pt_4 = Point(Point(5.695311256, 10.86966787, 0))

dedomain = DeconstructDomain(Domain=debox.Z)  # -> Start, End

pt_5 = ConstructPoint(XCoordinate=pdecon.XComponent, YCoordinate=pdecon.YComponent, ZCoordinate=dedomain.Start)
vec2pt_2 = Vector2Pt(PointA=pt_5, PointB=pt_4, Unitize=False)  # -> Vector, Length
move_2 = Move(Geometry=graft(get_geometry), Motion=vec2pt_2.Vector)  # -> flatten(Geometry), Transform
preview = CustomPreview(Geometry=move_2.Geometry, Shader=ColourSwatch(SwatchColor=RGBA(255, 255, 255, 230)))

geo = Geometry(move_2.Geometry)
fastbrepvolume = FastBrepVolume(InputBrep=geo)
ma = MassAddition(Input=fastbrepvolume)  # -> Result, PartialResults
division = Division(A=ma.Result, B=Slider(4, range=0..10))
larger = LargerThan(FirstNumber=fastbrepvolume, SecondNumber=Slider(10000, range=0..10000))  # -> LargerThan, OrEqualTo
int_3 = Integer(division)
scale_nu = ScaleNU(Geometry=geo, Plane=PlaneXY(0, 0, 0), ScaleX=1, ScaleY=1, ScaleZ=Slider(1.5, range=0..10))  # -> Geometry, Transform
brep = Brep(scale_nu.Geometry)  # disabled
debrep = DeconstructBrep(Brep=brep)  # -> Faces, Edges, Vertices; disabled
mesh_2 = MeshBrep(Brep=debrep.Faces, Settings=custom_mesh_settings)  # -> flatten(Mesh); disabled
lng = ListLength(List=scale_nu.Geometry)
sec = BrepPlane(Brep=graft(scale_nu.Geometry), Plane=move.Geometry)  # -> Curves, Points; disabled
one_over_x = OneOverX(Value=lng)
series_2 = Series(Start=0, Step=one_over_x, Count=lng)
dispatch = Dispatch(List=scale_nu.Geometry, DispatchPattern=larger.LargerThan)  # -> ListA, ListB
facen = FaceNormals(Mesh=mesh_2)  # -> flatten(Centers), flatten(Normals); disabled
demesh = DeconstructMesh(Mesh=mesh_2)  # -> flatten(Vertices), Faces, Colours, Normals; disabled
mjoin = MeshJoin(Meshes=mesh_2)  # disabled
sunion = SolidUnion(Breps=dispatch.ListB)
dprod = DotProduct(VectorA=Z_2, VectorB=facen.Normals, Unitize=False)  # disabled
preview_2 = CustomPreview(Geometry=sunion, Shader=ColourSwatch(SwatchColor=RGBA(255, 255, 255, 98)))
preview_3 = CustomPreview(Geometry=dispatch.ListA, Shader=ColourSwatch(SwatchColor=RGB(255, 0, 0)))
mesh_3 = MeshBrep(Brep=scale_nu.Geometry, Settings=custom_mesh_settings_2)
previewmat = CustomPreviewMaterials(
    Geometry=dispatch.ListA,
    DiffuseColor=RGB(255, 255, 255),
    DiffuseBitmap="C:\Users\je3-harding\Documents\Materials\maple_plywood.jpg")
equals = Equality(FirstNumber=dprod, SecondNumber=panel)  # -> Equality, Inequality; disabled
mpipe = MeshPipe(Curve=sec.Curves, Radius=Slider(0.2, range=0..1), Accuracy=0.2, Rotation=0, Segments=Slider(4, range=0..10), Caps=2)  # disabled
dispatch_2 = Dispatch(List=facen.Centers, DispatchPattern=equals.Equality)  # -> ListA, ListB; disabled
m2 = Panel(int_3)
occ = Occlusion(Samples=dispatch_2.ListA, Obstructions=brep, Rays=vec2pt.Vector)  # -> Hits, Occlusion; disabled
preview_4 = CustomPreview(Geometry=mpipe, Shader=swatch)  # disabled
mjoin_2 = MeshJoin(Meshes=mesh_3)
num_2 = Number(m2)
dispatch_3 = Dispatch(List=dispatch_2.ListA, DispatchPattern=occ.Hits)  # -> ListA, ListB; disabled
cluster = Cluster(M=mjoin_2)
mesh_4 = Mesh(flatten([cluster, dispatch.ListA, sunion]))
pt_6 = Point(dispatch_3.ListB)  # disabled
lng_2 = ListLength(List=dispatch_2.ListA)  # disabled
lng_3 = ListLength(List=pt_6)  # disabled
msphere = MeshSphere(Base=pt_6, Radius=number_slider_10, UCount=number_slider_9, VCount=number_slider_9)  # disabled
preview_5 = CustomPreview(Geometry=msphere, Shader=swatch_3)  # disabled
preview_6 = CustomPreview(Geometry=cluster, Shader=ColourSwatch(SwatchColor=RGB(138, 138, 138)))
division_2 = Division(A=lng_3, B=lng_2)  # disabled
multiplication_4 = Multiplication(A=division_2, B=number_slider_11)  # disabled
# Make some columns
# Mesh the thing
biomorpher = Biomorpher(Genome=genes, Geometry=mesh_4, Performance=num_2)
int_4 = Integer(multiplication_4)  # disabled
# Scale in Z to hit target volume
sun = Panel(int_4)  # disabled

# ==== cluster Cluster
M = ClusterInput()
Z = UnitZ(Factor=1)
facen = FaceNormals(Mesh=M)  # -> Centers, Normals
dprod = DotProduct(VectorA=facen.Normals, VectorB=Z, Unitize=True)
smaller = SmallerThan(FirstNumber=dprod, SecondNumber="-0.9")  # -> SmallerThan, OrEqualTo
dispatch = Dispatch(List=facen.Centers, DispatchPattern=smaller.SmallerThan)  # -> ListA, ListB
pdecon = Deconstruct(Point=dispatch.ListA)  # -> XComponent, YComponent, ZComponent
pt = ConstructPoint(XCoordinate=pdecon.XComponent, YCoordinate=pdecon.YComponent, ZCoordinate=0)
ln = Line(StartPoint=dispatch.ListA, EndPoint=pt)
lng = ListLength(List=ln)
multiplication = Multiplication(A=lng, B="0.7")
reduce = RandomReduce(List=ln, Reduction=multiplication, Seed=1)
len = Length(Curve=reduce)
addition = Addition(A=len, B=Slider(0.01, range=0..0.01))
multiplication_2 = Multiplication(A=addition, B=Slider(0.02, range=0..0.1))
mpipe = MeshPipe(Curve=reduce, Radius=multiplication_2, Accuracy=0.2, Rotation=0, Segments=10, Caps=0)
M_2 = ClusterOutput(mpipe)
