# Grasshopper definition towerHamlets02.gh (Grasshopper 0.9.76)
# plug-ins: HDTReference, embryoA

merge = Merge(
    Data1=Slider(0.11, range=0..1),
    Data2=Slider(0.59, range=0..1),
    Data3=Slider(1, range=0..1),
    Data4=Slider(0.54, range=0..1),
    Data5=Slider(0.42, range=0..1),
    Data6=Slider(0.31, range=0..1))
panel = Panel(merge)
item = ListItem(List=panel, Index=0, Wrap=True)  # -> Item, Item1, Item2, Item3, Item4, Item5
expression = Expression(x=item.Item5, Expression="20+(x*120)")
expression_2 = Expression(x=item.Item3, Expression="x*0.5")
crv = Curve(reparameterize([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]))
area = Area(Geometry=crv)  # -> Area, Centroid
scale = Scale(Geometry=crv, Center=area.Centroid, Factor=Slider(0.56, range=0..1))  # -> Geometry, Transform
item_2 = ListItem(List=scale.Geometry, Index=0, Wrap=True)  # -> Item, Item1
dom = ConstructDomain(DomainStart=expression_2, DomainEnd=Slider(1, range=0..1))
number_slider = Slider(6, range=0..10)
seam = Seam(Curve=item_2.Item1, Seam=item.Item4)
seam_2 = Seam(Curve=item_2.Item, Seam=item.Item1)
subcrv = SubCurve(BaseCurve=reparameterize(seam), Domain=dom)
neg = Negative(Value=number_slider)
dom_2 = ConstructDomain(DomainStart=Slider(0.09, range=0..0.5), DomainEnd=Slider(0.35, range=0..1))
dom_3 = ConstructDomain(DomainStart=Slider(0.5, range=0..0.5), DomainEnd=Slider(1, range=0..1))
number_slider_2 = Slider(6, range=0..10)
number_slider_3 = Slider(6, range=0..10)
number_slider_4 = Slider(50, range=0..100)
offset = Offset(Curve=subcrv, Distance=number_slider, Plane=PlaneXY(0, 0, 0), Corners=1)
offset_2 = Offset(Curve=subcrv, Distance=neg, Plane=PlaneXY(0, 0, 0), Corners=1)
subcrv_2 = SubCurve(BaseCurve=reparameterize(seam_2), Domain=dom_2)
subcrv_3 = SubCurve(BaseCurve=reparameterize(seam_2), Domain=dom_3)
number_slider_5 = Slider(10, range=0..10)
neg_2 = Negative(Value=number_slider_2)
number_slider_6 = Slider(2, range=0..10)
expression_3 = Expression(x=item.Item, Expression="20+(x*80)")
neg_3 = Negative(Value=number_slider_3)
expression_4 = Expression(x=item.Item2, Expression="20+(x*80)")
number_slider_7 = Slider(50, range=0..100)
reb = RebuildCurve(Curve=offset, Count=number_slider_4, Tangents=False)
reb_2 = RebuildCurve(Curve=offset_2, Count=number_slider_4, Tangents=False)
number_slider_8 = Slider(50, range=0..100)
offset_3 = Offset(Curve=subcrv_2, Distance=number_slider_2, Plane=PlaneXY(0, 0, 0), Corners=1)
offset_4 = Offset(Curve=subcrv_3, Distance=number_slider_3, Plane=PlaneXY(0, 0, 0), Corners=1)
offset_5 = Offset(Curve=subcrv_2, Distance=neg_2, Plane=PlaneXY(0, 0, 0), Corners=1)
number_slider_9 = Slider(10, range=0..10)
offset_6 = Offset(Curve=subcrv_3, Distance=neg_3, Plane=PlaneXY(0, 0, 0), Corners=1)
number_slider_10 = Slider(10, range=0..10)
number_slider_11 = Slider(2, range=0..10)
item_3 = ListItem(List=offset_5, Index=0, Wrap=True)
number_slider_12 = Slider(2, range=0..10)
item_4 = ListItem(List=offset_6, Index=0, Wrap=True)
reb_3 = RebuildCurve(Curve=offset_3, Count=number_slider_7, Tangents=False)
reb_4 = RebuildCurve(Curve=item_3, Count=number_slider_7, Tangents=False)
reb_5 = RebuildCurve(Curve=offset_4, Count=number_slider_8, Tangents=False)
reb_6 = RebuildCurve(Curve=item_4, Count=number_slider_8, Tangents=False)
Z = UnitZ(Factor=expression)
rulesrf = RuledSurface(CurveA=reb, CurveB=reb_2)
end = EndPoints(Curve=reb_4)  # -> Start, End
end_2 = EndPoints(Curve=reb_6)  # -> Start, End
end_3 = EndPoints(Curve=reb_3)  # -> Start, End
end_4 = EndPoints(Curve=reb_5)  # -> Start, End
Z_2 = UnitZ(Factor=expression_3)
extr = Extrude(Base=rulesrf, Direction=Z)
Z_3 = UnitZ(Factor=expression_4)
brep = Brep(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)
ln = Line(StartPoint=end_3.Start, EndPoint=end.Start)
ln_2 = Line(StartPoint=end_3.End, EndPoint=end.End)
ln_3 = Line(StartPoint=end_4.Start, EndPoint=end_2.Start)
ln_4 = Line(StartPoint=end_4.End, EndPoint=end_2.End)
sdiff = SolidDifference(BrepsA=extr, BrepsB=brep)
merge_2 = Merge(Data1=reb_3, Data2=ln, Data3=reb_4, Data4=ln_2)
merge_3 = Merge(Data1=reb_5, Data2=ln_3, Data3=reb_6, Data4=ln_4)
join = JoinCurves(Curves=merge_2, Preserve=False)
join_2 = JoinCurves(Curves=merge_3, Preserve=False)
extr_2 = Extrude(Base=join, Direction=Z_2)
extr_3 = Extrude(Base=join_2, Direction=Z_3)
cap = CapHoles(Brep=extr_2)
brep_2 = Brep(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)
cap_2 = CapHoles(Brep=extr_3)
merge_4 = Merge(Data1=cap, Data2=cap_2)
sdiff_2 = SolidDifference(BrepsA=merge_4, BrepsB=brep)
sdiff_3 = SolidDifference(BrepsA=sdiff_2, BrepsB=brep_2)
sdiff_4 = SolidDifference(BrepsA=sdiff, BrepsB=brep_2)
merge_5 = Merge(Data1=sdiff_3, Data2=sdiff_4)  # -> flatten(Result)
item_5 = ListItem(List=merge_5, Index=0, Wrap=True)  # -> Item, Item1, Item2
series = Series(Start=0, Step=Slider(4, range=0..10), Count=Slider(37, range=0..100))
Z_4 = UnitZ(Factor=series)
fastbrepvolume = FastBrepVolume(InputBrep=sdiff_3)
fastbrepvolume_2 = FastBrepVolume(InputBrep=sdiff_4)
xy = XYPlane(Origin=Point(0, 0, 0))
preview = CustomPreview(Geometry=item_5.Item, Shader=ColourSwatch(SwatchColor=RGBA(0, 213, 128, 195)))
preview_2 = CustomPreview(Geometry=item_5.Item1, Shader=ColourSwatch(SwatchColor=RGBA(91, 93, 111, 193)))
preview_3 = CustomPreview(Geometry=item_5.Item2, Shader=ColourSwatch(SwatchColor=RGBA(46, 160, 184, 195)))
ma = MassAddition(Input=flatten([fastbrepvolume, fastbrepvolume_2]))  # -> Result, PartialResults
move = Move(Geometry=xy, Motion=Z_4)  # -> Geometry, Transform
division = Division(A=ma.Result, B=Slider(4, range=0..10))
sec = BrepPlane(Brep=graft(sdiff_3), Plane=move.Geometry)  # -> Curves, Points
sec_2 = BrepPlane(Brep=sdiff_4, Plane=move.Geometry)  # -> Curves, Points
panel_2 = Panel(division)
previewlw = CustomPreviewLineweights(
    Geometry=flatten([sec.Curves, sec_2.Curves]),
    Shader=ColourSwatch(SwatchColor=RGB(255, 255, 255)),
    Thickness=Slider(0.34, range=0..1))
geo = Geometry(flatten([sdiff_3, sdiff_4]))
geo_2 = Geometry(flatten([sec.Curves, sec_2.Curves]))
