# Grasshopper definition turtle.gh (Grasshopper 0.9.76)
# plug-ins: Biomorpher

genes = GenePool(
    Decimals=0,
    Maximum=3,
    Minimum=0,
    Value=[2.658312019, 0.2907824061, 1.747598717, 1.704938539, 0.1581024864, 0.9174603186, 0.6763189028, 0.2331214991, 2.403021733, 0.617165074, 2.66455798, 0.392552633, 2.879639324, 2.510463796, 0.08446511025, 1.019379796, 0.05402377437, 0.6438403412, 2.384375696, 1.215572273])
genes_2 = GenePool(
    Decimals=0,
    Maximum=3,
    Minimum=0,
    Value=[2.188924228, 0.07633427162, 2.417102101, 0.1156443288, 1.684861809, 1.706848205, 0.3934285251, 2.532173947, 1.119852783, 0.7717335572, 0.9349127025, 1.738062192, 0.1034895843, 2.040176991, 2.835708762, 2.576444898, 0.3568897598, 0.4496078624, 0.2819254782, 0.4098519843])
entwine = Entwine(Branch00=genes_2, Branch01=genes, FlattenInputs=True)
panel = Panel("""1
2""")
c_script = CSharpScript(x=Slider(0, range=0..10), y=Slider(0, range=0..10), z=entwine)  # -> out, A; inputs x: Int32, y: Int32, z: list of Int32
# ---------- c_script: C# ----------
    List<Point3d> pts = new List<Point3d>();

    int currentX = x;
    int currentY = y;

    pts.Add(new Point3d(currentX, currentY, 0));

    for(int i = 0; i < z.Count; i++)
    {
      switch(z[i])
      {
        case 0:
          currentX++;
          break;
        case 1:
          currentY++;
          break;
        case 2:
          currentX--;
          break;
        case 3:
          currentY--;
          break;
      }

      pts.Add(new Point3d(currentX, currentY, 0));
    }


    Polyline myPoly = new Polyline(pts);
    A = myPoly;
# ---------- end c_script ----------
fillet = Fillet(Curve=flatten(c_script.A), Radius=Slider(0.2, range=0..1))
Z = UnitZ(Factor=panel)
panel_2 = Panel("""magenta
orange""")
extr = Extrude(Base=fillet, Direction=Z)
mesh = Mesh(extr)
preview = CustomPreview(Geometry=extr, Shader=panel_2)
mcol = MeshColours(
    Mesh=mesh,
    Colours=[RGB(127, 255, 0), RGB(0, 100, 0), RGB(34, 139, 34), RGB(124, 252, 0), RGB(154, 205, 50), RGB(173, 255, 47), RGB(50, 205, 50), RGB(152, 251, 152)])
area = Area(Geometry=extr)  # -> Area, Centroid
biomorpher = Biomorpher(Genome=[genes_2, genes], Geometry=mcol, Performance=area.Area)
