# Grasshopper definition untangle.gh (Grasshopper 0.9.76)
# plug-ins: Biomorpher, Mesh Pipe

# Try to untangle the nurbs curve using biomorpher...
genes = GenePool(
    Decimals=2,
    Maximum=100,
    Minimum=0,
    Value=[13.12755286, 64.56027369, 94.53396867, 73.51948012, 37.64421546, 32.33631245, 70.83474042, 15.86487462, 42.28263541, 19.94389669])
genes_2 = GenePool(
    Decimals=2,
    Maximum=100,
    Minimum=0,
    Value=[23.03192579, 17.17690002, 41.61939837, 23.24321942, 11.69811842, 66.92944549, 69.24202976, 32.95433672, 40.70928872, 83.66278223])
genes_3 = GenePool(
    Decimals=2,
    Maximum=100,
    Minimum=0,
    Value=[79.02481443, 34.70792432, 48.65040036, 66.47400482, 34.47722315, 17.71069212, 48.10615063, 96.63722897, 70.88192332, 36.33052103])
pt = ConstructPoint(XCoordinate=genes, YCoordinate=genes_2, ZCoordinate=genes_3)
nurbs = NurbsCurve(Vertices=pt, Degree=3, Periodic=True)  # -> Curve, Length, Domain
mpipe = MeshPipe(Curve=nurbs.Curve, Radius="1", Accuracy=0.2, Rotation=0, Segments=10, Caps=2)
biomorpher = Biomorpher(Genome=[genes, genes_2, genes_3], Geometry=mpipe)
