# Grasshopper definition untanglethread.gh (Grasshopper 0.9.76)
# plug-ins: Biomorpher, Mesh Pipe

# Try to untangle a thread.
# This is a very tricky problem to set an objective function
# (i.e. using Galapagos), but easier if a human can judge
# success at each generation.
# Double click on the biomorpher component to begin.
# Needs meshpipe component.
genes = GenePool(
    Decimals=2,
    Maximum=100,
    Minimum=0,
    Value=[3.149593111, 19.39416901, 0.6018578543, 88.2563678, 22.01405685, 80.56626608, 78.71477845, 45.82127251, 2.085069708, 16.4290662])
genes_2 = GenePool(
    Decimals=2,
    Maximum=100,
    Minimum=0,
    Value=[87.87440527, 30.17699799, 48.47120277, 37.73307667, 46.63402287, 8.443246506, 23.39687125, 32.4531044, 9.895475586, 74.05068496])
genes_3 = GenePool(
    Decimals=2,
    Maximum=100,
    Minimum=0,
    Value=[86.55361607, 48.82047323, 82.17241465, 75.41081373, 92.05434559, 70.88952049, 40.87273029, 42.66657571, 49.73968726, 94.18767062])
pt = ConstructPoint(XCoordinate=genes, YCoordinate=genes_2, ZCoordinate=genes_3)
nurbs = NurbsCurve(Vertices=pt, Degree=3, Periodic=True)  # -> Curve, Length, Domain
len = Length(Curve=nurbs.Curve)
mpipe = MeshPipe(Curve=nurbs.Curve, Radius="1", Accuracy=0.2, Rotation=0, Segments=10, Caps=2)
biomorpher = Biomorpher(Genome=[genes, genes_2, genes_3], Geometry=mpipe, Performance=len)  # -> GenoGuids, Population, Historic, Clusters
